% Simulink data dictionary slprj_FM.sldd
% references sl_ddtypes.sldd

FM_CEngDsT_SRCHi_Fault_ID = Simulink.Parameter(10, StorageClass="Const", HeaderFile="FM.h", DefinitionFile="FM.c", DataType="Fault_ID", Min=0, Max=65535)
FM_CEngDsT_SRCLo_Fault_ID = Simulink.Parameter(11, StorageClass="Const", HeaderFile="FM.h", DefinitionFile="FM.c", DataType="Fault_ID", Min=0, Max=65535)
FM_CEngDsT_PRCHi_Fault_ID = Simulink.Parameter(12, StorageClass="Const", HeaderFile="FM.h", DefinitionFile="FM.c", DataType="Fault_ID", Min=0, Max=65535)
FM_CEngDsT_PRCLo_Fault_ID = Simulink.Parameter(13, StorageClass="Const", HeaderFile="FM.h", DefinitionFile="FM.c", DataType="Fault_ID", Min=0, Max=65535)
FM_All_Fault_Status_Array = Simulink.Signal(StorageClass="Volatile", HeaderFile="FM.h", DefinitionFile="FM.c", DataType="boolean", Min=0, Max=1, Dimensions=[1 100], InitialValue="zeros(1,100)")  % 整个工程所有故障的故障状态数组：数组索引为故障编号，范围为0~65535；数组元素为故障状态，逻辑值，1表示当前故障编号对应故障已确认，0表示无故障或故障已恢复。
FM_Test1_Fault_ID = Simulink.Parameter(1, StorageClass="Const", HeaderFile="FM.h", DefinitionFile="FM.c", DataType="Fault_ID", Min=0, Max=65535)
FM_Test2_Fault_ID = Simulink.Parameter(2, StorageClass="Const", HeaderFile="FM.h", DefinitionFile="FM.c", DataType="Fault_ID", Min=0, Max=65535)
FM_Test3_Fault_ID = Simulink.Parameter(3, StorageClass="Const", HeaderFile="FM.h", DefinitionFile="FM.c", DataType="Fault_ID", Min=0, Max=65535)
FM_Test4_Fault_ID = Simulink.Parameter(4, StorageClass="Const", HeaderFile="FM.h", DefinitionFile="FM.c", DataType="Fault_ID", Min=0, Max=65535)
FM_Default_No_Fault_ID = Simulink.Parameter(0, StorageClass="Const", HeaderFile="FM.h", DefinitionFile="FM.c", DataType="Fault_ID", Min=0, Max=65535)
FM_All_Fault_Code1_Array = Simulink.Signal(StorageClass="Volatile", HeaderFile="FM.h", DefinitionFile="FM.c", DataType="uint16", Min=0, Max=1, Dimensions=[1 100], InitialValue="zeros(1,100)")  % 整个工程所有故障的故障码：数组索引为故障编号，范围为0~65535；数组元素为该故障的故障码。
FM_All_Fault_Code2_Array = Simulink.Signal(StorageClass="Volatile", HeaderFile="FM.h", DefinitionFile="FM.c", DataType="uint16", Min=0, Max=1, Dimensions=[1 100], InitialValue="zeros(1,100)")  % 整个工程所有故障的故障码：数组索引为故障编号，范围为0~65535；数组元素为该故障的故障码。
FM_All_Fault_Code3_Array = Simulink.Signal(StorageClass="Volatile", HeaderFile="FM.h", DefinitionFile="FM.c", DataType="uint16", Min=0, Max=1, Dimensions=[1 100], InitialValue="zeros(1,100)")  % 整个工程所有故障的故障码：数组索引为故障编号，范围为0~65535；数组元素为该故障的故障码。
FM_Present_Fault_Log_Array = Simulink.Signal(StorageClass="Volatile", HeaderFile="FM.h", DefinitionFile="FM.c", DataType="Fault_ID", Min=0, Max=1, Dimensions=[1 20], InitialValue="zeros(1,20)")  % 记录需要往E方里存储的当前已确认的故障：数组索引为序号，范围为0~20，即最大可存储20个故障；数组元素为故障编号。
FM_History_Fault_Log_Array = Simulink.Signal(StorageClass="Volatile", HeaderFile="FM.h", DefinitionFile="FM.c", DataType="Fault_ID", Min=0, Max=1, Dimensions=[1 20], InitialValue="zeros(1,20)")  % 记录需要往E方里存储的历史故障：数组索引为序号，范围为0~20，即最大可存储20个故障；数组元素为故障编号。
FM_Pending_Fault_Log_Array = Simulink.Signal(StorageClass="Volatile", HeaderFile="FM.h", DefinitionFile="FM.c", DataType="Fault_ID", Min=0, Max=1, Dimensions=[1 20], InitialValue="zeros(1,20)")  % 记录需要往E方里存储的潜在故障（还需要经过驾驶循环Debounce确认）：数组索引为序号，范围为0~20，即最大可存储20个故障；数组元素为故障编号。
FM_All_Fault_Class_Array = Simulink.Signal(StorageClass="Volatile", HeaderFile="FM.h", DefinitionFile="FM.c", DataType="uint8", Min=0, Max=1, Dimensions=[1 100], InitialValue="zeros(1,100)")  % 整个工程所有故障的故障所属类别：数组索引为故障编号，范围为0~65535；数组元素为故障所属故障类别。
FM_All_Fault_Priority_Array = Simulink.Signal(StorageClass="Volatile", HeaderFile="FM.h", DefinitionFile="FM.c", DataType="uint8", Min=0, Max=1, Dimensions=[1 100], InitialValue="zeros(1,100)")  % 整个工程所有故障的故障优先级：数组索引为故障编号，范围为0~65535；数组元素为故障的优先级。
FM_EGRVlv_GovDvtMax_Fault_ID = Simulink.Parameter(14, StorageClass="Const", HeaderFile="FM.h", DefinitionFile="FM.c", DataType="Fault_ID", Min=0, Max=65535)
FM_EGRVlv_GovDvtMin_Fault_ID = Simulink.Parameter(15, StorageClass="Const", HeaderFile="FM.h", DefinitionFile="FM.c", DataType="Fault_ID", Min=0, Max=65535)
FM_EGRVlv_SensSRCMax_Fault_ID = Simulink.Parameter(16, StorageClass="Const", HeaderFile="FM.h", DefinitionFile="FM.c", DataType="Fault_ID", Min=0, Max=65535)
FM_EGRVlv_SensSRCMin_Fault_ID = Simulink.Parameter(17, StorageClass="Const", HeaderFile="FM.h", DefinitionFile="FM.c", DataType="Fault_ID", Min=0, Max=65535)
FM_EGRVlv_SensPRCMax_Fault_ID = Simulink.Parameter(18, StorageClass="Const", HeaderFile="FM.h", DefinitionFile="FM.c", DataType="Fault_ID", Min=0, Max=65535)
FM_EGRVlv_SensPRCMin_Fault_ID = Simulink.Parameter(19, StorageClass="Const", HeaderFile="FM.h", DefinitionFile="FM.c", DataType="Fault_ID", Min=0, Max=65535)
FM_RailP_SRCMax_Fault_ID = Simulink.Parameter(20, StorageClass="Const", HeaderFile="FM.h", DefinitionFile="FM.c", DataType="Fault_ID", Min=0, Max=65535)
FM_RailP_SRCMin_Fault_ID = Simulink.Parameter(21, StorageClass="Const", HeaderFile="FM.h", DefinitionFile="FM.c", DataType="Fault_ID", Min=0, Max=65535)
FM_APP1_SRCMax_Fault_ID = Simulink.Parameter(22, StorageClass="Const", HeaderFile="FM.h", DefinitionFile="FM.c", DataType="Fault_ID", Min=0, Max=65535)
FM_APP1_SRCMin_Fault_ID = Simulink.Parameter(23, StorageClass="Const", HeaderFile="FM.h", DefinitionFile="FM.c", DataType="Fault_ID", Min=0, Max=65535)
FM_APP2_SRCMax_Fault_ID = Simulink.Parameter(24, StorageClass="Const", HeaderFile="FM.h", DefinitionFile="FM.c", DataType="Fault_ID", Min=0, Max=65535)
FM_APP2_SRCMin_Fault_ID = Simulink.Parameter(25, StorageClass="Const", HeaderFile="FM.h", DefinitionFile="FM.c", DataType="Fault_ID", Min=0, Max=65535)
FM_Test5_Fault_ID = Simulink.Parameter(5, StorageClass="Const", HeaderFile="FM.h", DefinitionFile="FM.c", DataType="Fault_ID", Min=0, Max=65535)