% Simulink data dictionary sl_const.sldd
% references sl_ddtypes.sldd

TRQ_MAX = Simulink.Parameter(3000, StorageClass="Const", HeaderFile="sl_Const_Paras.h", DefinitionFile="sl_Const_Paras.c", DataType="Torq", Unit="Nm")  % Maxmum Torque
TRQ_MIN = Simulink.Parameter(-3000, StorageClass="Const", HeaderFile="sl_Const_Paras.h", DefinitionFile="sl_Const_Paras.c", DataType="Torq", Unit="Nm")  % Minmum Torque
ERPM_MAX = Simulink.Parameter(10000, StorageClass="Const", HeaderFile="sl_Const_Paras.h", DefinitionFile="sl_Const_Paras.c", DataType="ERPM", Unit="RPM")  % Maxmum Engine Speed