% Simulink data dictionary CEngDsT_VD.sldd
% references slprj_cm.sldd
% references sl_ddtypes.sldd

CEngDsT_tSensFlt = Simulink.Signal(StorageClass="ExportToFile", HeaderFile="CEngDsT_VD_Signals.h", DefinitionFile="CEngDsT_VD_Signals.c", DataType="Temp_C", Min=-200, Max=200, Unit="deg", InitialValue="0")  % engine coolant sensor temperature without speed up
CEngDsT_t = Simulink.Signal(StorageClass="ExportToFile", HeaderFile="CEngDsT_VD_Signals.h", DefinitionFile="CEngDsT_VD_Signals.c", DataType="Temp_C", Min=-200, Max=200, Unit="deg", InitialValue="0")  % engine coolant temperature after filter
CEngDsT_dt = Simulink.Signal(StorageClass="ExportToFile", HeaderFile="CEngDsT_VD_Signals.h", DefinitionFile="CEngDsT_VD_Signals.c", DataType="Temp_C", Min=-200, Max=200, Unit="deg/s", InitialValue="0")  % temperature change rate
CEngDsT_tDflWarm_C = Simulink.Parameter(100, StorageClass="ExportToFile", HeaderFile="CEngDsT_VD_Paras.h", DefinitionFile="CEngDsT_VD_Paras.c", DataType="Temp_C", Min=-200, Max=200, Unit="deg")  % Default downstream engine coolant temperature value for warm engine conditions
CEngDsT_tDflCold_C = Simulink.Parameter(10, StorageClass="ExportToFile", HeaderFile="CEngDsT_VD_Paras.h", DefinitionFile="CEngDsT_VD_Paras.c", DataType="Temp_C", Min=-200, Max=200, Unit="deg")  % Default downstream engine coolant temperature value for cold engine conditions
CEngDsT_RmpSlpPos_C = Simulink.Parameter(3, StorageClass="ExportToFile", HeaderFile="CEngDsT_VD_Paras.h", DefinitionFile="CEngDsT_VD_Paras.c", DataType="uint16", Min=0, Max=200, Unit="ms")  % Parameter for Ramp 1 / Slope if the ramp has to be increased
CEngDsT_RmpSlpNeg_C = Simulink.Parameter(3, StorageClass="ExportToFile", HeaderFile="CEngDsT_VD_Paras.h", DefinitionFile="CEngDsT_VD_Paras.c", DataType="uint16", Min=0, Max=200, Unit="ms")  % Parameter for Ramp 1 / negative ramp slope
CEngDsT_facSerPT1_C = Simulink.Parameter(50, StorageClass="ExportToFile", HeaderFile="CEngDsT_VD_Paras.h", DefinitionFile="CEngDsT_VD_Paras.c", DataType="Fac100", Min=0, Max=99.9985, Unit="NaN")  % Time constant of PT1 filter for coolent Down streem temperature
SigTst_tCEngDsT_C = Simulink.Parameter(20, StorageClass="ExportToFile", HeaderFile="CEngDsT_VD_Paras.h", DefinitionFile="CEngDsT_VD_Paras.c", DataType="Temp_C", Min=-200, Max=200, Unit="deg")  % Set coolent temperature by hand
SigTst_swtCEngDsT_C = Simulink.Parameter(Switch.OFF, StorageClass="ExportToFile", HeaderFile="CEngDsT_VD_Paras.h", DefinitionFile="CEngDsT_VD_Paras.c", DataType="Enum: Switch", Unit="NaN")  % Switch for coolent temperature by hand