% Simulink data dictionary EGRVlv_DD.sldd
% references slprj_cm.sldd
% references sl_ddtypes.sldd

EGRVlv_rPs = Simulink.Signal(StorageClass="ExportToFile", HeaderFile="EGRVlv_DD_Signals.h", DefinitionFile="EGRVlv_DD_Signals.c", DataType="DutyCycle", Min=-100, Max=100, Unit="%", InitialValue="0")  % Duty cycle to power stage
EGRVlv_rPsNrm = Simulink.Signal(StorageClass="ExportToFile", HeaderFile="EGRVlv_DD_Signals.h", DefinitionFile="EGRVlv_DD_Signals.c", DataType="DutyCycle", Min=-100, Max=100, Unit="%", InitialValue="0")  % Normalized value of EGRVLv_rPSNrm
EGRVlv_tiPs = Simulink.Signal(StorageClass="ExportToFile", HeaderFile="EGRVlv_DD_Signals.h", DefinitionFile="EGRVlv_DD_Signals.c", DataType="Period_us", Min=0, Max=6000, Unit="us", InitialValue="0")  % signal period duration
EGRVlv_facCorFltPWM_mp = Simulink.Signal(StorageClass="ExportToFile", HeaderFile="EGRVlv_DD_Signals.h", DefinitionFile="EGRVlv_DD_Signals.c", DataType="Fac_100", Min=-32, Max=31.9, Unit="NaN", InitialValue="0")  % Measurement point for battery correction factor for single flow implementation
EGRVlv_rCnvInPWM_mp = Simulink.Signal(StorageClass="ExportToFile", HeaderFile="EGRVlv_DD_Signals.h", DefinitionFile="EGRVlv_DD_Signals.c", DataType="DutyCycle", Min=-100, Max=100, Unit="%", InitialValue="0")  % Measurement point for input of the curve
EGRVlv_rCnvPWM_mp = Simulink.Signal(StorageClass="ExportToFile", HeaderFile="EGRVlv_DD_Signals.h", DefinitionFile="EGRVlv_DD_Signals.c", DataType="DutyCycle", Min=-100, Max=100, Unit="%", InitialValue="0")  % Measurement point for output of the curve for single flow implementation
EGRVlv_rPsPWM = Simulink.Signal(StorageClass="ExportToFile", HeaderFile="EGRVlv_DD_Signals.h", DefinitionFile="EGRVlv_DD_Signals.c", DataType="DutyCycle", Min=-100, Max=100, Unit="%", InitialValue="0")  % Duty cycle to power stage
EGRVlv_rPsNrmPWM = Simulink.Signal(StorageClass="ExportToFile", HeaderFile="EGRVlv_DD_Signals.h", DefinitionFile="EGRVlv_DD_Signals.c", DataType="DutyCycle", Min=-100, Max=100, Unit="%", InitialValue="0")  % Normalized value of EGRVLv_rPSNrm
EGRVlv_facCorFltHb_mp = Simulink.Signal(StorageClass="ExportToFile", HeaderFile="EGRVlv_DD_Signals.h", DefinitionFile="EGRVlv_DD_Signals.c", DataType="Fac_100", Min=-32, Max=31.9, Unit="NaN", InitialValue="0")  % Measurement point for battery correction factor for single flow implementation
EGRVlv_rCnvInHb_mp = Simulink.Signal(StorageClass="ExportToFile", HeaderFile="EGRVlv_DD_Signals.h", DefinitionFile="EGRVlv_DD_Signals.c", DataType="DutyCycle", Min=-100, Max=100, Unit="%", InitialValue="0")  % Measurement point for input of the curve
EGRVlv_rCnvHb_mp = Simulink.Signal(StorageClass="ExportToFile", HeaderFile="EGRVlv_DD_Signals.h", DefinitionFile="EGRVlv_DD_Signals.c", DataType="DutyCycle", Min=-100, Max=100, Unit="%", InitialValue="0")  % Measurement point for output of the curve for single flow implementation
EGRVlv_rPsHb = Simulink.Signal(StorageClass="ExportToFile", HeaderFile="EGRVlv_DD_Signals.h", DefinitionFile="EGRVlv_DD_Signals.c", DataType="DutyCycle", Min=-100, Max=100, Unit="%", InitialValue="0")  % Duty cycle to power stage
EGRVlv_rPsNrmHb = Simulink.Signal(StorageClass="ExportToFile", HeaderFile="EGRVlv_DD_Signals.h", DefinitionFile="EGRVlv_DD_Signals.c", DataType="DutyCycle", Min=-100, Max=100, Unit="%", InitialValue="0")  % Normalized value of EGRVLv_rPSNrm
EGRVlv_swtHwSel_C = Simulink.Parameter(1, StorageClass="ExportToFile", HeaderFile="EGRVlv_DD_Paras.h", DefinitionFile="EGRVlv_DD_Paras.c", DataType="boolean", Min=0, Max=1, Unit="NaN")  % Switch to select between CJ945/TLE6244 and CJ230/TLE7209 power stages
EGRVlv_facBattCorFacFlt_C = Simulink.Parameter(50, StorageClass="ExportToFile", HeaderFile="EGRVlv_DD_Paras.h", DefinitionFile="EGRVlv_DD_Paras.c", DataType="Fac_100", Min=0, Max=99.9985, Unit="NaN")  % PT1 filter factor for the battery voltage correction filter
EGRVlv_facCorStrt_C = Simulink.Parameter(0.8, StorageClass="ExportToFile", HeaderFile="EGRVlv_DD_Paras.h", DefinitionFile="EGRVlv_DD_Paras.c", DataType="Fac_100", Min=-32, Max=31.9, Unit="NaN")  % Correction factor compensation in Start state
EGRVlv_stPwrStgDiaDis_C = Simulink.Parameter(0, StorageClass="ExportToFile", HeaderFile="EGRVlv_DD_Paras.h", DefinitionFile="EGRVlv_DD_Paras.c", DataType="uint16", Min=0, Max=65535, Unit="NaN")  % Mask to select power stage diagnosis disable conditions
EGRVlv_swtPwmOutBattCor_C = Simulink.Parameter(0, StorageClass="ExportToFile", HeaderFile="EGRVlv_DD_Paras.h", DefinitionFile="EGRVlv_DD_Paras.c", DataType="boolean", Min=0, Max=1, Unit="NaN")  % Devlib diagnosis parameter structure / Switch to enable battery correction
EGRVlv_stPwrStgDis_C = Simulink.Parameter(0, StorageClass="ExportToFile", HeaderFile="EGRVlv_DD_Paras.h", DefinitionFile="EGRVlv_DD_Paras.c", DataType="uint16", Min=0, Max=65535, Unit="NaN")  % Mask to select power stage disable conditions
EGRVlv_rPwmOutMin_C = Simulink.Parameter(0, StorageClass="ExportToFile", HeaderFile="EGRVlv_DD_Paras.h", DefinitionFile="EGRVlv_DD_Paras.c", DataType="DutyCycle", Min=-100, Max=100, Unit="%")  % Devlib diagnosis parameter structure / Minimum threshold for the duty cycle
EGRVlv_rPwmOutMax_C = Simulink.Parameter(0, StorageClass="ExportToFile", HeaderFile="EGRVlv_DD_Paras.h", DefinitionFile="EGRVlv_DD_Paras.c", DataType="DutyCycle", Min=-100, Max=100, Unit="%")  % Devlib diagnosis parameter structure / Maximum threshold for the duty cycle
EGRVlv_rCnvPWM_MAP = Simulink.Parameter(repmat(1, 16, 16), StorageClass="ExportToFile", HeaderFile="EGRVlv_DD_Paras.h", DefinitionFile="EGRVlv_DD_Paras.c", DataType="DutyCycle", Min=-100, Max=100, Unit="%")  % Pulsation correction map
EGRVlv_rCnvPWM_MAPX = Simulink.Parameter([0 6 13 15 25 28 35 39 48 57 68 78 84 94 97 99], StorageClass="ExportToFile", HeaderFile="EGRVlv_DD_Paras.h", DefinitionFile="EGRVlv_DD_Paras.c", DataType="DutyCycle", Min=-100, Max=100, Unit="%")  % X Axis Points of Map
EGRVlv_rCnvPWM_MAPY = Simulink.Parameter([0 350 700 1050 1400 1750 2100 2450 2800 3150 3500 3850 4200 4550 4900 5250], StorageClass="ExportToFile", HeaderFile="EGRVlv_DD_Paras.h", DefinitionFile="EGRVlv_DD_Paras.c", DataType="ERPM", Min=0, Max=6000, Unit="rpm")  % Y Axis Points of Map
EGRVlv_rCnvPsNrmPWM_CUR = Simulink.Parameter([0 6 13 15 25 28 35 39 48 57 68 78 84 94 97 99], StorageClass="ExportToFile", HeaderFile="EGRVlv_DD_Paras.h", DefinitionFile="EGRVlv_DD_Paras.c", DataType="DutyCycle", Min=-100, Max=100, Unit="%")  % Normalized correction curve
EGRVlv_rCnvPsNrmPWM_CURX = Simulink.Parameter([0 6 13 15 25 28 35 39 48 57 68 78 84 94 97 99], StorageClass="ExportToFile", HeaderFile="EGRVlv_DD_Paras.h", DefinitionFile="EGRVlv_DD_Paras.c", DataType="DutyCycle", Min=-100, Max=100, Unit="%")  % X Axis Points of curve
EGRVlv_rCnvHb_MAP = Simulink.Parameter(repmat(1, 16, 16), StorageClass="ExportToFile", HeaderFile="EGRVlv_DD_Paras.h", DefinitionFile="EGRVlv_DD_Paras.c", DataType="DutyCycle", Min=-100, Max=100, Unit="%")  % Pulsation correction map
EGRVlv_rCnvHb_MAPX = Simulink.Parameter([0 6 13 15 25 28 35 39 48 57 68 78 84 94 97 99], StorageClass="ExportToFile", HeaderFile="EGRVlv_DD_Paras.h", DefinitionFile="EGRVlv_DD_Paras.c", DataType="DutyCycle", Min=-100, Max=100, Unit="%")  % X Axis Points of Map
EGRVlv_rCnvHb_MAPY = Simulink.Parameter([0 350 700 1050 1400 1750 2100 2450 2800 3150 3500 3850 4200 4550 4900 5250], StorageClass="ExportToFile", HeaderFile="EGRVlv_DD_Paras.h", DefinitionFile="EGRVlv_DD_Paras.c", DataType="ERPM", Min=0, Max=6000, Unit="rpm")  % Y Axis Points of Map
EGRVlv_rCnvPsNrmHb_CUR = Simulink.Parameter([0 6 13 15 25 28 35 39 48 57 68 78 84 94 97 99], StorageClass="ExportToFile", HeaderFile="EGRVlv_DD_Paras.h", DefinitionFile="EGRVlv_DD_Paras.c", DataType="DutyCycle", Min=-100, Max=100, Unit="%")  % Normalized correction curve
EGRVlv_rCnvPsNrmHb_CURX = Simulink.Parameter([0 6 13 15 25 28 35 39 48 57 68 78 84 94 97 99], StorageClass="ExportToFile", HeaderFile="EGRVlv_DD_Paras.h", DefinitionFile="EGRVlv_DD_Paras.c", DataType="DutyCycle", Min=-100, Max=100, Unit="%")  % X Axis Points of curve
EGRVlv_tiPs_C = Simulink.Parameter(0, StorageClass="ExportToFile", HeaderFile="EGRVlv_DD_Paras.h", DefinitionFile="EGRVlv_DD_Paras.c", DataType="Period_us", Min=0, Max=6000, Unit="us")  % signal period duration