% Simulink data dictionary EGRVlv_VDMon.sldd
% references slprj_cm.sldd
% references sl_ddtypes.sldd

EGRVlv_rRlsEGR = Simulink.Signal(StorageClass="ExportToFile", HeaderFile="EGRVlv_VDMon_Signals.h", DefinitionFile="EGRVlv_VDMon_Signals.c", DataType="DutyCycle", Min=-100, Max=100, Unit="%", InitialValue="0")  % Additional control value to release a jammed valve
EGRVlv_stMon = Simulink.Signal(StorageClass="ExportToFile", HeaderFile="EGRVlv_VDMon_Signals.h", DefinitionFile="EGRVlv_VDMon_Signals.c", DataType="State2", Min=0, Max=65535, Unit="NaN", InitialValue="0")  % State of system monitoring
EGRVlv_bJamVlvClsd_DSM = Simulink.Signal(StorageClass="ExportToFile", HeaderFile="EGRVlv_VDMon_Signals.h", DefinitionFile="EGRVlv_VDMon_Signals.c", DataType="boolean", Min=0, Max=1, Unit="NaN", InitialValue="0")  % Status of EGRVlv_bJamVlvClsd
EGRVlv_bJamVlvOpn_DSM = Simulink.Signal(StorageClass="ExportToFile", HeaderFile="EGRVlv_VDMon_Signals.h", DefinitionFile="EGRVlv_VDMon_Signals.c", DataType="boolean", Min=0, Max=1, Unit="NaN", InitialValue="0")  % Status of EGRVlv_bJamVlvOpn
EGRVlv_bGovDvtMaxDeb_DSM = Simulink.Signal(StorageClass="ExportToFile", HeaderFile="EGRVlv_VDMon_Signals.h", DefinitionFile="EGRVlv_VDMon_Signals.c", DataType="boolean", Min=0, Max=1, Unit="NaN", InitialValue="0")  % Status of EGRVlv_bGovDvtMaxDeb
EGRVlv_bGovDvtMinDeb_DSM = Simulink.Signal(StorageClass="ExportToFile", HeaderFile="EGRVlv_VDMon_Signals.h", DefinitionFile="EGRVlv_VDMon_Signals.c", DataType="boolean", Min=0, Max=1, Unit="NaN", InitialValue="0")  % Status of EGRVlv_bGovDvtMinDeb
EGRVlv_stJamVlv = Simulink.Signal(StorageClass="ExportToFile", HeaderFile="EGRVlv_VDMon_Signals.h", DefinitionFile="EGRVlv_VDMon_Signals.c", DataType="boolean", Min=0, Max=1, Unit="NaN", InitialValue="0")  % Status indicates that the valve is jammed
EGRVlv_drRawFlt = Simulink.Signal(StorageClass="ExportToFile", HeaderFile="EGRVlv_VDMon_Signals.h", DefinitionFile="EGRVlv_VDMon_Signals.c", DataType="DutyCycle", Min=-100, Max=100, Unit="r/s", InitialValue="0")  % EGR rate gradient calculated over current position after PT1-filtering
EGRVlv_stEnaMon = Simulink.Signal(StorageClass="ExportToFile", HeaderFile="EGRVlv_VDMon_Signals.h", DefinitionFile="EGRVlv_VDMon_Signals.c", DataType="boolean", Min=0, Max=1, Unit="NaN", InitialValue="0")  % Enable condition
EGRVlv_stJamVlv_mp = Simulink.Signal(StorageClass="ExportToFile", HeaderFile="EGRVlv_VDMon_Signals.h", DefinitionFile="EGRVlv_VDMon_Signals.c", DataType="boolean", Min=0, Max=1, Unit="NaN", InitialValue="0")  % Status indicates that the valve is jammed
EGRVlv_tEngMon_mp = Simulink.Signal(StorageClass="ExportToFile", HeaderFile="EGRVlv_VDMon_Signals.h", DefinitionFile="EGRVlv_VDMon_Signals.c", DataType="Temp_C", Min=-3000, Max=3000, Unit="deg", InitialValue="0")  % Engine monitoring temperature
EGRVlv_numLckdDet = Simulink.Signal(StorageClass="ExportToFile", HeaderFile="EGRVlv_VDMon_Signals.h", DefinitionFile="EGRVlv_VDMon_Signals.c", DataType="State", Min=0, Max=255, Unit="NaN", InitialValue="0")  % Number of tasks since constant governor deviation at LMS
EGRVlv_stLMSDet = Simulink.Signal(StorageClass="ExportToFile", HeaderFile="EGRVlv_VDMon_Signals.h", DefinitionFile="EGRVlv_VDMon_Signals.c", DataType="boolean", Min=0, Max=1, Unit="NaN", InitialValue="0")  % Status of LMS detection
EGRVlv_stStepDet = Simulink.Signal(StorageClass="ExportToFile", HeaderFile="EGRVlv_VDMon_Signals.h", DefinitionFile="EGRVlv_VDMon_Signals.c", DataType="boolean", Min=0, Max=1, Unit="NaN", InitialValue="0")  % Status of step detection
EGRVlv_bJamVlvRlsCheck_mp = Simulink.Signal(StorageClass="ExportToFile", HeaderFile="EGRVlv_VDMon_Signals.h", DefinitionFile="EGRVlv_VDMon_Signals.c", DataType="boolean", Min=0, Max=1, Unit="NaN", InitialValue="0")  % Set bit 10 of EGRVlv_stMon
EGRVlv_numJamVlv_mp = Simulink.Signal(StorageClass="ExportToFile", HeaderFile="EGRVlv_VDMon_Signals.h", DefinitionFile="EGRVlv_VDMon_Signals.c", DataType="State", Min=0, Max=255, Unit="NaN", InitialValue="0")  % The number of jammed valve releasing
EGRVlv_drRaw_mp = Simulink.Signal(StorageClass="ExportToFile", HeaderFile="EGRVlv_VDMon_Signals.h", DefinitionFile="EGRVlv_VDMon_Signals.c", DataType="DutyCycle", Min=-100, Max=100, Unit="r/s", InitialValue="0")  % EGR rate gradient calculated over current position
EGRVlv_rDvtMax_C = Simulink.Parameter(10, StorageClass="ExportToFile", HeaderFile="EGRVlv_VDMon_Paras.h", DefinitionFile="EGRVlv_VDMon_Paras.c", DataType="DutyCycle", Min=-100, Max=100, Unit="%")  % Threshold for detection of positive governor deviation
EGRVlv_rDvtMin_C = Simulink.Parameter(5, StorageClass="ExportToFile", HeaderFile="EGRVlv_VDMon_Paras.h", DefinitionFile="EGRVlv_VDMon_Paras.c", DataType="DutyCycle", Min=-100, Max=100, Unit="%")  % Threshold for detection of negative governor deviation
EGRVlv_tiGovDvtMaxDebDef_C = Simulink.Parameter(200, StorageClass="ExportToFile", HeaderFile="EGRVlv_VDMon_Paras.h", DefinitionFile="EGRVlv_VDMon_Paras.c", DataType="Debncd_ms", Min=0, Max=6553.5, Unit="ms")  % Debounce time for checking heal of EGRVlv_bGovDvtMaxDeb
EGRVlv_tiGovDvtMaxDebOk_C = Simulink.Parameter(200, StorageClass="ExportToFile", HeaderFile="EGRVlv_VDMon_Paras.h", DefinitionFile="EGRVlv_VDMon_Paras.c", DataType="Debncd_ms", Min=0, Max=6553.5, Unit="ms")  % Debounce time for checking heal of EGRVlv_bGovDvtMaxDeb
EGRVlv_tiGovDvtMinDebDef_C = Simulink.Parameter(200, StorageClass="ExportToFile", HeaderFile="EGRVlv_VDMon_Paras.h", DefinitionFile="EGRVlv_VDMon_Paras.c", DataType="Debncd_ms", Min=0, Max=6553.5, Unit="ms")  % Debounce time for checking heal of EGRVlv_bGovDvtMinDeb
EGRVlv_tiGovDvtMinDebOk_C = Simulink.Parameter(200, StorageClass="ExportToFile", HeaderFile="EGRVlv_VDMon_Paras.h", DefinitionFile="EGRVlv_VDMon_Paras.c", DataType="Debncd_ms", Min=0, Max=6553.5, Unit="ms")  % Debounce time for checking heal of EGRVlv_bGovDvtMinDeb
EGRVlv_tiRls_C = Simulink.Parameter(1, StorageClass="ExportToFile", HeaderFile="EGRVlv_VDMon_Paras.h", DefinitionFile="EGRVlv_VDMon_Paras.c", DataType="Seconds1", Min=0, Max=3000, Unit="s")  % Time during which release function is active
EGRVlv_tiRepRls_C = Simulink.Parameter(1, StorageClass="ExportToFile", HeaderFile="EGRVlv_VDMon_Paras.h", DefinitionFile="EGRVlv_VDMon_Paras.c", DataType="Seconds1", Min=0, Max=3000, Unit="s")  % Time for releasing jammed valve condition
EGRVlv_rJamVlvOpnLo_C = Simulink.Parameter(8, StorageClass="ExportToFile", HeaderFile="EGRVlv_VDMon_Paras.h", DefinitionFile="EGRVlv_VDMon_Paras.c", DataType="DutyCycle", Min=-100, Max=100, Unit="%")  % Lower threshold for hysterisis for eliminating noise effect in the sensed position
EGRVlv_rJamVlvOpnHi_C = Simulink.Parameter(10, StorageClass="ExportToFile", HeaderFile="EGRVlv_VDMon_Paras.h", DefinitionFile="EGRVlv_VDMon_Paras.c", DataType="DutyCycle", Min=-100, Max=100, Unit="%")  % Upper threshold for hysterisis for eliminating noise effect in the sensed position
EGRVlv_rJamVlvOpnDemMax_C = Simulink.Parameter(2, StorageClass="ExportToFile", HeaderFile="EGRVlv_VDMon_Paras.h", DefinitionFile="EGRVlv_VDMon_Paras.c", DataType="DutyCycle", Min=-100, Max=100, Unit="%")  % Demand threshold detection for jammed valve in the open state
EGRVlv_RlsIKi_C = Simulink.Parameter(5, StorageClass="ExportToFile", HeaderFile="EGRVlv_VDMon_Paras.h", DefinitionFile="EGRVlv_VDMon_Paras.c", DataType="Fac_100", Min=-128, Max=127.9, Unit="%/(mg/hub)/s")  % Ki for the release integrator
EGRVlv_rRlsMax_C = Simulink.Parameter(80, StorageClass="ExportToFile", HeaderFile="EGRVlv_VDMon_Paras.h", DefinitionFile="EGRVlv_VDMon_Paras.c", DataType="DutyCycle", Min=-100, Max=100, Unit="%")  % Maximum output for release function
EGRVlv_numMonEngTemp_C = Simulink.Parameter(0, StorageClass="ExportToFile", HeaderFile="EGRVlv_VDMon_Paras.h", DefinitionFile="EGRVlv_VDMon_Paras.c", DataType="State", Min=0, Max=255, Unit="NaN")  % Index for selecting the engine temperature
EGRVlv_tEngLo_C = Simulink.Parameter(150, StorageClass="ExportToFile", HeaderFile="EGRVlv_VDMon_Paras.h", DefinitionFile="EGRVlv_VDMon_Paras.c", DataType="Temp_C", Min=-3000, Max=3000, Unit="deg")  % Lower temperature threshold for the release of the monitoring of abnormality in the EGR regulation
EGRVlv_tEngHi_C = Simulink.Parameter(200, StorageClass="ExportToFile", HeaderFile="EGRVlv_VDMon_Paras.h", DefinitionFile="EGRVlv_VDMon_Paras.c", DataType="Temp_C", Min=-3000, Max=3000, Unit="deg")  % Upper temperature threshold for the release of the monitoring of abnormality in the EGR regulation
EGRVlv_numLckdDetThres_C = Simulink.Parameter(0, StorageClass="ExportToFile", HeaderFile="EGRVlv_VDMon_Paras.h", DefinitionFile="EGRVlv_VDMon_Paras.c", DataType="State", Min=0, Max=255, Unit="NaN")  % Locked detection threshold
EGRVlv_rLMSThresDwn_C = Simulink.Parameter(5, StorageClass="ExportToFile", HeaderFile="EGRVlv_VDMon_Paras.h", DefinitionFile="EGRVlv_VDMon_Paras.c", DataType="DutyCycle", Min=-100, Max=100, Unit="%")  % Set point threshold to detect LMS
EGRVlv_rLckdDetThres_C = Simulink.Parameter(5, StorageClass="ExportToFile", HeaderFile="EGRVlv_VDMon_Paras.h", DefinitionFile="EGRVlv_VDMon_Paras.c", DataType="DutyCycle", Min=-100, Max=100, Unit="%")  % Locked detection threshold ratio
EGRVlv_rLMSActThresDwn_C = Simulink.Parameter(5, StorageClass="ExportToFile", HeaderFile="EGRVlv_VDMon_Paras.h", DefinitionFile="EGRVlv_VDMon_Paras.c", DataType="DutyCycle", Min=-100, Max=100, Unit="%")  % Actual position threshold to detect LMS
EGRVlv_rLMSActPosThresInit_C = Simulink.Parameter(3, StorageClass="ExportToFile", HeaderFile="EGRVlv_VDMon_Paras.h", DefinitionFile="EGRVlv_VDMon_Paras.c", DataType="DutyCycle", Min=-100, Max=100, Unit="%")  % positive threshold
EGRVlv_rStpThres_C = Simulink.Parameter(2, StorageClass="ExportToFile", HeaderFile="EGRVlv_VDMon_Paras.h", DefinitionFile="EGRVlv_VDMon_Paras.c", DataType="DutyCycle", Min=-100, Max=100, Unit="%")  % Threshold for step detection
EGRVlv_tiLMS_C = Simulink.Parameter(1, StorageClass="ExportToFile", HeaderFile="EGRVlv_VDMon_Paras.h", DefinitionFile="EGRVlv_VDMon_Paras.c", DataType="Seconds1", Min=0, Max=3000, Unit="s")  % Time during which pull down is active
EGRVlv_rLMSThresUp_C = Simulink.Parameter(10, StorageClass="ExportToFile", HeaderFile="EGRVlv_VDMon_Paras.h", DefinitionFile="EGRVlv_VDMon_Paras.c", DataType="DutyCycle", Min=-100, Max=100, Unit="%")  % Threshold to reset LMS detection bit
EGRVlv_numJamVlv_C = Simulink.Parameter(2, StorageClass="ExportToFile", HeaderFile="EGRVlv_VDMon_Paras.h", DefinitionFile="EGRVlv_VDMon_Paras.c", DataType="State", Min=0, Max=100, Unit="NaN")  % The maxmum number of anti-stuck execution times
EGRVlv_drActDvt_C = Simulink.Parameter(2, StorageClass="ExportToFile", HeaderFile="EGRVlv_VDMon_Paras.h", DefinitionFile="EGRVlv_VDMon_Paras.c", DataType="DutyCycle", Min=-100, Max=100, Unit="r/s")  % EGR position gradient to detect deviation fault
EGRVlv_drActDvtHi_C = Simulink.Parameter(4, StorageClass="ExportToFile", HeaderFile="EGRVlv_VDMon_Paras.h", DefinitionFile="EGRVlv_VDMon_Paras.c", DataType="DutyCycle", Min=-100, Max=100, Unit="r/s")  % EGR position gradient to undetect deviation fault