% Simulink data dictionary EGRVlv_VDPosGov.sldd
% references slprj_cm.sldd
% references sl_ddtypes.sldd

EGRVlv_rEGR = Simulink.Signal(StorageClass="ExportToFile", HeaderFile="EGRVlv_VDPosGov_Signals.h", DefinitionFile="EGRVlv_VDPosGov_Signals.c", DataType="DutyCycle", Min=-100, Max=100, Unit="%", InitialValue="0")  % Control value for the EGR valve
EGRVlv_rGovDesVal = Simulink.Signal(StorageClass="ExportToFile", HeaderFile="EGRVlv_VDPosGov_Signals.h", DefinitionFile="EGRVlv_VDPosGov_Signals.c", DataType="DutyCycle", Min=-100, Max=100, Unit="%", InitialValue="0")  % Internal desired value for governor
EGRVlv_rGovDvt = Simulink.Signal(StorageClass="ExportToFile", HeaderFile="EGRVlv_VDPosGov_Signals.h", DefinitionFile="EGRVlv_VDPosGov_Signals.c", DataType="DutyCycle", Min=-100, Max=100, Unit="%", InitialValue="0")  % Control deviation
EGRVlv_rOutD_mp = Simulink.Signal(StorageClass="ExportToFile", HeaderFile="EGRVlv_VDPosGov_Signals.h", DefinitionFile="EGRVlv_VDPosGov_Signals.c", DataType="DutyCycle", Min=-100, Max=100, Unit="%", InitialValue="0")  % measurement point for D governor for single flow implementation
EGRVlv_rGovEGR = Simulink.Signal(StorageClass="ExportToFile", HeaderFile="EGRVlv_VDPosGov_Signals.h", DefinitionFile="EGRVlv_VDPosGov_Signals.c", DataType="DutyCycle", Min=-100, Max=100, Unit="%", InitialValue="0")  % Control value from the governor
EGRVlv_rOutP_mp = Simulink.Signal(StorageClass="ExportToFile", HeaderFile="EGRVlv_VDPosGov_Signals.h", DefinitionFile="EGRVlv_VDPosGov_Signals.c", DataType="DutyCycle", Min=-100, Max=100, Unit="%", InitialValue="0")  % measurement point for P governor for single flow implementation
EGRVlv_rOutI_mp = Simulink.Signal(StorageClass="ExportToFile", HeaderFile="EGRVlv_VDPosGov_Signals.h", DefinitionFile="EGRVlv_VDPosGov_Signals.c", DataType="DutyCycle", Min=-100, Max=100, Unit="%", InitialValue="0")  % measurement point for I governor for single flow implementation
EGRVlv_rDesValNrm = Simulink.Signal(StorageClass="ExportToFile", HeaderFile="EGRVlv_VDPosGov_Signals.h", DefinitionFile="EGRVlv_VDPosGov_Signals.c", DataType="DutyCycle", Min=-100, Max=100, Unit="%", InitialValue="0")  % Normalized desired value
EGRVlv_rDesLMS = Simulink.Signal(StorageClass="ExportToFile", HeaderFile="EGRVlv_VDPosGov_Signals.h", DefinitionFile="EGRVlv_VDPosGov_Signals.c", DataType="DutyCycle", Min=-100, Max=100, Unit="%", InitialValue="0")  % Desired value from LMS control
EGRVlv_stClnUp = Simulink.Signal(StorageClass="ExportToFile", HeaderFile="EGRVlv_VDPosGov_Signals.h", DefinitionFile="EGRVlv_VDPosGov_Signals.c", DataType="State", Min=0, Max=255, Unit="NaN", InitialValue="0")  % Status of valvle cleanup function
EGRVlv_rGovDvtRel = Simulink.Signal(StorageClass="ExportToFile", HeaderFile="EGRVlv_VDPosGov_Signals.h", DefinitionFile="EGRVlv_VDPosGov_Signals.c", DataType="DutyCycle", Min=-100, Max=100, Unit="%", InitialValue="0")  % Relative governor deviation for OBD purpose
EGRVlv_stClnUpMchn = Simulink.Signal(StorageClass="ExportToFile", HeaderFile="EGRVlv_VDPosGov_Signals.h", DefinitionFile="EGRVlv_VDPosGov_Signals.c", DataType="State", Min=0, Max=255, Unit="NaN", InitialValue="0")  % Status of cleanup state machine
EGRVlv_stOfsLrnTrgClnUp = Simulink.Signal(StorageClass="ExportToFile", HeaderFile="EGRVlv_VDPosGov_Signals.h", DefinitionFile="EGRVlv_VDPosGov_Signals.c", DataType="boolean", Min=0, Max=1, Unit="NaN", InitialValue="0")  % Offset learning trigger from EGR valve cleanup function
EGRVlv_swtEGRTyp = Simulink.Signal(StorageClass="ExportToFile", HeaderFile="EGRVlv_VDPosGov_Signals.h", DefinitionFile="EGRVlv_VDPosGov_Signals.c", DataType="State", Min=0, Max=255, Unit="NaN", InitialValue="0")  % Type of EGR actuator used
EGRVlv_drAct_mp = Simulink.Signal(StorageClass="ExportToFile", HeaderFile="EGRVlv_VDPosGov_Signals.h", DefinitionFile="EGRVlv_VDPosGov_Signals.c", DataType="DutyCycle", Min=-100, Max=100, Unit="%/s", InitialValue="0")  % Valve velocity
EGRVlv_stSlwCls = Simulink.Signal(StorageClass="ExportToFile", HeaderFile="EGRVlv_VDPosGov_Signals.h", DefinitionFile="EGRVlv_VDPosGov_Signals.c", DataType="boolean", Min=0, Max=1, Unit="NaN", InitialValue="0")  % Status of slow close detection
EGRVlv_KpPar = Simulink.Signal(StorageClass="ExportToFile", HeaderFile="EGRVlv_VDPosGov_Signals.h", DefinitionFile="EGRVlv_VDPosGov_Signals.c", DataType="Fac_100", Min=-100, Max=100, Unit="%/(mg/hub)", InitialValue="0")  % P-Gain of the PID controller
EGRVlv_KiPar = Simulink.Signal(StorageClass="ExportToFile", HeaderFile="EGRVlv_VDPosGov_Signals.h", DefinitionFile="EGRVlv_VDPosGov_Signals.c", DataType="Fac_100", Min=-32, Max=31.9, Unit="%/(mg/hub)/s", InitialValue="0")  % I-Gain of the PID controller
EGRVlv_KdPar = Simulink.Signal(StorageClass="ExportToFile", HeaderFile="EGRVlv_VDPosGov_Signals.h", DefinitionFile="EGRVlv_VDPosGov_Signals.c", DataType="Fac_100", Min=-100, Max=100, Unit="%/(mg/hub)/s", InitialValue="0")  % D-Gain of the PID controller
EGRVlv_stIni = Simulink.Signal(StorageClass="ExportToFile", HeaderFile="EGRVlv_VDPosGov_Signals.h", DefinitionFile="EGRVlv_VDPosGov_Signals.c", DataType="boolean", Min=0, Max=1, Unit="NaN", InitialValue="0")  % Status of limiting the current
EGRVlv_rIniVal = Simulink.Signal(StorageClass="ExportToFile", HeaderFile="EGRVlv_VDPosGov_Signals.h", DefinitionFile="EGRVlv_VDPosGov_Signals.c", DataType="DutyCycle", Min=-100, Max=100, Unit="%", InitialValue="0")  % Initial value of correcting variable for position controller for single flow implementation
EGRVlv_rAbsEGR_mp = Simulink.Signal(StorageClass="ExportToFile", HeaderFile="EGRVlv_VDPosGov_Signals.h", DefinitionFile="EGRVlv_VDPosGov_Signals.c", DataType="DutyCycle", Min=-100, Max=100, Unit="%", InitialValue="0")  % Absolute value of duty cycle for calculating modelled current
EGRVlv_iEff_mp = Simulink.Signal(StorageClass="ExportToFile", HeaderFile="EGRVlv_VDPosGov_Signals.h", DefinitionFile="EGRVlv_VDPosGov_Signals.c", DataType="Current_mA", Min=-12800, Max=12799.6, Unit="mA", InitialValue="0")  % Modelled current
EGRVlv_iEffFlt_mp = Simulink.Signal(StorageClass="ExportToFile", HeaderFile="EGRVlv_VDPosGov_Signals.h", DefinitionFile="EGRVlv_VDPosGov_Signals.c", DataType="Current_mA", Min=-12800, Max=12799.6, Unit="mA", InitialValue="0")  % Filtered value of modelled current
EGRVlv_stLMSActv = Simulink.Signal(StorageClass="ExportToFile", HeaderFile="EGRVlv_VDPosGov_Signals.h", DefinitionFile="EGRVlv_VDPosGov_Signals.c", DataType="boolean", Min=0, Max=1, Unit="NaN", InitialValue="0")  % LMS and no CleanUp active,then activate LMS control
StpIni = Simulink.Signal(StorageClass="ExportToFile", HeaderFile="EGRVlv_VDPosGov_Signals.h", DefinitionFile="EGRVlv_VDPosGov_Signals.c", DataType="boolean", Min=0, Max=1, Unit="NaN", InitialValue="0")  % Status of stepping from lower mechanical stop
GovIni = Simulink.Signal(StorageClass="ExportToFile", HeaderFile="EGRVlv_VDPosGov_Signals.h", DefinitionFile="EGRVlv_VDPosGov_Signals.c", DataType="boolean", Min=0, Max=1, Unit="NaN", InitialValue="0")  % Status of PID initialization
swt_off = Simulink.Signal(StorageClass="ExportToFile", HeaderFile="EGRVlv_VDPosGov_Signals.h", DefinitionFile="EGRVlv_VDPosGov_Signals.c", DataType="boolean", Min=0, Max=1, Unit="NaN", InitialValue="0")  % Switch to value EGRVlv_rEGRSwtOff_C over a ramp with slope EGRVlv_rSwtOffRmp_C
EGRVlv_rGovMin_mp = Simulink.Signal(StorageClass="ExportToFile", HeaderFile="EGRVlv_VDPosGov_Signals.h", DefinitionFile="EGRVlv_VDPosGov_Signals.c", DataType="DutyCycle", Min=-100, Max=100, Unit="%", InitialValue="0")  % Minimum governor output limit
EGRVlv_rGovMax_mp = Simulink.Signal(StorageClass="ExportToFile", HeaderFile="EGRVlv_VDPosGov_Signals.h", DefinitionFile="EGRVlv_VDPosGov_Signals.c", DataType="DutyCycle", Min=-100, Max=100, Unit="%", InitialValue="0")  % Maximum governor output limit
local_static_TrgClnUp = Simulink.Signal(StorageClass="ExportToFile", HeaderFile="EGRVlv_VDPosGov_Signals.h", DefinitionFile="EGRVlv_VDPosGov_Signals.c", DataType="boolean", Min=0, Max=1, Unit="NaN", InitialValue="0")  % Local static status of valve cleaning trigger
EGRVlv_rDesClnUp = Simulink.Signal(StorageClass="ExportToFile", HeaderFile="EGRVlv_VDPosGov_Signals.h", DefinitionFile="EGRVlv_VDPosGov_Signals.c", DataType="DutyCycle", Min=-100, Max=100, Unit="%", InitialValue="0")  % Desired EGR valve position during valve cleaning operation
EGRVlv_stClnUpRls = Simulink.Signal(StorageClass="ExportToFile", HeaderFile="EGRVlv_VDPosGov_Signals.h", DefinitionFile="EGRVlv_VDPosGov_Signals.c", DataType="boolean", Min=0, Max=1, Unit="NaN", InitialValue="0")  % Status of valvle cleanup release function
EGRVlv_stClnUpOpn = Simulink.Signal(StorageClass="ExportToFile", HeaderFile="EGRVlv_VDPosGov_Signals.h", DefinitionFile="EGRVlv_VDPosGov_Signals.c", DataType="boolean", Min=0, Max=1, Unit="NaN", InitialValue="0")  % Status indicates that the valve is moving in open position direction
EGRVlv_stClnUpCls = Simulink.Signal(StorageClass="ExportToFile", HeaderFile="EGRVlv_VDPosGov_Signals.h", DefinitionFile="EGRVlv_VDPosGov_Signals.c", DataType="boolean", Min=0, Max=1, Unit="NaN", InitialValue="0")  % Status indicates that the valve is moving in closed position direction
EGRVlv_stClnUpFin = Simulink.Signal(StorageClass="ExportToFile", HeaderFile="EGRVlv_VDPosGov_Signals.h", DefinitionFile="EGRVlv_VDPosGov_Signals.c", DataType="boolean", Min=0, Max=1, Unit="NaN", InitialValue="0")  % Status indicates that CleanUp function is finished without any interrupt
EGRVlv_tiClnUp = Simulink.Signal(StorageClass="ExportToFile", HeaderFile="EGRVlv_VDPosGov_Signals.h", DefinitionFile="EGRVlv_VDPosGov_Signals.c", DataType="Debounce_ms", Min=0, Max=65535, Unit="ms", InitialValue="200")  % Time of post drive extension when valve cleaning is active
EGRVlv_ctClnUp = Simulink.Signal(StorageClass="ExportToFile", HeaderFile="EGRVlv_VDPosGov_Signals.h", DefinitionFile="EGRVlv_VDPosGov_Signals.c", DataType="Count2", Min=0, Max=65535, Unit="NaN", InitialValue="0")  % Counter for EGR valve open-close cleanup cycles
EGRVlv_stClnUpBlkd = Simulink.Signal(StorageClass="ExportToFile", HeaderFile="EGRVlv_VDPosGov_Signals.h", DefinitionFile="EGRVlv_VDPosGov_Signals.c", DataType="boolean", Min=0, Max=1, Unit="NaN", InitialValue="0")  % Status of valvle cleanup inhibited / interrupted
EGRVlv_rOutPID_mp = Simulink.Signal(StorageClass="ExportToFile", HeaderFile="EGRVlv_VDPosGov_Signals.h", DefinitionFile="EGRVlv_VDPosGov_Signals.c", DataType="DutyCycle", Min=-100, Max=100, Unit="%", InitialValue="0")  % Output of PID controller
EGRVlv_tiParDT1_C = Simulink.Parameter(3, StorageClass="ExportToFile", HeaderFile="EGRVlv_VDPosGov_Paras.h", DefinitionFile="EGRVlv_VDPosGov_Paras.c", DataType="Seconds", Min=0, Max=5, Unit="s")  % Time constant of the DT1 element for detection of slow closing
EGRVlv_KdParDT1_C = Simulink.Parameter(1, StorageClass="ExportToFile", HeaderFile="EGRVlv_VDPosGov_Paras.h", DefinitionFile="EGRVlv_VDPosGov_Paras.c", DataType="Fac_100", Min=-128, Max=127.9, Unit="%/(mg/hub)/s")  % Factor of the DT1 element for detection of slow closing
EGRVlv_drActNgv_C = Simulink.Parameter(20, StorageClass="ExportToFile", HeaderFile="EGRVlv_VDPosGov_Paras.h", DefinitionFile="EGRVlv_VDPosGov_Paras.c", DataType="Fac_100", Min=-327.68, Max=327.67, Unit="%/s")  % Threshold value for valve velocity for detection of slow closing
EGRVlv_rActNgv_C = Simulink.Parameter(-10, StorageClass="ExportToFile", HeaderFile="EGRVlv_VDPosGov_Paras.h", DefinitionFile="EGRVlv_VDPosGov_Paras.c", DataType="DutyCycle", Min=-100, Max=100, Unit="%")  % Threshold value for valve lift for detection of slow closing
EGRVlv_rGovDvtThres_C = Simulink.Parameter(30, StorageClass="ExportToFile", HeaderFile="EGRVlv_VDPosGov_Paras.h", DefinitionFile="EGRVlv_VDPosGov_Paras.c", DataType="DutyCycle", Min=-100, Max=100, Unit="%")  % Threshold value for masking the D component of PID controller
EGRVlv_SmlSigPsvPKp_C = Simulink.Parameter(5, StorageClass="ExportToFile", HeaderFile="EGRVlv_VDPosGov_Paras.h", DefinitionFile="EGRVlv_VDPosGov_Paras.c", DataType="Fac_100", Min=-100, Max=100, Unit="%/(mg/hub)")  % For positive small signals
EGRVlv_SlwClsPKp_C = Simulink.Parameter(3, StorageClass="ExportToFile", HeaderFile="EGRVlv_VDPosGov_Paras.h", DefinitionFile="EGRVlv_VDPosGov_Paras.c", DataType="Fac_100", Min=-100, Max=100, Unit="%/(mg/hub)")  % P-Gain of the PID controller for slow closing
EGRVlv_SmlSigNgvPKp_C = Simulink.Parameter(-5, StorageClass="ExportToFile", HeaderFile="EGRVlv_VDPosGov_Paras.h", DefinitionFile="EGRVlv_VDPosGov_Paras.c", DataType="Fac_100", Min=-100, Max=100, Unit="%/(mg/hub)")  % For negative small signals
EGRVlv_SmlSigPsvIKi_C = Simulink.Parameter(1, StorageClass="ExportToFile", HeaderFile="EGRVlv_VDPosGov_Paras.h", DefinitionFile="EGRVlv_VDPosGov_Paras.c", DataType="Fac_100", Min=-32, Max=31.9, Unit="%/(mg/hub)/s")  % For positive small signals
EGRVlv_SlwClsIKi_C = Simulink.Parameter(0.2, StorageClass="ExportToFile", HeaderFile="EGRVlv_VDPosGov_Paras.h", DefinitionFile="EGRVlv_VDPosGov_Paras.c", DataType="Fac_100", Min=-32, Max=31.9, Unit="%/(mg/hub)/s")  % I-Gain of the PID controller for slow closing
EGRVlv_SmlSigNgvIKi_C = Simulink.Parameter(-1, StorageClass="ExportToFile", HeaderFile="EGRVlv_VDPosGov_Paras.h", DefinitionFile="EGRVlv_VDPosGov_Paras.c", DataType="Fac_100", Min=-32, Max=31.9, Unit="%/(mg/hub)/s")  % For negative small signals
EGRVlv_DKdNgv_C = Simulink.Parameter(-5, StorageClass="ExportToFile", HeaderFile="EGRVlv_VDPosGov_Paras.h", DefinitionFile="EGRVlv_VDPosGov_Paras.c", DataType="Fac_100", Min=-100, Max=100, Unit="%/(mg/hub)/s")  % For negative large signals
EGRVlv_DKdPsv_C = Simulink.Parameter(5, StorageClass="ExportToFile", HeaderFile="EGRVlv_VDPosGov_Paras.h", DefinitionFile="EGRVlv_VDPosGov_Paras.c", DataType="Fac_100", Min=-100, Max=100, Unit="%/(mg/hub)/s")  % For positive large signals
EGRVlv_SmlSigPsvDKd_C = Simulink.Parameter(5, StorageClass="ExportToFile", HeaderFile="EGRVlv_VDPosGov_Paras.h", DefinitionFile="EGRVlv_VDPosGov_Paras.c", DataType="Fac_100", Min=-100, Max=100, Unit="%/(mg/hub)/s")  % For positive small signals
EGRVlv_SlwClsDKd_C = Simulink.Parameter(3, StorageClass="ExportToFile", HeaderFile="EGRVlv_VDPosGov_Paras.h", DefinitionFile="EGRVlv_VDPosGov_Paras.c", DataType="Fac_100", Min=-100, Max=100, Unit="%/(mg/hub)/s")  % D-Gain of the PID controller for slow closing
EGRVlv_SmlSigNgvDKd_C = Simulink.Parameter(-5, StorageClass="ExportToFile", HeaderFile="EGRVlv_VDPosGov_Paras.h", DefinitionFile="EGRVlv_VDPosGov_Paras.c", DataType="Fac_100", Min=-100, Max=100, Unit="%/(mg/hub)/s")  % For negative small signals
EGRVlv_swtSelDT1In_C = Simulink.Parameter(0, StorageClass="ExportToFile", HeaderFile="EGRVlv_VDPosGov_Paras.h", DefinitionFile="EGRVlv_VDPosGov_Paras.c", DataType="boolean", Min=0, Max=1, Unit="NaN")  % Switch to select the DT1 governor input
EGRVlv_PKpPsv_C = Simulink.Parameter(5, StorageClass="ExportToFile", HeaderFile="EGRVlv_VDPosGov_Paras.h", DefinitionFile="EGRVlv_VDPosGov_Paras.c", DataType="Fac_100", Min=-100, Max=100, Unit="%/(mg/hub)")  % For negative large signals
EGRVlv_PKpNgv_C = Simulink.Parameter(-5, StorageClass="ExportToFile", HeaderFile="EGRVlv_VDPosGov_Paras.h", DefinitionFile="EGRVlv_VDPosGov_Paras.c", DataType="Fac_100", Min=-100, Max=100, Unit="%/(mg/hub)")  % For positive large signals
EGRVlv_IKiPsv_C = Simulink.Parameter(5, StorageClass="ExportToFile", HeaderFile="EGRVlv_VDPosGov_Paras.h", DefinitionFile="EGRVlv_VDPosGov_Paras.c", DataType="Fac_100", Min=-32, Max=31.9, Unit="%/(mg/hub)/s")  % For negative large signals
EGRVlv_IKiNgv_C = Simulink.Parameter(-5, StorageClass="ExportToFile", HeaderFile="EGRVlv_VDPosGov_Paras.h", DefinitionFile="EGRVlv_VDPosGov_Paras.c", DataType="Fac_100", Min=-32, Max=31.9, Unit="%/(mg/hub)/s")  % For positive large signals
EGRVlv_rIniStp_C = Simulink.Parameter(5, StorageClass="ExportToFile", HeaderFile="EGRVlv_VDPosGov_Paras.h", DefinitionFile="EGRVlv_VDPosGov_Paras.c", DataType="DutyCycle", Min=-100, Max=100, Unit="%")  % Lead value for I component in case of step from lower mechanical stop
EGRVlv_tiGovDT1_C = Simulink.Parameter(3, StorageClass="ExportToFile", HeaderFile="EGRVlv_VDPosGov_Paras.h", DefinitionFile="EGRVlv_VDPosGov_Paras.c", DataType="Seconds", Min=0, Max=5, Unit="s")  % Time constant of the DT1 element in the PID controller
EGRVlv_rOutDMax_C = Simulink.Parameter(20, StorageClass="ExportToFile", HeaderFile="EGRVlv_VDPosGov_Paras.h", DefinitionFile="EGRVlv_VDPosGov_Paras.c", DataType="DutyCycle", Min=-100, Max=100, Unit="%")  % Maximum permisssible correcting variable for the D component of PID controller
EGRVlv_rOutIMax_C = Simulink.Parameter(30, StorageClass="ExportToFile", HeaderFile="EGRVlv_VDPosGov_Paras.h", DefinitionFile="EGRVlv_VDPosGov_Paras.c", DataType="DutyCycle", Min=-100, Max=100, Unit="%")  % Upper limiting value of I component of the position governor
EGRVlv_tiOutIMax_C = Simulink.Parameter(1, StorageClass="ExportToFile", HeaderFile="EGRVlv_VDPosGov_Paras.h", DefinitionFile="EGRVlv_VDPosGov_Paras.c", DataType="Seconds", Min=0, Max=300, Unit="s")  % Timer for holding current limitation
EGRVlv_facCrntEffFlt_C = Simulink.Parameter(50, StorageClass="ExportToFile", HeaderFile="EGRVlv_VDPosGov_Paras.h", DefinitionFile="EGRVlv_VDPosGov_Paras.c", DataType="Fac_100", Min=0, Max=99.9985, Unit="NaN")  % Factor of the PT1 filter
EGRVlv_iEffOvrLd_C = Simulink.Parameter(200, StorageClass="ExportToFile", HeaderFile="EGRVlv_VDPosGov_Paras.h", DefinitionFile="EGRVlv_VDPosGov_Paras.c", DataType="Current_mA", Min=-12800, Max=12799.6, Unit="mA")  % Threshold for overcurrent detection
EGRVlv_tiLimDlyOvrLd_C = Simulink.Parameter(1, StorageClass="ExportToFile", HeaderFile="EGRVlv_VDPosGov_Paras.h", DefinitionFile="EGRVlv_VDPosGov_Paras.c", DataType="Seconds", Min=0, Max=300, Unit="s")  % Delay time for governor limitation because of overcurrent
EGRVlv_rGovMin_C = Simulink.Parameter(10, StorageClass="ExportToFile", HeaderFile="EGRVlv_VDPosGov_Paras.h", DefinitionFile="EGRVlv_VDPosGov_Paras.c", DataType="DutyCycle", Min=-100, Max=100, Unit="%")  % calibration parameter to set of the lower limiting value of PID controller
EGRVlv_rGovMax_C = Simulink.Parameter(30, StorageClass="ExportToFile", HeaderFile="EGRVlv_VDPosGov_Paras.h", DefinitionFile="EGRVlv_VDPosGov_Paras.c", DataType="DutyCycle", Min=-100, Max=100, Unit="%")  % calibration parameter to set of the upper limiting value of PID controller
EGRVlv_rSwtOffRmp_C = Simulink.Parameter(2, StorageClass="ExportToFile", HeaderFile="EGRVlv_VDPosGov_Paras.h", DefinitionFile="EGRVlv_VDPosGov_Paras.c", DataType="DutyCycle", Min=-100, Max=100, Unit="%")  % Slope to ramp to switch off value
EGRVlv_rEGRSwtOff_C = Simulink.Parameter(20, StorageClass="ExportToFile", HeaderFile="EGRVlv_VDPosGov_Paras.h", DefinitionFile="EGRVlv_VDPosGov_Paras.c", DataType="DutyCycle", Min=-100, Max=100, Unit="%")  % Desired switch off value
EGRVlv_swtEGRTyp_C = Simulink.Parameter(0, StorageClass="ExportToFile", HeaderFile="EGRVlv_VDPosGov_Paras.h", DefinitionFile="EGRVlv_VDPosGov_Paras.c", DataType="State", Min=0, Max=255, Unit="NaN")  % Type of EGR actuator used
EGRVlv_IKiLMSSlp_C = Simulink.Parameter(5, StorageClass="ExportToFile", HeaderFile="EGRVlv_VDPosGov_Paras.h", DefinitionFile="EGRVlv_VDPosGov_Paras.c", DataType="Fac_100", Min=-32, Max=31.9, Unit="%/(mg/hub)/s")  % Slope for desired value of EGRVlv LMS control
EGRVlv_rDesLMSMin_C = Simulink.Parameter(10, StorageClass="ExportToFile", HeaderFile="EGRVlv_VDPosGov_Paras.h", DefinitionFile="EGRVlv_VDPosGov_Paras.c", DataType="DutyCycle", Min=-100, Max=100, Unit="%")  % Minimum limitation for desired LMS value
EGRVlv_rDesOffHold_C = Simulink.Parameter(15, StorageClass="ExportToFile", HeaderFile="EGRVlv_VDPosGov_Paras.h", DefinitionFile="EGRVlv_VDPosGov_Paras.c", DataType="DutyCycle", Min=-100, Max=100, Unit="%")  % Desired LMS hold value
EGRVlv_swtGovByp_C = Simulink.Parameter(0, StorageClass="ExportToFile", HeaderFile="EGRVlv_VDPosGov_Paras.h", DefinitionFile="EGRVlv_VDPosGov_Paras.c", DataType="boolean", Min=0, Max=1, Unit="NaN")  % Switch for bypassing the position controller
EGRVlv_swtDesValNrmInv_C = Simulink.Parameter(1, StorageClass="ExportToFile", HeaderFile="EGRVlv_VDPosGov_Paras.h", DefinitionFile="EGRVlv_VDPosGov_Paras.c", DataType="boolean", Min=0, Max=1, Unit="NaN")  % Switch to select the normalized desired value
EGRVlv_rPIDWinPsv_C = Simulink.Parameter(10, StorageClass="ExportToFile", HeaderFile="EGRVlv_VDPosGov_Paras.h", DefinitionFile="EGRVlv_VDPosGov_Paras.c", DataType="DutyCycle", Min=-100, Max=100, Unit="%")  % Positive window limit
EGRVlv_rPIDWinNgv_C = Simulink.Parameter(-10, StorageClass="ExportToFile", HeaderFile="EGRVlv_VDPosGov_Paras.h", DefinitionFile="EGRVlv_VDPosGov_Paras.c", DataType="DutyCycle", Min=-100, Max=100, Unit="%")  % Negative window limit
EGRVlv_rDesEGR_CUR = Simulink.Parameter([2 6 7 8 10 12 13 15 16 20 26 34 41 46 52 58 60 64 69 72 76 83 89 91 98], StorageClass="ExportToFile", HeaderFile="EGRVlv_VDPosGov_Paras.h", DefinitionFile="EGRVlv_VDPosGov_Paras.c", DataType="DutyCycle", Min=-100, Max=100, Unit="%")  % Curve to calculation the desired value for the governor EGRVlv_rGovDesVal based on EGRVlv_r
EGRVlv_rDesEGR_CURX = Simulink.Parameter([2 6 7 8 10 12 13 15 16 20 26 34 41 46 52 58 60 64 69 72 76 83 89 91 98], StorageClass="ExportToFile", HeaderFile="EGRVlv_VDPosGov_Paras.h", DefinitionFile="EGRVlv_VDPosGov_Paras.c", DataType="DutyCycle", Min=-100, Max=100, Unit="%")  % Curve axis to calculation the desired value for the governor EGRVlv_rGovDesVal based on EGRVlv_r
EGRVlv_iEff_CUR = Simulink.Parameter([200 600 700 800 1000 1200 1300 1500 1600 2000 2600 3400 4100 4600 5200 5800 6000 6400 6900 7200 7600 8300 8900 9100 9800], StorageClass="ExportToFile", HeaderFile="EGRVlv_VDPosGov_Paras.h", DefinitionFile="EGRVlv_VDPosGov_Paras.c", DataType="Current_mA", Min=-12800, Max=12799.6, Unit="mA")  % Transformation curve to convert the positon value to current value
EGRVlv_iEff_CURX = Simulink.Parameter([2 6 7 8 10 12 13 15 16 20 26 34 41 46 52 58 60 64 69 72 76 83 89 91 98], StorageClass="ExportToFile", HeaderFile="EGRVlv_VDPosGov_Paras.h", DefinitionFile="EGRVlv_VDPosGov_Paras.c", DataType="DutyCycle", Min=-100, Max=100, Unit="%")  % Transformation aixs to  convert the positon value to current value
EGRVlv_rGovMin_CUR = Simulink.Parameter([2 6 7 8 10 12 13 15 16 20 26 34 41 46 52 58 60 64 69 72 76 83 89 91 98], StorageClass="ExportToFile", HeaderFile="EGRVlv_VDPosGov_Paras.h", DefinitionFile="EGRVlv_VDPosGov_Paras.c", DataType="DutyCycle", Min=-100, Max=100, Unit="%")  % Transformation curve to convert the current value to position value
EGRVlv_rGovMin_CURX = Simulink.Parameter([200 600 700 800 1000 1200 1300 1500 1600 2000 2600 3400 4100 4600 5200 5800 6000 6400 6900 7200 7600 8300 8900 9100 9800], StorageClass="ExportToFile", HeaderFile="EGRVlv_VDPosGov_Paras.h", DefinitionFile="EGRVlv_VDPosGov_Paras.c", DataType="Current_mA", Min=-12800, Max=12799.6, Unit="mA")  % Transformation aixs to  convert the current value to position value
EGRVlv_rGovMax_CUR = Simulink.Parameter([2 6 7 8 10 12 13 15 16 20 26 34 41 46 52 58 60 64 69 72 76 83 89 91 98], StorageClass="ExportToFile", HeaderFile="EGRVlv_VDPosGov_Paras.h", DefinitionFile="EGRVlv_VDPosGov_Paras.c", DataType="DutyCycle", Min=-100, Max=100, Unit="%")  % Transformation curve to convert the current value to position value
EGRVlv_rGovMax_CURX = Simulink.Parameter([200 600 700 800 1000 1200 1300 1500 1600 2000 2600 3400 4100 4600 5200 5800 6000 6400 6900 7200 7600 8300 8900 9100 9800], StorageClass="ExportToFile", HeaderFile="EGRVlv_VDPosGov_Paras.h", DefinitionFile="EGRVlv_VDPosGov_Paras.c", DataType="Current_mA", Min=-12800, Max=12799.6, Unit="mA")  % Transformation aixs to  convert the current value to position value
EGRVlv_ctClnUpFin_C = Simulink.Parameter(5, StorageClass="ExportToFile", HeaderFile="EGRVlv_VDPosGov_Paras.h", DefinitionFile="EGRVlv_VDPosGov_Paras.c", DataType="Count2", Min=0, Max=65535, Unit="NaN")  % Number of valvle cleaning open-close cycle count
EGRVlv_rDesClnUpCls_C = Simulink.Parameter(10, StorageClass="ExportToFile", HeaderFile="EGRVlv_VDPosGov_Paras.h", DefinitionFile="EGRVlv_VDPosGov_Paras.c", DataType="DutyCycle", Min=-100, Max=100, Unit="%")  % Desired value for cleanup function for closed valve
EGRVlv_rDesClnUpOpen_C = Simulink.Parameter(-10, StorageClass="ExportToFile", HeaderFile="EGRVlv_VDPosGov_Paras.h", DefinitionFile="EGRVlv_VDPosGov_Paras.c", DataType="DutyCycle", Min=-100, Max=100, Unit="%")  % Desired value for cleanup function for open valve
EGRVlv_tiClnUp_C = Simulink.Parameter(50, StorageClass="ExportToFile", HeaderFile="EGRVlv_VDPosGov_Paras.h", DefinitionFile="EGRVlv_VDPosGov_Paras.c", DataType="Debncd_ms", Min=0, Max=65535, Unit="ms")  % Time for which valve is opened or closed during cleanup operation
EGRVlv_stClnUpInh_C = Simulink.Parameter(0, StorageClass="ExportToFile", HeaderFile="EGRVlv_VDPosGov_Paras.h", DefinitionFile="EGRVlv_VDPosGov_Paras.c", DataType="boolean", Min=0, Max=1, Unit="NaN")  % Paramter to inhibit valve cleaning permanently
EGRVlv_rEGRDflVal_C = Simulink.Parameter(0, StorageClass="ExportToFile", HeaderFile="EGRVlv_VDPosGov_Paras.h", DefinitionFile="EGRVlv_VDPosGov_Paras.c", DataType="DutyCycle", Min=-100, Max=100, Unit="%")  % Default control value for the EGR valve
EGRVlv_facdrActFlt_C = Simulink.Parameter(50, StorageClass="ExportToFile", HeaderFile="EGRVlv_VDPosGov_Paras.h", DefinitionFile="EGRVlv_VDPosGov_Paras.c", DataType="Fac_100", Min=0, Max=99.9985, Unit="NaN")  % Factor of the PT1 filter
RLS = fi(0, 0, 8, 0)

MINUS_1_PRC = embedded.fi(
  DataType="Fixed",
  Scaling="SlopeBias",
  Signed=true,
  WordLength=16,
  FixedExponent=-8,
  SlopeAdjustmentFactor=1.28,
  intarray=int16(-200),
  noverflows=0,
  nunderflows=0,
  maxlog=-Inf,
  minlog=Inf,
  RoundingMethod="Nearest",
  OverflowAction="Saturate",
  ProductMode="FullPrecision",
  SumMode="FullPrecision",
  ProductWordLength=32,
  SumWordLength=32,
  MaxProductWordLength=65535,
  MaxSumWordLength=65535,
  ProductFractionLength=30,
  ProductFixedExponent=-30,
  ProductSlope=9.313226e-10,
  ProductSlopeAdjustmentFactor=1,
  ProductBias=0,
  SumFractionLength=30,
  SumFixedExponent=-30,
  SumSlope=9.313226e-10,
  SumSlopeAdjustmentFactor=1,
  SumBias=0,
  CastBeforeSum=true,
  DDGMaxProductWordLength=65535,
  DDGMaxSumWordLength=65535,
  DDGProductFixedExponent=-30,
  DDGProductFractionLength=30,
  DDGProductWordLength=32,
  DDGSumFixedExponent=-30,
  DDGSumFractionLength=30,
  DDGSumWordLength=32,
  DDGCastBeforeSum=true,
  DDGProductBias=0,
  DDGProductSlopeAdjustmentFactor=1,
  DDGSumBias=0,
  DDGSumSlopeAdjustmentFactor=1,
  DDGProductSlope=9.313226e-10,
  DDGSumSlope=9.313226e-10,
  Logging=false,
  fimathislocal=false)

ZERO_PRC = embedded.fi(
  DataType="Fixed",
  Scaling="SlopeBias",
  Signed=true,
  WordLength=16,
  FixedExponent=-8,
  SlopeAdjustmentFactor=1.28,
  intarray=int16(0),
  noverflows=0,
  nunderflows=0,
  maxlog=-Inf,
  minlog=Inf,
  RoundingMethod="Nearest",
  OverflowAction="Saturate",
  ProductMode="FullPrecision",
  SumMode="FullPrecision",
  ProductWordLength=32,
  SumWordLength=32,
  MaxProductWordLength=65535,
  MaxSumWordLength=65535,
  ProductFractionLength=30,
  ProductFixedExponent=-30,
  ProductSlope=9.313226e-10,
  ProductSlopeAdjustmentFactor=1,
  ProductBias=0,
  SumFractionLength=30,
  SumFixedExponent=-30,
  SumSlope=9.313226e-10,
  SumSlopeAdjustmentFactor=1,
  SumBias=0,
  CastBeforeSum=true,
  DDGMaxProductWordLength=65535,
  DDGMaxSumWordLength=65535,
  DDGProductFixedExponent=-30,
  DDGProductFractionLength=30,
  DDGProductWordLength=32,
  DDGSumFixedExponent=-30,
  DDGSumFractionLength=30,
  DDGSumWordLength=32,
  DDGCastBeforeSum=true,
  DDGProductBias=0,
  DDGProductSlopeAdjustmentFactor=1,
  DDGSumBias=0,
  DDGSumSlopeAdjustmentFactor=1,
  DDGProductSlope=9.313226e-10,
  DDGSumSlope=9.313226e-10,
  Logging=false,
  fimathislocal=false)

VALEO = fi(0, 0, 8, 0)
EGRVLV_STCLNUP_INIT = fi(1, 0, 8, 0)
EGRVLV_STCLNUP_OPEN = fi(2, 0, 8, 0)
EGRVLV_STCLNUP_CLOSE = fi(3, 0, 8, 0)
EGRVLV_STCLNUP_FINISH = fi(4, 0, 8, 0)