% Simulink data dictionary EGRVlv_VDSens.sldd
% references slprj_cm.sldd
% references sl_ddtypes.sldd

EGRVlv_rActUnCor = Simulink.Signal(StorageClass="ExportToFile", HeaderFile="EGRVlv_VDSens_Signals.h", DefinitionFile="EGRVlv_VDSens_Signals.c", DataType="DutyCycle", Min=-100, Max=100, Unit="%", InitialValue="0")  % Uncorrected position of the valve
EGRVlv_rAct = Simulink.Signal(StorageClass="ExportToFile", HeaderFile="EGRVlv_VDSens_Signals.h", DefinitionFile="EGRVlv_VDSens_Signals.c", DataType="DutyCycle", Min=-100, Max=100, Unit="%", InitialValue="0")  % Actuatorposition
EGRVlv_stTmpOfsLrnt = Simulink.Signal(StorageClass="ExportToFile", HeaderFile="EGRVlv_VDSens_Signals.h", DefinitionFile="EGRVlv_VDSens_Signals.c", DataType="boolean", Min=0, Max=1, Unit="NaN", InitialValue="0")  % Temporary offset of the EGR valve is already learnt in the current driving cycle
EGRVlv_rActInv = Simulink.Signal(StorageClass="ExportToFile", HeaderFile="EGRVlv_VDSens_Signals.h", DefinitionFile="EGRVlv_VDSens_Signals.c", DataType="DutyCycle", Min=-100, Max=100, Unit="%", InitialValue="0")  % Actuatorposition (100% - rAct)
EGRVlv_rActNoErrHdl = Simulink.Signal(StorageClass="ExportToFile", HeaderFile="EGRVlv_VDSens_Signals.h", DefinitionFile="EGRVlv_VDSens_Signals.c", DataType="DutyCycle", Min=-100, Max=100, Unit="%", InitialValue="0")  % Valve position (offset corrected without error handling)
EGRVlv_bEGRVlvLgTDrft_DSM = Simulink.Signal(StorageClass="ExportToFile", HeaderFile="EGRVlv_VDSens_Signals.h", DefinitionFile="EGRVlv_VDSens_Signals.c", DataType="boolean", Min=0, Max=1, Unit="NaN", InitialValue="0")  % Fault path for long time valve drift
EGRVlv_bEGRVlvOfsPlaus_DSM = Simulink.Signal(StorageClass="ExportToFile", HeaderFile="EGRVlv_VDSens_Signals.h", DefinitionFile="EGRVlv_VDSens_Signals.c", DataType="boolean", Min=0, Max=1, Unit="NaN", InitialValue="0")  % Fault path for plausibility error
EGRVlv_bEGRVlvShTDrft_DSM = Simulink.Signal(StorageClass="ExportToFile", HeaderFile="EGRVlv_VDSens_Signals.h", DefinitionFile="EGRVlv_VDSens_Signals.c", DataType="boolean", Min=0, Max=1, Unit="NaN", InitialValue="0")  % Fault path for short time valve drift
EGRVlv_bEGRVlvOfsLrnJamVlv_DSM = Simulink.Signal(StorageClass="ExportToFile", HeaderFile="EGRVlv_VDSens_Signals.h", DefinitionFile="EGRVlv_VDSens_Signals.c", DataType="boolean", Min=0, Max=1, Unit="NaN", InitialValue="0")  % Fault path for jammed valve error during offset learning
EGRVlv_rAdapLrn_mp = Simulink.Signal(StorageClass="ExportToFile", HeaderFile="EGRVlv_VDSens_Signals.h", DefinitionFile="EGRVlv_VDSens_Signals.c", DataType="DutyCycle", Min=-100, Max=100, Unit="%", InitialValue="0")  % Offset learnt value in the present driving cycle
EGRVlv_stNewVlvTrg_mp = Simulink.Signal(StorageClass="ExportToFile", HeaderFile="EGRVlv_VDSens_Signals.h", DefinitionFile="EGRVlv_VDSens_Signals.c", DataType="boolean", Min=0, Max=1, Unit="NaN", InitialValue="0")  % New valve trigger status
EGRVlv_stAdap = Simulink.Signal(StorageClass="ExportToFile", HeaderFile="EGRVlv_VDSens_Signals.h", DefinitionFile="EGRVlv_VDSens_Signals.c", DataType="State2", Min=0, Max=65535, Unit="NaN", InitialValue="0")  % Status of offset learning
EGRVlv_rOfsLrnVlv = Simulink.Signal(StorageClass="ExportToFile", HeaderFile="EGRVlv_VDSens_Signals.h", DefinitionFile="EGRVlv_VDSens_Signals.c", DataType="DutyCycle", Min=-100, Max=100, Unit="%", InitialValue="0")  % Control value for offset learning
EGRVlv_rOfsLrnFrst = Simulink.Signal(StorageClass="ExportToFile", HeaderFile="EGRVlv_VDSens_Signals.h", DefinitionFile="EGRVlv_VDSens_Signals.c", DataType="DutyCycle", Min=-100, Max=100, Unit="%", InitialValue="0")  % First learnt offset value stored in EEPROM
EGRVlv_rOfsLrnLst = Simulink.Signal(StorageClass="ExportToFile", HeaderFile="EGRVlv_VDSens_Signals.h", DefinitionFile="EGRVlv_VDSens_Signals.c", DataType="DutyCycle", Min=-100, Max=100, Unit="%", InitialValue="0")  % Last learnt offset value stored in EEPROM
EGRVlv_stOfsLrn = Simulink.Signal(StorageClass="ExportToFile", HeaderFile="EGRVlv_VDSens_Signals.h", DefinitionFile="EGRVlv_VDSens_Signals.c", DataType="State", Min=0, Max=255, Unit="NaN", InitialValue="0")  % Offset learning for Throttle valve complete
EGRVlv_rModVal = Simulink.Signal(StorageClass="ExportToFile", HeaderFile="EGRVlv_VDSens_Signals.h", DefinitionFile="EGRVlv_VDSens_Signals.c", DataType="DutyCycle", Min=-100, Max=100, Unit="%", InitialValue="0")  % The model value used in the evaluation of the EGR valve actuator position EGRVlv_rAct
EGRVlv_rTmpOfs = Simulink.Signal(StorageClass="ExportToFile", HeaderFile="EGRVlv_VDSens_Signals.h", DefinitionFile="EGRVlv_VDSens_Signals.c", DataType="DutyCycle", Min=-100, Max=100, Unit="%", InitialValue="0")  % Temperory offset calculated
EGRVlv_rUnFlt = Simulink.Signal(StorageClass="ExportToFile", HeaderFile="EGRVlv_VDSens_Signals.h", DefinitionFile="EGRVlv_VDSens_Signals.c", DataType="DutyCycle", Min=-100, Max=100, Unit="%", InitialValue="0")  % Unfiltered EGR valve position
EGRVlv_rFlt = Simulink.Signal(StorageClass="ExportToFile", HeaderFile="EGRVlv_VDSens_Signals.h", DefinitionFile="EGRVlv_VDSens_Signals.c", DataType="DutyCycle", Min=-100, Max=100, Unit="%", InitialValue="0")  % Filtered EGR valve position
EGRVlv_swtEGRTyp2 = Simulink.Signal(StorageClass="ExportToFile", HeaderFile="EGRVlv_VDSens_Signals.h", DefinitionFile="EGRVlv_VDSens_Signals.c", DataType="boolean", Min=0, Max=1, Unit="NaN", InitialValue="0")  % Bit 2 of EGRVlv_swtEGRTyp
EGRVlv_swtEGRTyp2T = Simulink.Signal(StorageClass="ExportToFile", HeaderFile="EGRVlv_VDSens_Signals.h", DefinitionFile="EGRVlv_VDSens_Signals.c", DataType="boolean", Min=0, Max=1, Unit="NaN", InitialValue="0")  % Temperature-related state when EGRVlv_swtEGRTyp.2 is set
EGRVlv_stOfsLrnFrst = Simulink.Signal(StorageClass="ExportToFile", HeaderFile="EGRVlv_VDSens_Signals.h", DefinitionFile="EGRVlv_VDSens_Signals.c", DataType="boolean", Min=0, Max=1, Unit="NaN", InitialValue="0")  % Status of first learnt offset value
EGRVlv_stOfsLrnLst = Simulink.Signal(StorageClass="ExportToFile", HeaderFile="EGRVlv_VDSens_Signals.h", DefinitionFile="EGRVlv_VDSens_Signals.c", DataType="boolean", Min=0, Max=1, Unit="NaN", InitialValue="0")  % Status of last learnt offset value
EGRVlv_stOpnLdDiag = Simulink.Signal(StorageClass="ExportToFile", HeaderFile="EGRVlv_VDSens_Signals.h", DefinitionFile="EGRVlv_VDSens_Signals.c", DataType="boolean", Min=0, Max=1, Unit="NaN", InitialValue="0")  % Trigger for open Load diagnostics
EGRVlv_stEdgOpn_mp = Simulink.Signal(StorageClass="ExportToFile", HeaderFile="EGRVlv_VDSens_Signals.h", DefinitionFile="EGRVlv_VDSens_Signals.c", DataType="boolean", Min=0, Max=1, Unit="NaN", InitialValue="0")  % Status of opening of EGR valve not for the first time
EGRVlv_stFrstOpn_mp = Simulink.Signal(StorageClass="ExportToFile", HeaderFile="EGRVlv_VDSens_Signals.h", DefinitionFile="EGRVlv_VDSens_Signals.c", DataType="boolean", Min=0, Max=1, Unit="NaN", InitialValue="0")  % Status of first opening of EGR valve
EGRVlv_stVlvStk_mp = Simulink.Signal(StorageClass="ExportToFile", HeaderFile="EGRVlv_VDSens_Signals.h", DefinitionFile="EGRVlv_VDSens_Signals.c", DataType="boolean", Min=0, Max=1, Unit="NaN", InitialValue="0")  % Status of valve stuck during opening
EGRVlv_stVlvOpnBuf_mp = Simulink.Signal(StorageClass="ExportToFile", HeaderFile="EGRVlv_VDSens_Signals.h", DefinitionFile="EGRVlv_VDSens_Signals.c", DataType="boolean", Min=0, Max=1, Unit="NaN", InitialValue="0")  % Status of valve opening
EGRVlv_stVlvJamBuf_mp = Simulink.Signal(StorageClass="ExportToFile", HeaderFile="EGRVlv_VDSens_Signals.h", DefinitionFile="EGRVlv_VDSens_Signals.c", DataType="boolean", Min=0, Max=1, Unit="NaN", InitialValue="0")  % Status of valve jammed during opening
EGRVlv_stVlvJamBufCls_mp = Simulink.Signal(StorageClass="ExportToFile", HeaderFile="EGRVlv_VDSens_Signals.h", DefinitionFile="EGRVlv_VDSens_Signals.c", DataType="boolean", Min=0, Max=1, Unit="NaN", InitialValue="0")  % Status of valve jammed during closing
EGRVlv_stAdapVlv_mp = Simulink.Signal(StorageClass="ExportToFile", HeaderFile="EGRVlv_VDSens_Signals.h", DefinitionFile="EGRVlv_VDSens_Signals.c", DataType="boolean", Min=0, Max=1, Unit="NaN", InitialValue="0")  % State of valve close
EGRVlv_stStr_mp = Simulink.Signal(StorageClass="ExportToFile", HeaderFile="EGRVlv_VDSens_Signals.h", DefinitionFile="EGRVlv_VDSens_Signals.c", DataType="boolean", Min=0, Max=1, Unit="NaN", InitialValue="0")  % Store state status
EGRVlv_rAdapPos_mp = Simulink.Signal(StorageClass="ExportToFile", HeaderFile="EGRVlv_VDSens_Signals.h", DefinitionFile="EGRVlv_VDSens_Signals.c", DataType="DutyCycle", Min=-100, Max=100, Unit="%", InitialValue="0")  % Valve position at zero point
EGRVlv_ctAdapCls_mp = Simulink.Signal(StorageClass="ExportToFile", HeaderFile="EGRVlv_VDSens_Signals.h", DefinitionFile="EGRVlv_VDSens_Signals.c", DataType="Count2", Min=0, Max=65535, Unit="NaN", InitialValue="0")  % Close/open cycle counter
EGRVlv_stVlvClsBuf_mp = Simulink.Signal(StorageClass="ExportToFile", HeaderFile="EGRVlv_VDSens_Signals.h", DefinitionFile="EGRVlv_VDSens_Signals.c", DataType="boolean", Min=0, Max=1, Unit="NaN", InitialValue="0")  % Status of valve closure
EGRVlv_stVlvStkCls_mp = Simulink.Signal(StorageClass="ExportToFile", HeaderFile="EGRVlv_VDSens_Signals.h", DefinitionFile="EGRVlv_VDSens_Signals.c", DataType="boolean", Min=0, Max=1, Unit="NaN", InitialValue="0")  % Status of valve stuck during closing
EGRVlv_stVlvClsd_mp = Simulink.Signal(StorageClass="ExportToFile", HeaderFile="EGRVlv_VDSens_Signals.h", DefinitionFile="EGRVlv_VDSens_Signals.c", DataType="boolean", Min=0, Max=1, Unit="NaN", InitialValue="0")  % Status of valve closure
EGRVlv_stMovFin_mp = Simulink.Signal(StorageClass="ExportToFile", HeaderFile="EGRVlv_VDSens_Signals.h", DefinitionFile="EGRVlv_VDSens_Signals.c", DataType="boolean", Min=0, Max=1, Unit="NaN", InitialValue="0")  % Status of adaption finished
EGRVlv_rPosLrnMin_mp = Simulink.Signal(StorageClass="ExportToFile", HeaderFile="EGRVlv_VDSens_Signals.h", DefinitionFile="EGRVlv_VDSens_Signals.c", DataType="DutyCycle", Min=-100, Max=100, Unit="%", InitialValue="0")  % Minimum offset obtained during offset learning close/open cycles
EGRVlv_rPosLrnMax_mp = Simulink.Signal(StorageClass="ExportToFile", HeaderFile="EGRVlv_VDSens_Signals.h", DefinitionFile="EGRVlv_VDSens_Signals.c", DataType="DutyCycle", Min=-100, Max=100, Unit="%", InitialValue="0")  % Maximum offset obtained during offset learning close/open cycles
EGRVlv_rPlausVal_mp = Simulink.Signal(StorageClass="ExportToFile", HeaderFile="EGRVlv_VDSens_Signals.h", DefinitionFile="EGRVlv_VDSens_Signals.c", DataType="DutyCycle", Min=-100, Max=100, Unit="%", InitialValue="0")  % Plausible value(Difference between the max and min adaption values)
EGRVlv_stPlaus = Simulink.Signal(StorageClass="ExportToFile", HeaderFile="EGRVlv_VDSens_Signals.h", DefinitionFile="EGRVlv_VDSens_Signals.c", DataType="boolean", Min=0, Max=1, Unit="NaN", InitialValue="0")  % State to indicate a plausibility error is detected
EGRVlv_stAdpSccs = Simulink.Signal(StorageClass="ExportToFile", HeaderFile="EGRVlv_VDSens_Signals.h", DefinitionFile="EGRVlv_VDSens_Signals.c", DataType="boolean", Min=0, Max=1, Unit="NaN", InitialValue="0")  % State to indicate the offset learning is adapting successfully
EGRVlv_stLgTDrft = Simulink.Signal(StorageClass="ExportToFile", HeaderFile="EGRVlv_VDSens_Signals.h", DefinitionFile="EGRVlv_VDSens_Signals.c", DataType="boolean", Min=0, Max=1, Unit="NaN", InitialValue="0")  % State to indicate a long time drift error is detected
EGRVlv_stShTDrft = Simulink.Signal(StorageClass="ExportToFile", HeaderFile="EGRVlv_VDSens_Signals.h", DefinitionFile="EGRVlv_VDSens_Signals.c", DataType="boolean", Min=0, Max=1, Unit="NaN", InitialValue="0")  % State to indicate a short time drift error is detected
EGRVlv_stOfsEngCond_mp = Simulink.Signal(StorageClass="ExportToFile", HeaderFile="EGRVlv_VDSens_Signals.h", DefinitionFile="EGRVlv_VDSens_Signals.c", DataType="boolean", Min=0, Max=1, Unit="NaN", InitialValue="0")  % Status of engine condition for offset learning release
EGRVlv_stOfsLrnRls_mp = Simulink.Signal(StorageClass="ExportToFile", HeaderFile="EGRVlv_VDSens_Signals.h", DefinitionFile="EGRVlv_VDSens_Signals.c", DataType="boolean", Min=0, Max=1, Unit="NaN", InitialValue="0")  % Status of offset learning release
EGRVlv_stBrkAftRun = Simulink.Signal(StorageClass="ExportToFile", HeaderFile="EGRVlv_VDSens_Signals.h", DefinitionFile="EGRVlv_VDSens_Signals.c", DataType="boolean", Min=0, Max=1, Unit="NaN", InitialValue="0")  % Status of broken afterrun
EGRVlv_rOfs_mp = Simulink.Signal(StorageClass="ExportToFile", HeaderFile="EGRVlv_VDSens_Signals.h", DefinitionFile="EGRVlv_VDSens_Signals.c", DataType="DutyCycle", Min=-100, Max=100, Unit="%", InitialValue="0")  % Offset correction
EGRVlv_stTrg_mp = Simulink.Signal(StorageClass="ExportToFile", HeaderFile="EGRVlv_VDSens_Signals.h", DefinitionFile="EGRVlv_VDSens_Signals.c", DataType="boolean", Min=0, Max=1, Unit="NaN", InitialValue="NaN")  % Trigger status
EGRVlv_rOfsLrnVlvUnLim = Simulink.Signal(StorageClass="ExportToFile", HeaderFile="EGRVlv_VDSens_Signals.h", DefinitionFile="EGRVlv_VDSens_Signals.c", DataType="DutyCycle", Min=-100, Max=100, Unit="%", InitialValue="0")  % Unlimited control value for offset learning
EGRVlv_tiStable_mp = Simulink.Signal(StorageClass="ExportToFile", HeaderFile="EGRVlv_VDSens_Signals.h", DefinitionFile="EGRVlv_VDSens_Signals.c", DataType="Debncd_ms", Min=0, Max=65535, Unit="ms", InitialValue="0")  % Duration time that keeps the EGR valve steady
EGRVlv_rAdapPosAvg_mp = Simulink.Signal(StorageClass="ExportToFile", HeaderFile="EGRVlv_VDSens_Signals.h", DefinitionFile="EGRVlv_VDSens_Signals.c", DataType="DutyCycle", Min=-100, Max=100, Unit="%", InitialValue="0")  % Average valve position at zero point
EGRVlv_tiAdapWaitSensAcq_mp = Simulink.Signal(StorageClass="ExportToFile", HeaderFile="EGRVlv_VDSens_Signals.h", DefinitionFile="EGRVlv_VDSens_Signals.c", DataType="Debncd_ms", Min=0, Max=65535, Unit="ms", InitialValue="0")  % Duration time waiting for sensor acquisition
EGRVlv_rLinOfs_mp = Simulink.Signal(StorageClass="ExportToFile", HeaderFile="EGRVlv_VDSens_Signals.h", DefinitionFile="EGRVlv_VDSens_Signals.c", DataType="DutyCycle", Min=-100, Max=100, Unit="%", InitialValue="0")  % Valve position before limiting
EGRVlv_rTransStgDfl_C = Simulink.Parameter(20, StorageClass="ExportToFile", HeaderFile="EGRVlv_VDSens_Paras.h", DefinitionFile="EGRVlv_VDSens_Paras.c", DataType="DutyCycle", Min=-100, Max=100, Unit="%")  % Structure for Transtage / Fixed replacement value
EGRVlv_RmpSlpPos_C = Simulink.Parameter(3, StorageClass="ExportToFile", HeaderFile="EGRVlv_VDSens_Paras.h", DefinitionFile="EGRVlv_VDSens_Paras.c", DataType="DutyCycle", Min=-100, Max=100, Unit="%/s")  % Parameter for Ramp 1 / Slope if the ramp has to be increased
EGRVlv_RmpSlpNeg_C = Simulink.Parameter(3, StorageClass="ExportToFile", HeaderFile="EGRVlv_VDSens_Paras.h", DefinitionFile="EGRVlv_VDSens_Paras.c", DataType="DutyCycle", Min=-100, Max=100, Unit="%/s")  % Parameter for Ramp 1 / negative ramp slope
EGRVlv_facPT1_C = Simulink.Parameter(50, StorageClass="ExportToFile", HeaderFile="EGRVlv_VDSens_Paras.h", DefinitionFile="EGRVlv_VDSens_Paras.c", DataType="Fac_100", Min=0, Max=99.9985, Unit="NaN")  % PT1 filter factor for EGRVlv sensor
EGRVlv_facPT1ModVal_C = Simulink.Parameter(50, StorageClass="ExportToFile", HeaderFile="EGRVlv_VDSens_Paras.h", DefinitionFile="EGRVlv_VDSens_Paras.c", DataType="Fac_100", Min=0, Max=99.9985, Unit="NaN")  % PT1 filter factor for EGRVlv sensor model value
SigTst_rEGRVlv_C = Simulink.Parameter(20, StorageClass="ExportToFile", HeaderFile="EGRVlv_VDSens_Paras.h", DefinitionFile="EGRVlv_VDSens_Paras.c", DataType="DutyCycle", Min=-100, Max=100, Unit="%")  % Set EGR valve position by hand
SigTst_swtEGRVlv_C = Simulink.Parameter(Switch.OFF, StorageClass="ExportToFile", HeaderFile="EGRVlv_VDSens_Paras.h", DefinitionFile="EGRVlv_VDSens_Paras.c", DataType="Enum: Switch", Unit="NaN")  % Switch for EGR valve position by hand
EGRVlv_rPullDwnThres_C = Simulink.Parameter(15, StorageClass="ExportToFile", HeaderFile="EGRVlv_VDSens_Paras.h", DefinitionFile="EGRVlv_VDSens_Paras.c", DataType="DutyCycle", Min=-100, Max=100, Unit="%")  % Pull down threshold ratio
EGRVlv_rTmpOfsLrnMin_C = Simulink.Parameter(10, StorageClass="ExportToFile", HeaderFile="EGRVlv_VDSens_Paras.h", DefinitionFile="EGRVlv_VDSens_Paras.c", DataType="DutyCycle", Min=-100, Max=100, Unit="%")  % Minimum offset ratio
EGRVlv_rTmpOfsLrnMax_C = Simulink.Parameter(30, StorageClass="ExportToFile", HeaderFile="EGRVlv_VDSens_Paras.h", DefinitionFile="EGRVlv_VDSens_Paras.c", DataType="DutyCycle", Min=-100, Max=100, Unit="%")  % Maximum offset ratio
EGRVlv_rActMin_C = Simulink.Parameter(5, StorageClass="ExportToFile", HeaderFile="EGRVlv_VDSens_Paras.h", DefinitionFile="EGRVlv_VDSens_Paras.c", DataType="DutyCycle", Min=-100, Max=100, Unit="%")  % Minimum threshold for actual sensed valve position
EGRVlv_rActMax_C = Simulink.Parameter(95, StorageClass="ExportToFile", HeaderFile="EGRVlv_VDSens_Paras.h", DefinitionFile="EGRVlv_VDSens_Paras.c", DataType="DutyCycle", Min=-100, Max=100, Unit="%")  % Maximum threshold for actual sensed valve position
EGRVlv_swtOfsLrnActv_C = Simulink.Parameter(1, StorageClass="ExportToFile", HeaderFile="EGRVlv_VDSens_Paras.h", DefinitionFile="EGRVlv_VDSens_Paras.c", DataType="boolean", Min=0, Max=1, Unit="NaN")  % Switch to ENABLE/DISABLE offset learning
EGRVlv_swtSensPrs_C = Simulink.Parameter(1, StorageClass="ExportToFile", HeaderFile="EGRVlv_VDSens_Paras.h", DefinitionFile="EGRVlv_VDSens_Paras.c", DataType="boolean", Min=0, Max=1, Unit="NaN")  % Switch for position sensor present or not
EGRVlv_rCmpNewCtlUn_C = Simulink.Parameter(20, StorageClass="ExportToFile", HeaderFile="EGRVlv_VDSens_Paras.h", DefinitionFile="EGRVlv_VDSens_Paras.c", DataType="DutyCycle", Min=-100, Max=100, Unit="%")  % Default value for the new ECU
EGRVlv_numEngTempOfsLrnRls1_C = Simulink.Parameter(0, StorageClass="ExportToFile", HeaderFile="EGRVlv_VDSens_Paras.h", DefinitionFile="EGRVlv_VDSens_Paras.c", DataType="uint8", Min=0, Max=255, Unit="NaN")  % Index for EngDa_tFld
EGRVlv_tEngFldThresOfsLrnRls1_C = Simulink.Parameter(0, StorageClass="ExportToFile", HeaderFile="EGRVlv_VDSens_Paras.h", DefinitionFile="EGRVlv_VDSens_Paras.c", DataType="Temp_C", Min=-3000, Max=3000, Unit="deg")  % Threshold temperature for release of offset learning strategy-1
EGRVlv_numEngTempOfsLrnRls2_C = Simulink.Parameter(0, StorageClass="ExportToFile", HeaderFile="EGRVlv_VDSens_Paras.h", DefinitionFile="EGRVlv_VDSens_Paras.c", DataType="uint8", Min=0, Max=255, Unit="NaN")  % Index for EngDa_tFld
EGRVlv_tEngFldThresOfsLrnRls2_C = Simulink.Parameter(0, StorageClass="ExportToFile", HeaderFile="EGRVlv_VDSens_Paras.h", DefinitionFile="EGRVlv_VDSens_Paras.c", DataType="Temp_C", Min=-3000, Max=3000, Unit="deg")  % Threshold temperature for release of offset learning strategy-2
EGRVlv_rAdapIniOpn_C = Simulink.Parameter(30, StorageClass="ExportToFile", HeaderFile="EGRVlv_VDSens_Paras.h", DefinitionFile="EGRVlv_VDSens_Paras.c", DataType="DutyCycle", Min=-100, Max=100, Unit="%")  % Initialisation value for the integrator for the opening valve
EGRVlv_rAdapIniOpn0_C = Simulink.Parameter(18, StorageClass="ExportToFile", HeaderFile="EGRVlv_VDSens_Paras.h", DefinitionFile="EGRVlv_VDSens_Paras.c", DataType="DutyCycle", Min=-100, Max=100, Unit="%")  % Initialisation value for the integrator for the opening valve(first time)
EGRVlv_facAdapClsStrt_C = Simulink.Parameter(0.7, StorageClass="ExportToFile", HeaderFile="EGRVlv_VDSens_Paras.h", DefinitionFile="EGRVlv_VDSens_Paras.c", DataType="Fac_100", Min=-32, Max=31.9, Unit="NaN")  % Integrator initialisation factor
EGRVlv_rAdapAgOpnMin_C = Simulink.Parameter(30, StorageClass="ExportToFile", HeaderFile="EGRVlv_VDSens_Paras.h", DefinitionFile="EGRVlv_VDSens_Paras.c", DataType="DutyCycle", Min=-100, Max=100, Unit="%")  % Minimum opening angle
EGRVlv_tiAdapJamVlv_C = Simulink.Parameter(500, StorageClass="ExportToFile", HeaderFile="EGRVlv_VDSens_Paras.h", DefinitionFile="EGRVlv_VDSens_Paras.c", DataType="Debncd_ms", Min=0, Max=65535, Unit="ms")  % Debounce time to detect a stuck valve in Open state
EGRVlv_IKiOfsLrnUp_C = Simulink.Parameter(1, StorageClass="ExportToFile", HeaderFile="EGRVlv_VDSens_Paras.h", DefinitionFile="EGRVlv_VDSens_Paras.c", DataType="Fac_100", Min=-128, Max=127.9, Unit="%/(mg/hub)/s")  % Position constant for the integrator during valve opening
EGRVlv_rAdapAgOpnMax_C = Simulink.Parameter(80, StorageClass="ExportToFile", HeaderFile="EGRVlv_VDSens_Paras.h", DefinitionFile="EGRVlv_VDSens_Paras.c", DataType="DutyCycle", Min=-100, Max=100, Unit="%")  % Maximum opening angle
EGRVlv_rAdapOpnBnd_C = Simulink.Parameter(88, StorageClass="ExportToFile", HeaderFile="EGRVlv_VDSens_Paras.h", DefinitionFile="EGRVlv_VDSens_Paras.c", DataType="DutyCycle", Min=-100, Max=100, Unit="%")  % Initialisation value for integrator in case max permissible angle is reached
EGRVlv_rOfsLrnVlvMin_C = Simulink.Parameter(-100, StorageClass="ExportToFile", HeaderFile="EGRVlv_VDSens_Paras.h", DefinitionFile="EGRVlv_VDSens_Paras.c", DataType="DutyCycle", Min=-100, Max=100, Unit="%")  % Lower limit of control value for offset learning
EGRVlv_rOfsLrnVlvMax_C = Simulink.Parameter(100, StorageClass="ExportToFile", HeaderFile="EGRVlv_VDSens_Paras.h", DefinitionFile="EGRVlv_VDSens_Paras.c", DataType="DutyCycle", Min=-100, Max=100, Unit="%")  % Upper limit of control value for offset learning
EGRVlv_tiAdapPullUp_C = Simulink.Parameter(200, StorageClass="ExportToFile", HeaderFile="EGRVlv_VDSens_Paras.h", DefinitionFile="EGRVlv_VDSens_Paras.c", DataType="Debncd_ms", Min=0, Max=65535, Unit="ms")  % Calibration parameter to set time for pull down after lower stop is detected
EGRVlv_numAdapClsMax_C = Simulink.Parameter(1, StorageClass="ExportToFile", HeaderFile="EGRVlv_VDSens_Paras.h", DefinitionFile="EGRVlv_VDSens_Paras.c", DataType="uint16", Min=0, Max=65535, Unit="NaN")  % Maximum number of opening and closing cycles
EGRVlv_rOfsMin_C = Simulink.Parameter(-60, StorageClass="ExportToFile", HeaderFile="EGRVlv_VDSens_Paras.h", DefinitionFile="EGRVlv_VDSens_Paras.c", DataType="DutyCycle", Min=-100, Max=100, Unit="%")  % Minimum offset parameter
EGRVlv_rOfsMax_C = Simulink.Parameter(60, StorageClass="ExportToFile", HeaderFile="EGRVlv_VDSens_Paras.h", DefinitionFile="EGRVlv_VDSens_Paras.c", DataType="DutyCycle", Min=-100, Max=100, Unit="%")  % Maximum offset parameter
EGRVlv_rAdapDiffPlaus_C = Simulink.Parameter(2, StorageClass="ExportToFile", HeaderFile="EGRVlv_VDSens_Paras.h", DefinitionFile="EGRVlv_VDSens_Paras.c", DataType="DutyCycle", Min=-100, Max=100, Unit="%")  % Permissible difference b/n max and min adaption values
EGRVlv_rOpnPosOfsMin_C = Simulink.Parameter(0, StorageClass="ExportToFile", HeaderFile="EGRVlv_VDSens_Paras.h", DefinitionFile="EGRVlv_VDSens_Paras.c", DataType="DutyCycle", Min=-100, Max=100, Unit="%")  % Minimum drift offset threshold at open position
EGRVlv_rOpnPosOfsMax_C = Simulink.Parameter(0, StorageClass="ExportToFile", HeaderFile="EGRVlv_VDSens_Paras.h", DefinitionFile="EGRVlv_VDSens_Paras.c", DataType="DutyCycle", Min=-100, Max=100, Unit="%")  % Maximum drift offset threshold at open position
EGRVlv_facAdapPosCls_C = Simulink.Parameter(0.98, StorageClass="ExportToFile", HeaderFile="EGRVlv_VDSens_Paras.h", DefinitionFile="EGRVlv_VDSens_Paras.c", DataType="Fac_100", Min=-32, Max=31.9, Unit="NaN")  % Factor to calculate the EGR valve close position
EGRVlv_rSensVlvThres_C = Simulink.Parameter(10, StorageClass="ExportToFile", HeaderFile="EGRVlv_VDSens_Paras.h", DefinitionFile="EGRVlv_VDSens_Paras.c", DataType="DutyCycle", Min=-100, Max=100, Unit="%")  % Threshold for detection of lower stop
EGRVlv_tiClsJamVlv_C = Simulink.Parameter(1000, StorageClass="ExportToFile", HeaderFile="EGRVlv_VDSens_Paras.h", DefinitionFile="EGRVlv_VDSens_Paras.c", DataType="Debncd_ms", Min=0, Max=65535, Unit="ms")  % Debounce time to detect a stuck valve in closed state
EGRVlv_rOfsLrnDwn_C = Simulink.Parameter(2, StorageClass="ExportToFile", HeaderFile="EGRVlv_VDSens_Paras.h", DefinitionFile="EGRVlv_VDSens_Paras.c", DataType="DutyCycle", Min=-100, Max=100, Unit="%")  % Position constant for the integrator during valve closure
EGRVlv_rOpnPosAdapDiffPlausLgT_C = Simulink.Parameter(0, StorageClass="ExportToFile", HeaderFile="EGRVlv_VDSens_Paras.h", DefinitionFile="EGRVlv_VDSens_Paras.c", DataType="DutyCycle", Min=-100, Max=100, Unit="%")  % Maximum drift threshold in long time state
EGRVlv_rAdapDiffPlausShT_C = Simulink.Parameter(20, StorageClass="ExportToFile", HeaderFile="EGRVlv_VDSens_Paras.h", DefinitionFile="EGRVlv_VDSens_Paras.c", DataType="DutyCycle", Min=-100, Max=100, Unit="%")  % Short time drift threshold
EGRVlv_rOpnPosAdapDiffPlausShT_C = Simulink.Parameter(0, StorageClass="ExportToFile", HeaderFile="EGRVlv_VDSens_Paras.h", DefinitionFile="EGRVlv_VDSens_Paras.c", DataType="DutyCycle", Min=-100, Max=100, Unit="%")  % Maximum drift threshold in short time state
EGRVlv_tiAdapPullDwn_C = Simulink.Parameter(200, StorageClass="ExportToFile", HeaderFile="EGRVlv_VDSens_Paras.h", DefinitionFile="EGRVlv_VDSens_Paras.c", DataType="Debncd_ms", Min=0, Max=65535, Unit="ms")  % Time for pull down after lower stop is detected
EGRVlv_rOfsLrnRmpDwnCls_C = Simulink.Parameter(3, StorageClass="ExportToFile", HeaderFile="EGRVlv_VDSens_Paras.h", DefinitionFile="EGRVlv_VDSens_Paras.c", DataType="DutyCycle", Min=-100, Max=100, Unit="%")  % Position constant for the integrator in ramp down to close state
EGRVlv_rRmpDwnCls_C = Simulink.Parameter(15, StorageClass="ExportToFile", HeaderFile="EGRVlv_VDSens_Paras.h", DefinitionFile="EGRVlv_VDSens_Paras.c", DataType="DutyCycle", Min=-100, Max=100, Unit="%")  % Threshold for integrator in ramp down to close state
EGRVlv_rOfsLrnRmpUpFst_C = Simulink.Parameter(5, StorageClass="ExportToFile", HeaderFile="EGRVlv_VDSens_Paras.h", DefinitionFile="EGRVlv_VDSens_Paras.c", DataType="DutyCycle", Min=-100, Max=100, Unit="%")  % Position constant for the integrator in ramp up fast state
EGRVlv_rRmpUpFst_C = Simulink.Parameter(40, StorageClass="ExportToFile", HeaderFile="EGRVlv_VDSens_Paras.h", DefinitionFile="EGRVlv_VDSens_Paras.c", DataType="DutyCycle", Min=-100, Max=100, Unit="%")  % Threshold for integrator in ramp up faststate
EGRVlv_IKiOfsLrnRmpUpSlw_C = Simulink.Parameter(5, StorageClass="ExportToFile", HeaderFile="EGRVlv_VDSens_Paras.h", DefinitionFile="EGRVlv_VDSens_Paras.c", DataType="Fac_100", Min=-100, Max=100, Unit="%/(mg/hub)/s")  % Integrator gain in ramp up slow state
EGRVlv_rZeroCrossCor_C = Simulink.Parameter(0, StorageClass="ExportToFile", HeaderFile="EGRVlv_VDSens_Paras.h", DefinitionFile="EGRVlv_VDSens_Paras.c", DataType="DutyCycle", Min=-100, Max=100, Unit="%")  % Correction value when the offset learning integrator crosses zero
EGRVlv_rOfsLrnVlvT1Cor_C = Simulink.Parameter(0, StorageClass="ExportToFile", HeaderFile="EGRVlv_VDSens_Paras.h", DefinitionFile="EGRVlv_VDSens_Paras.c", DataType="DutyCycle", Min=-100, Max=100, Unit="%")  % Correction value for integrator in Pierburg strategy-3
EGRVlv_tiOfsLrnVlvT1_C = Simulink.Parameter(200, StorageClass="ExportToFile", HeaderFile="EGRVlv_VDSens_Paras.h", DefinitionFile="EGRVlv_VDSens_Paras.c", DataType="Debncd_ms", Min=0, Max=65535, Unit="ms")  % Waiting time before checking the learnt value in Pierburg strategy-2
EGRVlv_tiAdapWaitSensAcq_C = Simulink.Parameter(200, StorageClass="ExportToFile", HeaderFile="EGRVlv_VDSens_Paras.h", DefinitionFile="EGRVlv_VDSens_Paras.c", DataType="Debncd_ms", Min=0, Max=65535, Unit="ms")  % Waiting time before checking the learnt value in Pierburg strategy-2
EGRVlv_ctTrgClnUpThres_C = Simulink.Parameter(0, StorageClass="ExportToFile", HeaderFile="EGRVlv_VDSens_Paras.h", DefinitionFile="EGRVlv_VDSens_Paras.c", DataType="Count2", Min=0, Max=65535, Unit="NaN")  % Threshold for count of valve cleaning trigger from failed offset learning before switching on the MIL
EGRVlv_stOfsEngCond_C = Simulink.Parameter(0, StorageClass="ExportToFile", HeaderFile="EGRVlv_VDSens_Paras.h", DefinitionFile="EGRVlv_VDSens_Paras.c", DataType="boolean", Min=0, Max=1, Unit="NaN")  % Decides whether offset learning has to be started only after engine has entered to running state
EGRVlv_uBattMin_C = Simulink.Parameter(0, StorageClass="ExportToFile", HeaderFile="EGRVlv_VDSens_Paras.h", DefinitionFile="EGRVlv_VDSens_Paras.c", DataType="Volt_mV", Min=0, Max=50000, Unit="mv")  % Minimum value of battery voltage to release zero point adaption
EGRVlv_uBattMax_C = Simulink.Parameter(0, StorageClass="ExportToFile", HeaderFile="EGRVlv_VDSens_Paras.h", DefinitionFile="EGRVlv_VDSens_Paras.c", DataType="Volt_mV", Min=0, Max=50000, Unit="mv")  % Maximum value of battery voltage to release zero point adaption
EGRVlv_numTempSel_C = Simulink.Parameter(0, StorageClass="ExportToFile", HeaderFile="EGRVlv_VDSens_Paras.h", DefinitionFile="EGRVlv_VDSens_Paras.c", DataType="uint8", Min=0, Max=255, Unit="NaN")  % Temperature selector from the engine temperature field
EGRVlv_tEngMin_C = Simulink.Parameter(0, StorageClass="ExportToFile", HeaderFile="EGRVlv_VDSens_Paras.h", DefinitionFile="EGRVlv_VDSens_Paras.c", DataType="Temp_C", Min=-3000, Max=3000, Unit="deg")  % Minimum value of engine temparature to release the zero point adaption
EGRVlv_tEngMax_C = Simulink.Parameter(0, StorageClass="ExportToFile", HeaderFile="EGRVlv_VDSens_Paras.h", DefinitionFile="EGRVlv_VDSens_Paras.c", DataType="Temp_C", Min=-3000, Max=3000, Unit="deg")  % Maximum value of engine temparature to release the zero point adaption
EGRVlv_stOfsLrnTrg_C = Simulink.Parameter(0, StorageClass="ExportToFile", HeaderFile="EGRVlv_VDSens_Paras.h", DefinitionFile="EGRVlv_VDSens_Paras.c", DataType="boolean", Min=0, Max=1, Unit="NaN")  % Trigger for offset learning
EGRVlv_stNewVlvTrg_C = Simulink.Parameter(0, StorageClass="ExportToFile", HeaderFile="EGRVlv_VDSens_Paras.h", DefinitionFile="EGRVlv_VDSens_Paras.c", DataType="boolean", Min=0, Max=1, Unit="NaN")  % Trigger for new valve
EGRVlv_rActOfs_C = Simulink.Parameter(0, StorageClass="ExportToFile", HeaderFile="EGRVlv_VDSens_Paras.h", DefinitionFile="EGRVlv_VDSens_Paras.c", DataType="DutyCycle", Min=-100, Max=100, Unit="%")  % Offset correction value.
EGRVlv_swtActOfs_C = Simulink.Parameter(0, StorageClass="ExportToFile", HeaderFile="EGRVlv_VDSens_Paras.h", DefinitionFile="EGRVlv_VDSens_Paras.c", DataType="boolean", Min=0, Max=1, Unit="NaN")  % Switch to activate offset correction replacement value
EGRVlv_rOpnPosActOfs_C = Simulink.Parameter(0, StorageClass="ExportToFile", HeaderFile="EGRVlv_VDSens_Paras.h", DefinitionFile="EGRVlv_VDSens_Paras.c", DataType="DutyCycle", Min=-100, Max=100, Unit="%")  % Offset for first learning at open position
EGRVlv_tiStable_C = Simulink.Parameter(200, StorageClass="ExportToFile", HeaderFile="EGRVlv_VDSens_Paras.h", DefinitionFile="EGRVlv_VDSens_Paras.c", DataType="Debncd_ms", Min=0, Max=65535, Unit="ms")  % Duration time that keeps the EGR valve steady
EGRVlv_stOfsLrnEnb_C = Simulink.Parameter(0, StorageClass="ExportToFile", HeaderFile="EGRVlv_VDSens_Paras.h", DefinitionFile="EGRVlv_VDSens_Paras.c", DataType="boolean", Min=0, Max=1, Unit="NaN")  % Switch to ENABLE/DISABLE offset learning

PRC_ZERO = embedded.fi(
  DataType="Fixed",
  Scaling="SlopeBias",
  Signed=true,
  WordLength=16,
  FixedExponent=-8,
  SlopeAdjustmentFactor=1.28,
  intarray=int16(0),
  noverflows=0,
  nunderflows=0,
  maxlog=-Inf,
  minlog=Inf,
  RoundingMethod="Nearest",
  OverflowAction="Saturate",
  ProductMode="FullPrecision",
  SumMode="FullPrecision",
  ProductWordLength=32,
  SumWordLength=32,
  MaxProductWordLength=65535,
  MaxSumWordLength=65535,
  ProductFractionLength=30,
  ProductFixedExponent=-30,
  ProductSlope=9.313226e-10,
  ProductSlopeAdjustmentFactor=1,
  ProductBias=0,
  SumFractionLength=30,
  SumFixedExponent=-30,
  SumSlope=9.313226e-10,
  SumSlopeAdjustmentFactor=1,
  SumBias=0,
  CastBeforeSum=true,
  DDGMaxProductWordLength=65535,
  DDGMaxSumWordLength=65535,
  DDGProductFixedExponent=-30,
  DDGProductFractionLength=30,
  DDGProductWordLength=32,
  DDGSumFixedExponent=-30,
  DDGSumFractionLength=30,
  DDGSumWordLength=32,
  DDGCastBeforeSum=true,
  DDGProductBias=0,
  DDGProductSlopeAdjustmentFactor=1,
  DDGSumBias=0,
  DDGSumSlopeAdjustmentFactor=1,
  DDGProductSlope=9.313226e-10,
  DDGSumSlope=9.313226e-10,
  Logging=false,
  fimathislocal=false)

PRC_100 = embedded.fi(
  DataType="Fixed",
  Scaling="SlopeBias",
  Signed=true,
  WordLength=16,
  FixedExponent=-8,
  SlopeAdjustmentFactor=1.28,
  intarray=int16(20000),
  noverflows=0,
  nunderflows=0,
  maxlog=-Inf,
  minlog=Inf,
  RoundingMethod="Nearest",
  OverflowAction="Saturate",
  ProductMode="FullPrecision",
  SumMode="FullPrecision",
  ProductWordLength=32,
  SumWordLength=32,
  MaxProductWordLength=65535,
  MaxSumWordLength=65535,
  ProductFractionLength=30,
  ProductFixedExponent=-30,
  ProductSlope=9.313226e-10,
  ProductSlopeAdjustmentFactor=1,
  ProductBias=0,
  SumFractionLength=30,
  SumFixedExponent=-30,
  SumSlope=9.313226e-10,
  SumSlopeAdjustmentFactor=1,
  SumBias=0,
  CastBeforeSum=true,
  DDGMaxProductWordLength=65535,
  DDGMaxSumWordLength=65535,
  DDGProductFixedExponent=-30,
  DDGProductFractionLength=30,
  DDGProductWordLength=32,
  DDGSumFixedExponent=-30,
  DDGSumFractionLength=30,
  DDGSumWordLength=32,
  DDGCastBeforeSum=true,
  DDGProductBias=0,
  DDGProductSlopeAdjustmentFactor=1,
  DDGSumBias=0,
  DDGSumSlopeAdjustmentFactor=1,
  DDGProductSlope=9.313226e-10,
  DDGSumSlope=9.313226e-10,
  Logging=false,
  fimathislocal=false)