% Simulink data dictionary ASDdc_Governor.sldd
% references slprj_cm.sldd
% references sl_ddtypes.sldd
% references sl_const.sldd

ASDdc_trq = Simulink.Signal(StorageClass="ExportToFile", HeaderFile="ASDdc_Governor_Signals.h", DefinitionFile="ASDdc_Governor_Signals.c", DataType="Torq", Min=-3000, Max=3000, Unit="Nm", InitialValue="0")  % ASD disturbance compensator torque output
ASDrf_trqInrSet = Simulink.Signal(StorageClass="ExportToFile", HeaderFile="ASDdc_Governor_Signals.h", DefinitionFile="ASDdc_Governor_Signals.c", DataType="Torq", Min=-3000, Max=3000, Unit="Nm", InitialValue="0")  % ASD reference filter torque output
ASDdc_trqFrstDT1_mp = Simulink.Signal(StorageClass="ExportToFile", HeaderFile="ASDdc_Governor_Signals.h", DefinitionFile="ASDdc_Governor_Signals.c", DataType="Torq", Min=-3000, Max=3000, Unit="Nm", InitialValue="0")  % Min. permitted torque by gradient limitation
ASDdc_trqUnLtd_mp = Simulink.Signal(StorageClass="ExportToFile", HeaderFile="ASDdc_Governor_Signals.h", DefinitionFile="ASDdc_Governor_Signals.c", DataType="Torq", Min=-3000, Max=3000, Unit="Nm", InitialValue="0")  % ASD disturbance compensator torque output before limitation
ASDdc_stInitFrst_mp = Simulink.Signal(StorageClass="ExportToFile", HeaderFile="ASDdc_Governor_Signals.h", DefinitionFile="ASDdc_Governor_Signals.c", DataType="boolean", Min=0, Max=1, Unit="NaN", InitialValue="0")  % Indicator for initialisation
ASDdc_nInitXFrst_mp = Simulink.Signal(StorageClass="ExportToFile", HeaderFile="ASDdc_Governor_Signals.h", DefinitionFile="ASDdc_Governor_Signals.c", DataType="ERPM", Min=-6000, Max=6000, Unit="rpm", InitialValue="0")  % Engine speed
ASDdc_trqInitYFrst_mp = Simulink.Signal(StorageClass="ExportToFile", HeaderFile="ASDdc_Governor_Signals.h", DefinitionFile="ASDdc_Governor_Signals.c", DataType="Torq", Min=-3000, Max=3000, Unit="Nm", InitialValue="0")  % Initialisation value for ASDDc 1st torque
ASDdc_stInitScnd_mp = Simulink.Signal(StorageClass="ExportToFile", HeaderFile="ASDdc_Governor_Signals.h", DefinitionFile="ASDdc_Governor_Signals.c", DataType="boolean", Min=0, Max=1, Unit="NaN", InitialValue="0")  % Indicator for initialisation
ASDdc_trqInitXScnd_mp = Simulink.Signal(StorageClass="ExportToFile", HeaderFile="ASDdc_Governor_Signals.h", DefinitionFile="ASDdc_Governor_Signals.c", DataType="Torq", Min=-3000, Max=3000, Unit="Nm", InitialValue="0")  % Initialisation value for ASDDc 2nd torque
ASDdc_trqInitYScnd_mp = Simulink.Signal(StorageClass="ExportToFile", HeaderFile="ASDdc_Governor_Signals.h", DefinitionFile="ASDdc_Governor_Signals.c", DataType="Torq", Min=-3000, Max=3000, Unit="Nm", InitialValue="0")  % Initialisation value for ASDDc 2nd torque
ASDdc_vLimIni_C = Simulink.Parameter(2.25, StorageClass="ExportToFile", HeaderFile="ASDdc_Governor_Paras.h", DefinitionFile="ASDdc_Governor_Paras.c", DataType="Velocity_kmph", Min=0, Max=250, Unit="km/h")  % ASD disturbance compensator speed limit for initialisation / deactivation
ASDdc_trqLimMin_C = Simulink.Parameter(0, StorageClass="ExportToFile", HeaderFile="ASDdc_Governor_Paras.h", DefinitionFile="ASDdc_Governor_Paras.c", DataType="Torq", Min=-3000, Max=3000, Unit="Nm")  % ASD disturbance compensator output limitation maximum
ASDdc_trqLimMax_C = Simulink.Parameter(0, StorageClass="ExportToFile", HeaderFile="ASDdc_Governor_Paras.h", DefinitionFile="ASDdc_Governor_Paras.c", DataType="Torq", Min=-3000, Max=3000, Unit="Nm")  % ASD disturbance compensator output limitation minximum
PthSet_trqASDdcInit_C = Simulink.Parameter(0, StorageClass="ExportToFile", HeaderFile="ASDdc_Governor_Paras.h", DefinitionFile="ASDdc_Governor_Paras.c", DataType="Torq", Min=-3000, Max=3000, Unit="Nm")  % Initialisation value for disturbance control when overridung overrun shut off
ASDrf_swtLim_C = Simulink.Parameter(3, StorageClass="ExportToFile", HeaderFile="ASDdc_Governor_Paras.h", DefinitionFile="ASDdc_Governor_Paras.c", DataType="State", Min=0, Max=255, Unit="NaN")  % Switch to choose limitation of ASDrf_trqInr to CoETS_trqInrLtd