% Simulink data dictionary CnvSet_Trq2Q.sldd
% references slprj_cm.sldd
% references sl_ddtypes.sldd

CnvSet_qSetPrs = Simulink.Signal(StorageClass="ExportToFile", HeaderFile="CnvSet_Trq2Q_Signals.h", DefinitionFile="CnvSet_Trq2Q_Signals.c", DataType="InjMass", Min=-319, Max=319, Unit="mg/hub", InitialValue="0")  % Setpoint injection quantity current operation mode
CnvSet_etaCurrRmp = Simulink.Signal(StorageClass="ExportToFile", HeaderFile="CnvSet_Trq2Q_Signals.h", DefinitionFile="CnvSet_Trq2Q_Signals.c", DataType="Effcy", Min=-100, Max=100, Unit="Nm/(mg/hub)", InitialValue="6")  % Conversion efficiency corresponding to CnvSet_qSet
CnvSet_qSet = Simulink.Signal(StorageClass="ExportToFile", HeaderFile="CnvSet_Trq2Q_Signals.h", DefinitionFile="CnvSet_Trq2Q_Signals.c", DataType="InjMass", Min=-319, Max=319, Unit="mg/hub", InitialValue="0")  % Set point injection quantity
CnvSet_qSetNxt = Simulink.Signal(StorageClass="ExportToFile", HeaderFile="CnvSet_Trq2Q_Signals.h", DefinitionFile="CnvSet_Trq2Q_Signals.c", DataType="InjMass", Min=-319, Max=319, Unit="mg/hub", InitialValue="0")  % Setpoint injection quantity next opration mode
CnvSet_qStrt = Simulink.Signal(StorageClass="ExportToFile", HeaderFile="CnvSet_Trq2Q_Signals.h", DefinitionFile="CnvSet_Trq2Q_Signals.c", DataType="InjMass", Min=-319, Max=319, Unit="mg/hub", InitialValue="0")  % Injection start quantity
CnvSet_facRmpVal = Simulink.Signal(StorageClass="ExportToFile", HeaderFile="CnvSet_Trq2Q_Signals.h", DefinitionFile="CnvSet_Trq2Q_Signals.c", DataType="Fac_10", Min=-31, Max=31, Unit="NaN", InitialValue="0")  % ramp value for operation mode switchover
CnvSet_etaCurr = Simulink.Signal(StorageClass="ExportToFile", HeaderFile="CnvSet_Trq2Q_Signals.h", DefinitionFile="CnvSet_Trq2Q_Signals.c", DataType="Effcy", Min=-100, Max=100, Unit="Nm/(mg/hub)", InitialValue="6")  % Current conversion efficiency
CnvSet_etaCurrNxt = Simulink.Signal(StorageClass="ExportToFile", HeaderFile="CnvSet_Trq2Q_Signals.h", DefinitionFile="CnvSet_Trq2Q_Signals.c", DataType="Effcy", Min=-100, Max=100, Unit="Nm/(mg/hub)", InitialValue="6")  % conversion efficiency for next operation mode
PthSet_trqInrSetAct = Simulink.Signal(StorageClass="ExportToFile", HeaderFile="CnvSet_Trq2Q_Signals.h", DefinitionFile="CnvSet_Trq2Q_Signals.c", DataType="Torq", Min=-3276.8, Max=3276.7, Unit="Nm", InitialValue="0")  % Current inner engine torque
CnvSet_qSetOpt_mp = Simulink.Signal(StorageClass="ExportToFile", HeaderFile="CnvSet_Trq2Q_Signals.h", DefinitionFile="CnvSet_Trq2Q_Signals.c", DataType="InjMass", Min=-319, Max=319, Unit="mg/hub", InitialValue="0")  % Setpoint injection quantity without corrections
CnvSet_qSetOptNxt_mp = Simulink.Signal(StorageClass="ExportToFile", HeaderFile="CnvSet_Trq2Q_Signals.h", DefinitionFile="CnvSet_Trq2Q_Signals.c", DataType="InjMass", Min=-319, Max=319, Unit="mg/hub", InitialValue="0")  % Setpoint injection quantity without corrections next operation mode
CnvSet_eta0_C = Simulink.Parameter(6, StorageClass="ExportToFile", HeaderFile="CnvSet_Trq2Q_Paras.h", DefinitionFile="CnvSet_Trq2Q_Paras.c", DataType="Effcy", Min=-100, Max=100, Unit="Nm/(mg/hub)")  % Conversion efficiency during start
CnvSet_facRmpVal_CURX = Simulink.Parameter([0 0.1 0.2 0.3 0.4 0.5 0.6 0.7 0.8 0.9 1], StorageClass="ExportToFile", HeaderFile="CnvSet_Trq2Q_Paras.h", DefinitionFile="CnvSet_Trq2Q_Paras.c", DataType="Fac_10", Min=-31, Max=31, Unit="NaN")  % AxisX of the Curve
CnvSet_facRmpVal_CUR = Simulink.Parameter([0 0.1 0.2 0.3 0.4 0.5 0.6 0.7 0.8 0.8 1], StorageClass="ExportToFile", HeaderFile="CnvSet_Trq2Q_Paras.h", DefinitionFile="CnvSet_Trq2Q_Paras.c", DataType="Fac_10", Min=-31, Max=31, Unit="NaN")  % Curve of ramp-Fac_10 for switch over ramp
PhyMod_trq2qBas_MAPX = Simulink.Parameter([250 500 750 1000 1250 1500 1750 2000 2250 2500 2750 3000 3500 4000 4500 5000], StorageClass="ExportToFile", HeaderFile="CnvSet_Trq2Q_Paras.h", DefinitionFile="CnvSet_Trq2Q_Paras.c", DataType="ERPM", Min=-12000, Max=12000, Unit="rpm")  % AxisX of the MAP
PhyMod_trq2qBas_MAPY = Simulink.Parameter([0 30 60 90 120 150 180 210 240 270 300 330 360 390 420 450], StorageClass="ExportToFile", HeaderFile="CnvSet_Trq2Q_Paras.h", DefinitionFile="CnvSet_Trq2Q_Paras.c", DataType="Torq", Min=-3276.8, Max=3276.7, Unit="Nm")  % AxisY of the MAP

PhyMod_trq2qBas_MAP = Simulink.Parameter([0 0 0 0 0 0 0 0 0 0 0 0 0 0 0 0
 6.3 5.8 5.4 5.6 5.8 6.1 6.1 6 6 6 6.1 6.3 6.5 6.7 6.9 7.16
 12.7 12.1 11.5 12 12.1 12.2 12 11.7 11.7 11.8 12 12.3 12.6 12.8 13 13.26
 17.5 16.76 16 16.6 16.8 16.9 16.7 16.5 16.4 16.4 16.5 16.9 17.6 18.2 18.4 18.66
 24.7 23.5 22.3 20.5 20.9 21.3 21.3 21.3 21.5 21.7 21.7 21.7 22.2 22.3 22.5 22.76
 31.5 30.46 29.4 27.4 26.6 25.8 26.3 26.8 26.9 27 27.1 27.2 28 28.8 29 29.26
 37.5 36.7 36.3 34.9 34.6 34.3 34 33.7 33.86 34 33.66 33.3 33.96 34.6 34.8 35.06
 46.1 45 43.6 40.8 40.46 40.1 40.3 40.3 40.3 40.1 40.2 40.3 41.4 42.5 42.7 42.96
 57.2 53.36 52.6 47.6 46.96 46.3 46.06 45.8 46.36 46.9 47.4 47.9 49.4 50.9 51.1 51.36
 63.06 62.06 61.3 54.5 53.7 52.9 52.86 52.8 52.86 52.9 53.76 54.6 55.7 56.8 57 57.26
 71.16 70.16 69.4 60.8 60.3 60.1 60.1 60.4 60.4 60.4 61.3 62.2 62.9 63.6 63.8 64.06
 79.26 78.26 77.5 67.3 67.1 66.8 67.6 68.4 69.7 71 71.5 72 72.5 73 73.5 74.06
 87.36 86.36 85.6 74.8 74.16 73.76 75.34 76.66 79.26 81.84 81.96 82.06 82.36 82.66 83.16 83.7
 95.46 94.46 93.7 82.8 81.46 80.96 83.36 85.16 89.06 92.96 92.66 92.36 92.46 92.56 93.06 93.6
 103.56 102.56 101.8 89.8 89 88.4 91.6 93.9 99.1 104.3 103.6 102.9 102.8 102.7 103.2 103.76
 111.66 110.66 109.9 97.8 96.8 96.1 100.1 102.9 109.4 115.9 114.8 113.7 113.4 113.1 113.6 114.16], StorageClass="ExportToFile", HeaderFile="CnvSet_Trq2Q_Paras.h", DefinitionFile="CnvSet_Trq2Q_Paras.c", DataType="InjMass", Min=-319, Max=319, Unit="mg/hub")  % Engine basic map for conversion of torque/quantity

CnvSet_etaMin_C = Simulink.Parameter(1, StorageClass="ExportToFile", HeaderFile="CnvSet_Trq2Q_Paras.h", DefinitionFile="CnvSet_Trq2Q_Paras.c", DataType="Effcy", Min=-100, Max=100, Unit="Nm/(mg/hub)")  % Current conversion efficiency max limation
CnvSet_etaMax_C = Simulink.Parameter(10, StorageClass="ExportToFile", HeaderFile="CnvSet_Trq2Q_Paras.h", DefinitionFile="CnvSet_Trq2Q_Paras.c", DataType="Effcy", Min=-100, Max=100, Unit="Nm/(mg/hub)")  % Current conversion efficiency min limation

INJ_MASS_ZERO = embedded.fi(
  DataType="Fixed",
  Scaling="SlopeBias",
  Signed=true,
  WordLength=16,
  FixedExponent=-7,
  SlopeAdjustmentFactor=1.28,
  intarray=int16(0),
  noverflows=0,
  nunderflows=0,
  maxlog=-Inf,
  minlog=Inf,
  RoundingMethod="Nearest",
  OverflowAction="Saturate",
  ProductMode="FullPrecision",
  SumMode="FullPrecision",
  ProductWordLength=32,
  SumWordLength=32,
  MaxProductWordLength=65535,
  MaxSumWordLength=65535,
  ProductFractionLength=30,
  ProductFixedExponent=-30,
  ProductSlope=9.313226e-10,
  ProductSlopeAdjustmentFactor=1,
  ProductBias=0,
  SumFractionLength=30,
  SumFixedExponent=-30,
  SumSlope=9.313226e-10,
  SumSlopeAdjustmentFactor=1,
  SumBias=0,
  CastBeforeSum=true,
  DDGMaxProductWordLength=65535,
  DDGMaxSumWordLength=65535,
  DDGProductFixedExponent=-30,
  DDGProductFractionLength=30,
  DDGProductWordLength=32,
  DDGSumFixedExponent=-30,
  DDGSumFractionLength=30,
  DDGSumWordLength=32,
  DDGCastBeforeSum=true,
  DDGProductBias=0,
  DDGProductSlopeAdjustmentFactor=1,
  DDGSumBias=0,
  DDGSumSlopeAdjustmentFactor=1,
  DDGProductSlope=9.313226e-10,
  DDGSumSlope=9.313226e-10,
  Logging=false,
  fimathislocal=false)