% Simulink data dictionary CoETS_TrqCalc.sldd
% references slprj_cm.sldd
% references sl_ddtypes.sldd

CoETS_trqInrCurr = Simulink.Signal(StorageClass="ExportToFile", HeaderFile="CoETS_TrqCalc_Signals.h", DefinitionFile="CoETS_TrqCalc_Signals.c", DataType="Torq", Min=-3276, Max=3276, Unit="Nm", InitialValue="0")  % Inner torque current value
CoETS_trqInrCurrFast = Simulink.Signal(StorageClass="ExportToFile", HeaderFile="CoETS_TrqCalc_Signals.h", DefinitionFile="CoETS_TrqCalc_Signals.c", DataType="Torq", Min=-3276, Max=3276, Unit="Nm", InitialValue="0")  % Inner desired torque (fast path) calculated from CoPT_trqCurrEng [Nm]
CoETS_trqInrLead = Simulink.Signal(StorageClass="ExportToFile", HeaderFile="CoETS_TrqCalc_Signals.h", DefinitionFile="CoETS_TrqCalc_Signals.c", DataType="Torq", Min=-3276, Max=3276, Unit="Nm", InitialValue="0")  % desired lead (inner) torque (without Filter with reserve)
CoETS_trqInrLeadFast = Simulink.Signal(StorageClass="ExportToFile", HeaderFile="CoETS_TrqCalc_Signals.h", DefinitionFile="CoETS_TrqCalc_Signals.c", DataType="Torq", Min=-3276, Max=3276, Unit="Nm", InitialValue="0")  % Inner torque desired value (fast signal path) generated out of CoPT_trqLeadEng
CoETS_stInrDesBrk = Simulink.Signal(StorageClass="ExportToFile", HeaderFile="CoETS_TrqCalc_Signals.h", DefinitionFile="CoETS_TrqCalc_Signals.c", DataType="State4", Min=0, Max=4294967295, Unit="NaN", InitialValue="0")  % Negative torque status for inner torque
CoETS_trqSpdGovLim = Simulink.Signal(StorageClass="ExportToFile", HeaderFile="CoETS_TrqCalc_Signals.h", DefinitionFile="CoETS_TrqCalc_Signals.c", DataType="Torq", Min=-3276.8, Max=3276.7, Unit="Nm", InitialValue="0")  % Inner engine limitation torque for EISGov
CoETS_trqLlim = Simulink.Signal(StorageClass="ExportToFile", HeaderFile="CoETS_TrqCalc_Signals.h", DefinitionFile="CoETS_TrqCalc_Signals.c", DataType="Torq", Min=-3276, Max=3276, Unit="Nm", InitialValue="0")  % Longitudinal limitation for inner engine torque
CoETS_trqInrLtd = Simulink.Signal(StorageClass="ExportToFile", HeaderFile="CoETS_TrqCalc_Signals.h", DefinitionFile="CoETS_TrqCalc_Signals.c", DataType="Torq", Min=-3000, Max=3000, Unit="Nm", InitialValue="0")  % inner torque set value after limitation, before AS
CoETS_trqUnFltLtd = Simulink.Signal(StorageClass="ExportToFile", HeaderFile="CoETS_TrqCalc_Signals.h", DefinitionFile="CoETS_TrqCalc_Signals.c", DataType="Torq", Min=-3276, Max=3276, Unit="Nm", InitialValue="0")  % Limited idle speed governor torque
CoETS_trqInrSet_mp = Simulink.Signal(StorageClass="ExportToFile", HeaderFile="CoETS_TrqCalc_Signals.h", DefinitionFile="CoETS_TrqCalc_Signals.c", DataType="Torq", Min=-3276, Max=3276, Unit="Nm", InitialValue="0")  % Intermediate inner torque for the set path without filteration
CoETS_trqInrSetSlow = Simulink.Signal(StorageClass="ExportToFile", HeaderFile="CoETS_TrqCalc_Signals.h", DefinitionFile="CoETS_TrqCalc_Signals.c", DataType="Torq", Min=-3276, Max=3276, Unit="Nm", InitialValue="0")  % Filtered inner torque ( positive torque) desired value (standard signal path) generated out of CoPT_trqDesEng
CoETS_trqUnFltLtdSet = Simulink.Signal(StorageClass="ExportToFile", HeaderFile="CoETS_TrqCalc_Signals.h", DefinitionFile="CoETS_TrqCalc_Signals.c", DataType="Torq", Min=-3276, Max=3276, Unit="Nm", InitialValue="0")  % Compensation torque of the accessories
CoETS_trqInrLtdPre_mp = Simulink.Signal(StorageClass="ExportToFile", HeaderFile="CoETS_TrqCalc_Signals.h", DefinitionFile="CoETS_TrqCalc_Signals.c", DataType="Torq", Min=-3276, Max=3276, Unit="Nm", InitialValue="0")  % inner set torque after limitation, before active surge damper
CoETS_trqUnFltSet = Simulink.Signal(StorageClass="ExportToFile", HeaderFile="CoETS_TrqCalc_Signals.h", DefinitionFile="CoETS_TrqCalc_Signals.c", DataType="Torq", Min=-3276, Max=3276, Unit="Nm", InitialValue="0")  % Compensation torque of "loss torque compensation" to bypass filter influences on the set path which is partly compensated
CoETS_trqInrLimSet = Simulink.Signal(StorageClass="ExportToFile", HeaderFile="CoETS_TrqCalc_Signals.h", DefinitionFile="CoETS_TrqCalc_Signals.c", DataType="Torq", Min=-3000, Max=3000, Unit="Nm", InitialValue="0")  % Limitation torque without the part of the speed governor
CoETS_trqInrDesNTC = Simulink.Signal(StorageClass="ExportToFile", HeaderFile="CoETS_TrqCalc_Signals.h", DefinitionFile="CoETS_TrqCalc_Signals.c", DataType="Torq", Min=-3276, Max=3276, Unit="Nm", InitialValue="0")  % Additional desired engine friction Nm
CoETS_trqInrLim = Simulink.Signal(StorageClass="ExportToFile", HeaderFile="CoETS_TrqCalc_Signals.h", DefinitionFile="CoETS_TrqCalc_Signals.c", DataType="Torq", Min=-3276, Max=3276, Unit="Nm", InitialValue="0")  % Limitation torque (inner engine torque)
CoETS_trqLlim_mp = Simulink.Signal(StorageClass="ExportToFile", HeaderFile="CoETS_TrqCalc_Signals.h", DefinitionFile="CoETS_TrqCalc_Signals.c", DataType="Torq", Min=-3276, Max=3276, Unit="Nm", InitialValue="0")  % Longitudinal limitation for inner engine torque
CoETS_trqMaxOfsBrkDes_C = Simulink.Parameter(0, StorageClass="ExportToFile", HeaderFile="CoETS_TrqCalc_Paras.h", DefinitionFile="CoETS_TrqCalc_Paras.c", DataType="Torq", Min=-3276, Max=3276, Unit="Nm")  % Max offset torque
CoETS_trqMinOfsBrkDes_C = Simulink.Parameter(0, StorageClass="ExportToFile", HeaderFile="CoETS_TrqCalc_Paras.h", DefinitionFile="CoETS_TrqCalc_Paras.c", DataType="Torq", Min=-3276, Max=3276, Unit="Nm")  % Min offset torque
DCSOVRDSENGPRT_SY = fi(0, 0, 32, 0)
ENGPRT_OVRDS_DCS = fi(1, 0, 32, 0)
PTPRTOVRDSSPDGOV_SY = fi(0, 0, 32, 0)
SPDGOV_OVRDS_PTPRT = fi(0, 0, 32, 0)