% Simulink data dictionary PthSet_TrqCalc.sldd
% references slprj_cm.sldd
% references sl_ddtypes.sldd

PthSet_trqInrSetSum = Simulink.Signal(StorageClass="ExportToFile", HeaderFile="PthSet_TrqCalc_Signals.h", DefinitionFile="PthSet_TrqCalc_Signals.c", DataType="Torq", Min=-3000, Max=3276.7, Unit="Nm", InitialValue="0")  % Sum of inner set torque
PthSet_stActvMonLim = Simulink.Signal(StorageClass="ExportToFile", HeaderFile="PthSet_TrqCalc_Signals.h", DefinitionFile="PthSet_TrqCalc_Signals.c", DataType="State", Min=0, Max=255, Unit="NaN", InitialValue="0")  % State of monitoring limitation
PthSet_trqInrSet = Simulink.Signal(StorageClass="ExportToFile", HeaderFile="PthSet_TrqCalc_Signals.h", DefinitionFile="PthSet_TrqCalc_Signals.c", DataType="Torq", Min=-3000, Max=3276.7, Unit="Nm", InitialValue="0")  % Inner torque set value after monitoring limitation
PthSet_stDisable = Simulink.Signal(StorageClass="ExportToFile", HeaderFile="PthSet_TrqCalc_Signals.h", DefinitionFile="PthSet_TrqCalc_Signals.c", DataType="boolean", Min=0, Max=1, Unit="NaN", InitialValue="0")  % Condition: overrun fuel cut-off
PthSet_trqSetASDdc = Simulink.Signal(StorageClass="ExportToFile", HeaderFile="PthSet_TrqCalc_Signals.h", DefinitionFile="PthSet_TrqCalc_Signals.c", DataType="Torq", Min=-3000, Max=3276.7, Unit="Nm", InitialValue="0")  % Inner torque set value after first limitation
PthSet_trqInrSetNoMo = Simulink.Signal(StorageClass="ExportToFile", HeaderFile="PthSet_TrqCalc_Signals.h", DefinitionFile="PthSet_TrqCalc_Signals.c", DataType="Torq", Min=-3000, Max=3276.7, Unit="Nm", InitialValue="0")  % Inner torque set value before monitoring limitation
PthSet_trqBefPeakLim_mp = Simulink.Signal(StorageClass="ExportToFile", HeaderFile="PthSet_TrqCalc_Signals.h", DefinitionFile="PthSet_TrqCalc_Signals.c", DataType="Torq", Min=-3000, Max=3276.7, Unit="Nm", InitialValue="0")  % Maximum torque value before railpressure peak limiter
PthSet_tiSwtOff_mp = Simulink.Signal(StorageClass="ExportToFile", HeaderFile="PthSet_TrqCalc_Signals.h", DefinitionFile="PthSet_TrqCalc_Signals.c", DataType="Debncd_ms", Min=0, Max=65535, Unit="ms", InitialValue="0")  % Time for switch off after overrun detection
PthSet_tiRmpStrt_mp = Simulink.Signal(StorageClass="ExportToFile", HeaderFile="PthSet_TrqCalc_Signals.h", DefinitionFile="PthSet_TrqCalc_Signals.c", DataType="Debncd_ms", Min=0, Max=65535, Unit="ms", InitialValue="0")  % Time after overrun detection for ramp start
PthSet_dtrqRmpDwn_mp = Simulink.Signal(StorageClass="ExportToFile", HeaderFile="PthSet_TrqCalc_Signals.h", DefinitionFile="PthSet_TrqCalc_Signals.c", DataType="Torq_s", Min=-3000, Max=3276.7, Unit="Nm/s", InitialValue="0")  % Value for ramp negative slope
PthSet_trqRmp_mp = Simulink.Signal(StorageClass="ExportToFile", HeaderFile="PthSet_TrqCalc_Signals.h", DefinitionFile="PthSet_TrqCalc_Signals.c", DataType="Torq", Min=-3000, Max=3276.7, Unit="Nm", InitialValue="0")  % Ramp output torque of overrun shut off
PthSet_stRmp_mp = Simulink.Signal(StorageClass="ExportToFile", HeaderFile="PthSet_TrqCalc_Signals.h", DefinitionFile="PthSet_TrqCalc_Signals.c", DataType="boolean", Min=0, Max=1, Unit="NaN", InitialValue="0")  % Ramp state for overrun shut off (0: inactive; 1: active)
PthSet_trqInrSet_mp = Simulink.Signal(StorageClass="ExportToFile", HeaderFile="PthSet_TrqCalc_Signals.h", DefinitionFile="PthSet_TrqCalc_Signals.c", DataType="Torq", Min=-3000, Max=3276.7, Unit="Nm", InitialValue="0")  % PthSet: inner torque set value measure point
PthSet_trqLimOffs_mp = Simulink.Signal(StorageClass="ExportToFile", HeaderFile="PthSet_TrqCalc_Signals.h", DefinitionFile="PthSet_TrqCalc_Signals.c", DataType="Torq", Min=-3000, Max=3276.7, Unit="Nm", InitialValue="0")  % Limitation torque value with offset
PthSet_trqBefRmp_mp = Simulink.Signal(StorageClass="ExportToFile", HeaderFile="PthSet_TrqCalc_Signals.h", DefinitionFile="PthSet_TrqCalc_Signals.c", DataType="Torq", Min=-3000, Max=3276.7, Unit="Nm", InitialValue="0")  % Set torque after second limitation, before overrun shut off
PthSet_trqOffs_C = Simulink.Parameter(10, StorageClass="ExportToFile", HeaderFile="PthSet_TrqCalc_Paras.h", DefinitionFile="PthSet_TrqCalc_Paras.c", DataType="Torq", Min=-3000, Max=3276.7, Unit="Nm")  % Offset on limitation torque value to allow ASDdc to work
PthSet_tiSwtOffDfl_C = Simulink.Parameter(1000, StorageClass="ExportToFile", HeaderFile="PthSet_TrqCalc_Paras.h", DefinitionFile="PthSet_TrqCalc_Paras.c", DataType="Debncd_ms", Min=0, Max=65535, Unit="ms")  % Default time after overrun detection until switch off
PthSet_tiRmpStrtDfl_C = Simulink.Parameter(500, StorageClass="ExportToFile", HeaderFile="PthSet_TrqCalc_Paras.h", DefinitionFile="PthSet_TrqCalc_Paras.c", DataType="Debncd_ms", Min=0, Max=65535, Unit="ms")  % Default time after overrun detection until ramp starts
PthSet_dtrqRmpDwnDfl_C = Simulink.Parameter(100, StorageClass="ExportToFile", HeaderFile="PthSet_TrqCalc_Paras.h", DefinitionFile="PthSet_TrqCalc_Paras.c", DataType="Torq_s", Min=-3000, Max=3276.7, Unit="Nm/s")  % Torque ramp negative slope
PthSet_dtrqRmpDwn_CUR = Simulink.Parameter(repmat(100, 1, 6), StorageClass="ExportToFile", HeaderFile="PthSet_TrqCalc_Paras.h", DefinitionFile="PthSet_TrqCalc_Paras.c", DataType="Torq_s", Min=-3000, Max=3276.7, Unit="Nm/s")  % curve of ramp slope
PthSet_dtrqRmpDwn_CURX = Simulink.Parameter([0.7 1.1 1.7 2.5 3.5 4.5], StorageClass="ExportToFile", HeaderFile="PthSet_TrqCalc_Paras.h", DefinitionFile="PthSet_TrqCalc_Paras.c", DataType="TraGear", Min=-327, Max=327, Unit="NaN")  % axis of ramp slope
PthSet_tiSwtOff_CURX = Simulink.Parameter([0.7 1.1 1.7 2.5 3.5 4.5], StorageClass="ExportToFile", HeaderFile="PthSet_TrqCalc_Paras.h", DefinitionFile="PthSet_TrqCalc_Paras.c", DataType="TraGear", Min=-327, Max=327, Unit="NaN")  % axis of time before switchoff
PthSet_tiSwtOff_CUR = Simulink.Parameter(repmat(1000, 1, 6), StorageClass="ExportToFile", HeaderFile="PthSet_TrqCalc_Paras.h", DefinitionFile="PthSet_TrqCalc_Paras.c", DataType="Debncd_ms", Min=0, Max=65535, Unit="ms")  % curve of time before switchoff
PthSet_tiRmpStrt_CURX = Simulink.Parameter([0.7 1.1 1.7 2.5 3.5 4.5], StorageClass="ExportToFile", HeaderFile="PthSet_TrqCalc_Paras.h", DefinitionFile="PthSet_TrqCalc_Paras.c", DataType="TraGear", Min=-327, Max=327, Unit="NaN")  % axis of time before start ramp
PthSet_tiRmpStrt_CUR = Simulink.Parameter(repmat(500, 1, 6), StorageClass="ExportToFile", HeaderFile="PthSet_TrqCalc_Paras.h", DefinitionFile="PthSet_TrqCalc_Paras.c", DataType="Debncd_ms", Min=0, Max=65535, Unit="ms")  % curve of time before start ramp

TRQ_ZERO = embedded.fi(
  DataType="Fixed",
  Scaling="SlopeBias",
  Signed=true,
  WordLength=16,
  FixedExponent=-4,
  SlopeAdjustmentFactor=1.6,
  intarray=int16(0),
  noverflows=0,
  nunderflows=0,
  maxlog=-Inf,
  minlog=Inf,
  RoundingMethod="Nearest",
  OverflowAction="Saturate",
  ProductMode="FullPrecision",
  SumMode="FullPrecision",
  ProductWordLength=32,
  SumWordLength=32,
  MaxProductWordLength=65535,
  MaxSumWordLength=65535,
  ProductFractionLength=30,
  ProductFixedExponent=-30,
  ProductSlope=9.313226e-10,
  ProductSlopeAdjustmentFactor=1,
  ProductBias=0,
  SumFractionLength=30,
  SumFixedExponent=-30,
  SumSlope=9.313226e-10,
  SumSlopeAdjustmentFactor=1,
  SumBias=0,
  CastBeforeSum=true,
  DDGMaxProductWordLength=65535,
  DDGMaxSumWordLength=65535,
  DDGProductFixedExponent=-30,
  DDGProductFractionLength=30,
  DDGProductWordLength=32,
  DDGSumFixedExponent=-30,
  DDGSumFractionLength=30,
  DDGSumWordLength=32,
  DDGCastBeforeSum=true,
  DDGProductBias=0,
  DDGProductSlopeAdjustmentFactor=1,
  DDGSumBias=0,
  DDGSumSlopeAdjustmentFactor=1,
  DDGProductSlope=9.313226e-10,
  DDGSumSlope=9.313226e-10,
  Logging=false,
  fimathislocal=false)