% Simulink data dictionary EngDem_TrqLimCoord.sldd
% references slprj_cm.sldd
% references sl_ddtypes.sldd
% references sl_const.sldd

EngDem_trqLimErr = Simulink.Signal(StorageClass="ExportToFile", HeaderFile="EngDem_TrqLimCoord_Signals.h", DefinitionFile="EngDem_TrqLimCoord_Signals.c", DataType="Torq", Min=-3276.8, Max=3276.7, Unit="Nm", InitialValue="0")  % Substitute limiting torque in the event of an error
EngDem_trqLimPDiff = Simulink.Signal(StorageClass="ExportToFile", HeaderFile="EngDem_TrqLimCoord_Signals.h", DefinitionFile="EngDem_TrqLimCoord_Signals.c", DataType="Torq", Min=-3276.8, Max=3276.7, Unit="Nm", InitialValue="0")  % Limiting torque due to exhaust gas back-pressure
EngDem_trqInrLim = Simulink.Signal(StorageClass="ExportToFile", HeaderFile="EngDem_TrqLimCoord_Signals.h", DefinitionFile="EngDem_TrqLimCoord_Signals.c", DataType="Torq", Min=-3276.8, Max=3276.7, Unit="Nm", InitialValue="0")  % Resulting limiting torque (inner engine torque)
EngDem_stErr_mp = Simulink.Signal(StorageClass="ExportToFile", HeaderFile="EngDem_TrqLimCoord_Signals.h", DefinitionFile="EngDem_TrqLimCoord_Signals.c", DataType="boolean", Min=0, Max=1, Unit="NaN", InitialValue="0")  % Status of the limitation FIDs
EngDem_facAdj = Simulink.Signal(StorageClass="ExportToFile", HeaderFile="EngDem_TrqLimCoord_Signals.h", DefinitionFile="EngDem_TrqLimCoord_Signals.c", DataType="Fac_10", Min=-10, Max=10, Unit="NaN", InitialValue="1")  % EEPROM adjustment value for correction of the limiting torque
EngDem_trqInrLimLead = Simulink.Signal(StorageClass="ExportToFile", HeaderFile="EngDem_TrqLimCoord_Signals.h", DefinitionFile="EngDem_TrqLimCoord_Signals.c", DataType="Torq", Min=-3276.8, Max=3276.7, Unit="Nm", InitialValue="0")  % inner engine limted lead torque
EngDem_trqInrLimSlow = Simulink.Signal(StorageClass="ExportToFile", HeaderFile="EngDem_TrqLimCoord_Signals.h", DefinitionFile="EngDem_TrqLimCoord_Signals.c", DataType="Torq", Min=-3276.8, Max=3276.7, Unit="Nm", InitialValue="0")  % inner engine limted torque for Slow Path
EngDem_trqLimRslt_mp = Simulink.Signal(StorageClass="ExportToFile", HeaderFile="EngDem_TrqLimCoord_Signals.h", DefinitionFile="EngDem_TrqLimCoord_Signals.c", DataType="Torq", Min=-3276.8, Max=3276.7, Unit="Nm", InitialValue="0")  % Resulting limiting torque before ramp
EngDem_trqLimSwt = Simulink.Signal(StorageClass="ExportToFile", HeaderFile="EngDem_TrqLimCoord_Signals.h", DefinitionFile="EngDem_TrqLimCoord_Signals.c", DataType="Torq", Min=-3276.8, Max=3276.7, Unit="Nm", InitialValue="0")  % Output of ramp switch element for torque limitation in case of system error
EngDem_pDiffPFltPrdc_mp = Simulink.Signal(StorageClass="ExportToFile", HeaderFile="EngDem_TrqLimCoord_Signals.h", DefinitionFile="EngDem_TrqLimCoord_Signals.c", DataType="Press_kpa", Min=0, Max=500, Unit="kPa", InitialValue="0")  % Predicted difference pressure over particulate filter
EngDem_trqLimRawErr_mp = Simulink.Signal(StorageClass="ExportToFile", HeaderFile="EngDem_TrqLimCoord_Signals.h", DefinitionFile="EngDem_TrqLimCoord_Signals.c", DataType="Torq", Min=-3276.8, Max=3276.7, Unit="Nm", InitialValue="0")  % Raw value of torque limitation in case of system error
EngDem_trqLimMinCalc = Simulink.Signal(StorageClass="ExportToFile", HeaderFile="EngDem_TrqLimCoord_Signals.h", DefinitionFile="EngDem_TrqLimCoord_Signals.c", DataType="Torq", Min=-3276.8, Max=3276.7, Unit="Nm", InitialValue="0")  % Application parameter for engine torque limit demanded by the performance limiter.
EngDem_trqLimCalc = Simulink.Signal(StorageClass="ExportToFile", HeaderFile="EngDem_TrqLimCoord_Signals.h", DefinitionFile="EngDem_TrqLimCoord_Signals.c", DataType="Torq", Min=-3276.8, Max=3276.7, Unit="Nm", InitialValue="0")  % Limiting torque due to exhaust gas back-pressure
EngDem_RmpLimErrPos_C = Simulink.Parameter(50, StorageClass="ExportToFile", HeaderFile="EngDem_TrqLimCoord_Paras.h", DefinitionFile="EngDem_TrqLimCoord_Paras.c", DataType="Torq_s", Min=-1000, Max=1000, Unit="Nm/s")  % Coordination of the limiting torques of engine demands
EngDem_RmpLimErrNeg_C = Simulink.Parameter(50, StorageClass="ExportToFile", HeaderFile="EngDem_TrqLimCoord_Paras.h", DefinitionFile="EngDem_TrqLimCoord_Paras.c", DataType="Torq_s", Min=-1000, Max=1000, Unit="Nm/s")  % Coordination of the limiting torques of engine demands
EngDem_facAdjMin_C = Simulink.Parameter(1, StorageClass="ExportToFile", HeaderFile="EngDem_TrqLimCoord_Paras.h", DefinitionFile="EngDem_TrqLimCoord_Paras.c", DataType="Fac_10", Min=-10, Max=10, Unit="NaN")  % Minimum adjustment value for correction of torque limitation
EngDem_facAdjMax_C = Simulink.Parameter(1, StorageClass="ExportToFile", HeaderFile="EngDem_TrqLimCoord_Paras.h", DefinitionFile="EngDem_TrqLimCoord_Paras.c", DataType="Fac_10", Min=-10, Max=10, Unit="NaN")  % Maximum adjustment value for correction of torque limitation
EngDem_TrqLimErrRmpPos_C = Simulink.Parameter(100, StorageClass="ExportToFile", HeaderFile="EngDem_TrqLimCoord_Paras.h", DefinitionFile="EngDem_TrqLimCoord_Paras.c", DataType="Torq_s", Min=-1000, Max=1000, Unit="Nm/s")  % Slope ramp up and down (limitation in case of system error)
EngDem_TrqLimErrRmpNeg_C = Simulink.Parameter(50, StorageClass="ExportToFile", HeaderFile="EngDem_TrqLimCoord_Paras.h", DefinitionFile="EngDem_TrqLimCoord_Paras.c", DataType="Torq_s", Min=-1000, Max=1000, Unit="Nm/s")  % Slope ramp up and down (limitation in case of system error)
EngDem_facDvolPT1_C = Simulink.Parameter(50, StorageClass="ExportToFile", HeaderFile="EngDem_TrqLimCoord_Paras.h", DefinitionFile="EngDem_TrqLimCoord_Paras.c", DataType="Fac100", Min=0, Max=99.9985, Unit="NaN")  % Time constant of exhatust gas volume PT1 filtering.
EngDem_facResFlowPT1_C = Simulink.Parameter(50, StorageClass="ExportToFile", HeaderFile="EngDem_TrqLimCoord_Paras.h", DefinitionFile="EngDem_TrqLimCoord_Paras.c", DataType="Fac100", Min=0, Max=99.9985, Unit="NaN")  % Time constant of exhaust gas flow resistance PT1 filtering.
EngDem_trqLimPDiff_CURX = Simulink.Parameter([0 14 28 42 56 70 84 98 112 126 140 154 168 196 210 224 238 252 266 280 294 308 322 336 350], StorageClass="ExportToFile", HeaderFile="EngDem_TrqLimCoord_Paras.h", DefinitionFile="EngDem_TrqLimCoord_Paras.c", DataType="Press_kpa", Min=0, Max=350, Unit="kPa")  % EngDem_pDiffPFltPrdc_mp
EngDem_trqLimPDiff_CUR = Simulink.Parameter(repmat(3000, 1, 25), StorageClass="ExportToFile", HeaderFile="EngDem_TrqLimCoord_Paras.h", DefinitionFile="EngDem_TrqLimCoord_Paras.c", DataType="Torq_s", Min=-3276.8, Max=3276.7, Unit="Nm")  % Limitation value for the differential pressure of particulate filter.
EngDem_trqLimErr1_CURX = Simulink.Parameter([0 250 500 750 1000 1250 1500 1750 2000 2250 2500 2750 3000 3250 3500 3750 4000 4250 4500 4750 5000 5250 5500 5750 6000], StorageClass="ExportToFile", HeaderFile="EngDem_TrqLimCoord_Paras.h", DefinitionFile="EngDem_TrqLimCoord_Paras.c", DataType="ERPM", Min=0, Max=6000, Unit="rpm")  % Epm_nEng
EngDem_trqLimErr1_CUR = Simulink.Parameter([200 200 200 200 200 200 230 230 230 180 0 0 0 0 0 0 0 0 0 0 0 0 0 0 0], StorageClass="ExportToFile", HeaderFile="EngDem_TrqLimCoord_Paras.h", DefinitionFile="EngDem_TrqLimCoord_Paras.c", DataType="Torq_s", Min=-3276.8, Max=3276.7, Unit="Nm")  % Limiting torque curve in the event of system error
EngDem_trqLimErr2_CURX = Simulink.Parameter([0 250 500 750 1000 1250 1500 1750 2000 2250 2500 2750 3000 3250 3500 3750 4000 4250 4500 4750 5000 5250 5500 5750 6000], StorageClass="ExportToFile", HeaderFile="EngDem_TrqLimCoord_Paras.h", DefinitionFile="EngDem_TrqLimCoord_Paras.c", DataType="ERPM", Min=0, Max=6000, Unit="rpm")  % Epm_nEng
EngDem_trqLimErr2_CUR = Simulink.Parameter([200 200 200 200 200 200 230 230 230 180 0 0 0 0 0 0 0 0 0 0 0 0 0 0 0], StorageClass="ExportToFile", HeaderFile="EngDem_TrqLimCoord_Paras.h", DefinitionFile="EngDem_TrqLimCoord_Paras.c", DataType="Torq_s", Min=-3276.8, Max=3276.7, Unit="Nm")  % Limiting torque curve in the event of system error 2.
EngDem_trqLimErr3_CURX = Simulink.Parameter([0 250 500 750 1000 1250 1500 1750 2000 2250 2500 2750 3000 3250 3500 3750 4000 4250 4500 4750 5000 5250 5500 5750 6000], StorageClass="ExportToFile", HeaderFile="EngDem_TrqLimCoord_Paras.h", DefinitionFile="EngDem_TrqLimCoord_Paras.c", DataType="ERPM", Min=0, Max=6000, Unit="rpm")  % Epm_nEng
EngDem_trqLimErr3_CUR = Simulink.Parameter([200 200 200 200 200 200 230 230 230 180 0 0 0 0 0 0 0 0 0 0 0 0 0 0 0], StorageClass="ExportToFile", HeaderFile="EngDem_TrqLimCoord_Paras.h", DefinitionFile="EngDem_TrqLimCoord_Paras.c", DataType="Torq_s", Min=-3276.8, Max=3276.7, Unit="Nm")  % Limiting torque curve in the event of system error 3.
EngDem_trqLimErr4_CURX = Simulink.Parameter([0 250 500 750 1000 1250 1500 1750 2000 2250 2500 2750 3000 3250 3500 3750 4000 4250 4500 4750 5000 5250 5500 5750 6000], StorageClass="ExportToFile", HeaderFile="EngDem_TrqLimCoord_Paras.h", DefinitionFile="EngDem_TrqLimCoord_Paras.c", DataType="ERPM", Min=0, Max=6000, Unit="rpm")  % Epm_nEng
EngDem_trqLimErr4_CUR = Simulink.Parameter([200 200 200 200 200 200 230 230 230 180 0 0 0 0 0 0 0 0 0 0 0 0 0 0 0], StorageClass="ExportToFile", HeaderFile="EngDem_TrqLimCoord_Paras.h", DefinitionFile="EngDem_TrqLimCoord_Paras.c", DataType="Torq_s", Min=-3276.8, Max=3276.7, Unit="Nm")  % Limiting torque curve in the event of system error 4.
EngDem_facAdj_C = Simulink.Parameter(1, StorageClass="ExportToFile", HeaderFile="EngDem_TrqLimCoord_Paras.h", DefinitionFile="EngDem_TrqLimCoord_Paras.c", DataType="Fac_10", Min=-10, Max=10, Unit="NaN")  % EEPROM adjustment value for correction of the limiting torque