% Simulink data dictionary EngPrt_PrtLimMech.sldd
% references slprj_cm.sldd
% references sl_ddtypes.sldd

EngPrt_trqLimMech = Simulink.Signal(StorageClass="ExportToFile", HeaderFile="EngPrt_PrtLimMech_Signals.h", DefinitionFile="EngPrt_PrtLimMech_Signals.c", DataType="Torq", Min=-3276.8, Max=3276.7, Unit="Nm", InitialValue="0")  % Resulting limiting torque for engine mechanics protection (inner engine torque)
EngPrt_trqUnLim = Simulink.Signal(StorageClass="ExportToFile", HeaderFile="EngPrt_PrtLimMech_Signals.h", DefinitionFile="EngPrt_PrtLimMech_Signals.c", DataType="Torq", Min=-3276.8, Max=3276.7, Unit="Nm", InitialValue="0")  % Enabled torque from the maximum power manager
EngPrt_trqNLim = Simulink.Signal(StorageClass="ExportToFile", HeaderFile="EngPrt_PrtLimMech_Signals.h", DefinitionFile="EngPrt_PrtLimMech_Signals.c", DataType="Torq", Min=-3276.8, Max=3276.7, Unit="Nm", InitialValue="0")  % Limiting torque for protection from excessive engine speed
EngPrt_trqLimEngTempCor_mp = Simulink.Signal(StorageClass="ExportToFile", HeaderFile="EngPrt_PrtLimMech_Signals.h", DefinitionFile="EngPrt_PrtLimMech_Signals.c", DataType="Torq", Min=-3276.8, Max=3276.7, Unit="Nm", InitialValue="0")  % Engine Protection based on Engine temperature and Engine Speed
EngPrt_trqLimAPSCor_mp = Simulink.Signal(StorageClass="ExportToFile", HeaderFile="EngPrt_PrtLimMech_Signals.h", DefinitionFile="EngPrt_PrtLimMech_Signals.c", DataType="Torq", Min=-3276.8, Max=3276.7, Unit="Nm", InitialValue="0")  % Torque limitation correction factor based on atmospheric pressure for engine protection
EngPrt_facTrqLimCor_mp = Simulink.Signal(StorageClass="ExportToFile", HeaderFile="EngPrt_PrtLimMech_Signals.h", DefinitionFile="EngPrt_PrtLimMech_Signals.c", DataType="Fac_10", Min=-10, Max=10, Unit="NaN", InitialValue="0")  % Env pressure and Engine Temperature Correction value for Torque Limitation
EngPrt_trqLimCor_mp = Simulink.Signal(StorageClass="ExportToFile", HeaderFile="EngPrt_PrtLimMech_Signals.h", DefinitionFile="EngPrt_PrtLimMech_Signals.c", DataType="Torq", Min=-3276.8, Max=3276.7, Unit="Nm", InitialValue="0")  % Torque correction based on Env Pressure or Engine Temperature field
EngPrt_trqLimCorVal_mp = Simulink.Signal(StorageClass="ExportToFile", HeaderFile="EngPrt_PrtLimMech_Signals.h", DefinitionFile="EngPrt_PrtLimMech_Signals.c", DataType="Torq", Min=-3276.8, Max=3276.7, Unit="Nm", InitialValue="0")  % Torque correction based on Env Pressure or Engine Temperature field multiplied by a factor
EngPrt_qLim_mp = Simulink.Signal(StorageClass="ExportToFile", HeaderFile="EngPrt_PrtLimMech_Signals.h", DefinitionFile="EngPrt_PrtLimMech_Signals.c", DataType="InjMass", Min=-319, Max=319, Unit="mg/hub", InitialValue="0")  % Limitation quantity to protection from excessive torque (Application of the limitation as Injection quantity)
EngPrt_swtLimCorType_C = Simulink.Parameter(Switch.OFF, StorageClass="ExportToFile", HeaderFile="EngPrt_PrtLimMech_Paras.h", DefinitionFile="EngPrt_PrtLimMech_Paras.c", DataType="Enum: Switch", Unit="NaN")  % Application parameter to determine the torque correction factor
EngPrt_RmpLimNErrPos_C = Simulink.Parameter(10, StorageClass="ExportToFile", HeaderFile="EngPrt_PrtLimMech_Paras.h", DefinitionFile="EngPrt_PrtLimMech_Paras.c", DataType="Torq_s", Min=-1000, Max=1000, Unit="Nm/s")  % Positive (.Pos_C) resp. ramp gradient between engine speed limitation curves
EngPrt_RmpLimNErrNeg_C = Simulink.Parameter(10, StorageClass="ExportToFile", HeaderFile="EngPrt_PrtLimMech_Paras.h", DefinitionFile="EngPrt_PrtLimMech_Paras.c", DataType="Torq_s", Min=-1000, Max=1000, Unit="Nm/s")  % negative (.Neg_C) ramp gradient between engine speed limitation curves
EngPrt_trqLim_CURX = Simulink.Parameter([500 800 1000 1200 1400 1600 1800 1900 2000 2200 2400 2600 2700 2800 3000 3100 3200 3350 3475 3600], StorageClass="ExportToFile", HeaderFile="EngPrt_PrtLimMech_Paras.h", DefinitionFile="EngPrt_PrtLimMech_Paras.c", DataType="ERPM", Min=0, Max=6000, Unit="rpm")  % Epm_nEng
EngPrt_trqLim_CUR = Simulink.Parameter([250 212.04 192.51 214.83 231.012 231.57 233.244 234.36 236.034 236.592 242.73 239.94 217.5 175.8 30.4 0 0 0 0 0], StorageClass="ExportToFile", HeaderFile="EngPrt_PrtLimMech_Paras.h", DefinitionFile="EngPrt_PrtLimMech_Paras.c", DataType="Torq", Min=-3276.8, Max=3276.7, Unit="Nm")  % Curve for torque limitation (according to application inner or outer engine torque)
EngPrt_trqNLimSpr_CUR = Simulink.Parameter(repmat(300, 1, 20), StorageClass="ExportToFile", HeaderFile="EngPrt_PrtLimMech_Paras.h", DefinitionFile="EngPrt_PrtLimMech_Paras.c", DataType="Torq", Min=-3276.8, Max=3276.7, Unit="Nm")  % Curve for for engine speed limitation in case of system errors (as limitation torque)
EngPrt_trqNLimSpr_CURX = Simulink.Parameter([0 250 500 800 1000 1250 1400 1600 1800 2000 2200 2400 2500 2600 2700 2800 2900 3000 4750 5000], StorageClass="ExportToFile", HeaderFile="EngPrt_PrtLimMech_Paras.h", DefinitionFile="EngPrt_PrtLimMech_Paras.c", DataType="ERPM", Min=0, Max=6000, Unit="rpm")  % Epm_nEng
EngPrt_trqNLim_CUR = Simulink.Parameter(repmat(400, 1, 20), StorageClass="ExportToFile", HeaderFile="EngPrt_PrtLimMech_Paras.h", DefinitionFile="EngPrt_PrtLimMech_Paras.c", DataType="Torq", Min=-3276.8, Max=3276.7, Unit="Nm")  % Curve for normal engine speed limitation (inner engine torque)
EngPrt_trqNLim_CURX = Simulink.Parameter([0 250 500 750 1000 1250 1500 1750 2250 2500 2750 3000 3250 3500 3750 4000 4250 4500 4750 5000], StorageClass="ExportToFile", HeaderFile="EngPrt_PrtLimMech_Paras.h", DefinitionFile="EngPrt_PrtLimMech_Paras.c", DataType="ERPM", Min=0, Max=6000, Unit="rpm")  % Epm_nEng
EngPrt_trqLimEngTempCor_MAP = Simulink.Parameter(repmat(0, 16, 16), StorageClass="ExportToFile", HeaderFile="EngPrt_PrtLimMech_Paras.h", DefinitionFile="EngPrt_PrtLimMech_Paras.c", DataType="Torq", Min=-3276.8, Max=3276.7, Unit="Nm")  % Engine Protection based on Engine temperature and Engine Speed
EngPrt_trqLimEngTempCor_MAPY = Simulink.Parameter([-50 -35 -20 -5 0 15 25 30 45 60 75 90 105 120 130 150], StorageClass="ExportToFile", HeaderFile="EngPrt_PrtLimMech_Paras.h", DefinitionFile="EngPrt_PrtLimMech_Paras.c", DataType="Temp_C", Min=-3000, Max=3000, Unit="deg")  % EngPrt_tTrqLim_mp
EngPrt_trqLimEngTempCor_MAPX = Simulink.Parameter([0 250 500 750 1000 1250 1500 3750 4000 4250 4500 4750 5000 5250 5500 6000], StorageClass="ExportToFile", HeaderFile="EngPrt_PrtLimMech_Paras.h", DefinitionFile="EngPrt_PrtLimMech_Paras.c", DataType="ERPM", Min=0, Max=6000, Unit="rpm")  % Epm_nEng
EngPrt_trqLimAPSCor_MAP = Simulink.Parameter(repmat(0, 16, 16), StorageClass="ExportToFile", HeaderFile="EngPrt_PrtLimMech_Paras.h", DefinitionFile="EngPrt_PrtLimMech_Paras.c", DataType="Torq", Min=-3276.8, Max=3276.7, Unit="Nm")  % Torque limitation correction factor based on atmospheric pressure for engine
EngPrt_trqLimAPSCor_MAPY = Simulink.Parameter([0 20 40 60 80 100 120 140 160 180 200 220 240 280 320 350], StorageClass="ExportToFile", HeaderFile="EngPrt_PrtLimMech_Paras.h", DefinitionFile="EngPrt_PrtLimMech_Paras.c", DataType="Press_kpa", Min=0, Max=500, Unit="kPa")  % EnvP_p
EngPrt_trqLimAPSCor_MAPX = Simulink.Parameter([0 250 500 750 1000 1250 1500 3750 4000 4250 4500 4750 5000 5250 5500 6000], StorageClass="ExportToFile", HeaderFile="EngPrt_PrtLimMech_Paras.h", DefinitionFile="EngPrt_PrtLimMech_Paras.c", DataType="ERPM", Min=0, Max=6000, Unit="rpm")  % Epm_nEng
EngPrt_facTrqLimCor_MAP = Simulink.Parameter(repmat(1, 16, 16), StorageClass="ExportToFile", HeaderFile="EngPrt_PrtLimMech_Paras.h", DefinitionFile="EngPrt_PrtLimMech_Paras.c", DataType="Fac_10", Min=-10, Max=10, Unit="NaN")  % Env pressure and Engine Temperature Correction value for Torque Limitation
EngPrt_facTrqLimCor_MAPY = Simulink.Parameter([0 20 40 60 80 100 110 120 140 160 180 200 220 280 320 350], StorageClass="ExportToFile", HeaderFile="EngPrt_PrtLimMech_Paras.h", DefinitionFile="EngPrt_PrtLimMech_Paras.c", DataType="Press_kpa", Min=0, Max=500, Unit="kPa")  % EnvP_p
EngPrt_facTrqLimCor_MAPX = Simulink.Parameter([-50 -35 -20 -5 0 15 30 45 60 75 90 105 120 130 140 150], StorageClass="ExportToFile", HeaderFile="EngPrt_PrtLimMech_Paras.h", DefinitionFile="EngPrt_PrtLimMech_Paras.c", DataType="Temp_C", Min=-3000, Max=3000, Unit="deg")  % EngPrt_tTrqLim_mp
EngPrt_qLim_CUR = Simulink.Parameter(repmat(50, 1, 25), StorageClass="ExportToFile", HeaderFile="EngPrt_PrtLimMech_Paras.h", DefinitionFile="EngPrt_PrtLimMech_Paras.c", DataType="InjMass", Min=-319, Max=319, Unit="mg/hub")  % Curve for normal engine speed limitation (Injection quantity)
EngPrt_qLim_CURX = Simulink.Parameter([100 345.8333 591.6667 837.5 1083.333 1329.167 1575 1820.833 2066.667 2312.5 2558.333 2804.167 3050 3295.833 3541.667 3787.5 4033.333 4279.167 4525 4770.833 5016.667 5262.5 5508.333 5754.167 6000], StorageClass="ExportToFile", HeaderFile="EngPrt_PrtLimMech_Paras.h", DefinitionFile="EngPrt_PrtLimMech_Paras.c", DataType="ERPM", Min=0, Max=6000, Unit="rpm")  % Epm_nEng
EngPrt_swtTrq_C = Simulink.Parameter(0, StorageClass="ExportToFile", HeaderFile="EngPrt_PrtLimMech_Paras.h", DefinitionFile="EngPrt_PrtLimMech_Paras.c", DataType="State", Min=0, Max=2, Unit="NaN")  % Switch for chosing kind of torque limitation
EngPrt_facEngSPOffset_CUR = Simulink.Parameter([1 0.8888889 0.7777778 0.6666667 0.5555556 0.4444444 0.3333333 0.2222222 0.1111111 0], StorageClass="ExportToFile", HeaderFile="EngPrt_PrtLimMech_Paras.h", DefinitionFile="EngPrt_PrtLimMech_Paras.c", DataType="Fac1", Min=0, Max=1, Unit="NaN")  % Curve for Engsp limation
EngPrt_facEngSPOffset_CURX = Simulink.Parameter([-100 -77.77778 -55.55556 -33.33333 -11.11111 11.11111 33.33333 55.55556 77.77778 100], StorageClass="ExportToFile", HeaderFile="EngPrt_PrtLimMech_Paras.h", DefinitionFile="EngPrt_PrtLimMech_Paras.c", DataType="ERPM", Min=-1000, Max=1000, Unit="rpm")  % EngSp  offset
EngPrt_nEngSplimRmpSlopePos_C = Simulink.Parameter(200, StorageClass="ExportToFile", HeaderFile="EngPrt_PrtLimMech_Paras.h", DefinitionFile="EngPrt_PrtLimMech_Paras.c", DataType="ERPM_s", Min=-12000, Max=12000, Unit="rpm/s")  % slope if the ramp has to be increased
EngPrt_nEngSplimRmpSlopeNeg_C = Simulink.Parameter(200, StorageClass="ExportToFile", HeaderFile="EngPrt_PrtLimMech_Paras.h", DefinitionFile="EngPrt_PrtLimMech_Paras.c", DataType="ERPM_s", Min=-12000, Max=12000, Unit="rpm/s")  % slope if the ramp has to be decreased
EngPrt_nEngSplimOffset_C = Simulink.Parameter(100, StorageClass="ExportToFile", HeaderFile="EngPrt_PrtLimMech_Paras.h", DefinitionFile="EngPrt_PrtLimMech_Paras.c", DataType="ERPM", Min=0, Max=1000, Unit="rpm")  % engine speed  offset