% Simulink data dictionary EngPrt_PrtLimOvht.sldd
% references slprj_cm.sldd
% references sl_ddtypes.sldd
% references sl_const.sldd

EngPrt_trqLimOvhtPrv = Simulink.Signal(StorageClass="ExportToFile", HeaderFile="EngPrt_PrtLimOvht_Signals.h", DefinitionFile="EngPrt_PrtLimOvht_Signals.c", DataType="Torq", Min=-3276.8, Max=3276.7, Unit="Nm", InitialValue="0")  % Torque limitation value for engine protection from overheating
EngPrt_trqOvhtPrvMax_mp = Simulink.Signal(StorageClass="ExportToFile", HeaderFile="EngPrt_PrtLimOvht_Signals.h", DefinitionFile="EngPrt_PrtLimOvht_Signals.c", DataType="Torq", Min=-3276.8, Max=3276.7, Unit="Nm", InitialValue="0")  % Injection mass out of max temperature MAP EngPrt_qOvhtPrvMax_MAP [mg/stroke] mg/hub
EngPrt_trqOvhtPrvHigh_mp = Simulink.Signal(StorageClass="ExportToFile", HeaderFile="EngPrt_PrtLimOvht_Signals.h", DefinitionFile="EngPrt_PrtLimOvht_Signals.c", DataType="Torq", Min=-3276.8, Max=3276.7, Unit="Nm", InitialValue="0")  % Injection mass out of high temperature MAP[mg/stroke] mg/hub
EngPrt_trqOvhtPrvLow_mp = Simulink.Signal(StorageClass="ExportToFile", HeaderFile="EngPrt_PrtLimOvht_Signals.h", DefinitionFile="EngPrt_PrtLimOvht_Signals.c", DataType="Torq", Min=-3276.8, Max=3276.7, Unit="Nm", InitialValue="0")  % Injection mass out of low temperature MAP EngPrt_qOvhtPrvLow_MAP [mg/stroke] mg/hub
EngPrt_facOvhtPrvTrqTemp_mp = Simulink.Signal(StorageClass="ExportToFile", HeaderFile="EngPrt_PrtLimOvht_Signals.h", DefinitionFile="EngPrt_PrtLimOvht_Signals.c", DataType="Fac_10", Min=-16, Max=16, Unit="Nm/deg", InitialValue="0")  % injection mass by per  temperature[-] mg/hub/deg C
EngPrt_trqOvhtPrvStab_mp = Simulink.Signal(StorageClass="ExportToFile", HeaderFile="EngPrt_PrtLimOvht_Signals.h", DefinitionFile="EngPrt_PrtLimOvht_Signals.c", DataType="Torq", Min=-3276.8, Max=3276.7, Unit="Nm", InitialValue="0")  % Maximum allowed injection mass under stabilized conditions[mg/stroke] mg/hub
EngPrt_trqOvhtPrvDynLtd_mp = Simulink.Signal(StorageClass="ExportToFile", HeaderFile="EngPrt_PrtLimOvht_Signals.h", DefinitionFile="EngPrt_PrtLimOvht_Signals.c", DataType="Torq", Min=-3276.8, Max=3276.7, Unit="Nm", InitialValue="0")  % Dynamical allowed injection mass after limitation[mg/stroke] mg/hub
EngPrt_trqOvhtPrvSum_mp = Simulink.Signal(StorageClass="ExportToFile", HeaderFile="EngPrt_PrtLimOvht_Signals.h", DefinitionFile="EngPrt_PrtLimOvht_Signals.c", DataType="Torq", Min=-3276.8, Max=3276.7, Unit="Nm", InitialValue="0")  % Injection mass with dynamic corrections[mg/stroke] mg/hub
EngPrt_trqOvhtPrvTLim_mp = Simulink.Signal(StorageClass="ExportToFile", HeaderFile="EngPrt_PrtLimOvht_Signals.h", DefinitionFile="EngPrt_PrtLimOvht_Signals.c", DataType="Torq", Min=-3276.8, Max=3276.7, Unit="Nm", InitialValue="0")  % Exhaust gas temperature dependent injection mass protection[mg/stroke] mg/hub
EngPrt_tOvhtPrvCalc_mp = Simulink.Signal(StorageClass="ExportToFile", HeaderFile="EngPrt_PrtLimOvht_Signals.h", DefinitionFile="EngPrt_PrtLimOvht_Signals.c", DataType="Temp_C", Min=-50, Max=200, Unit="deg", InitialValue="0")  % Calculated temperature under stable conditions[deg C] deg C
EngPrt_tOvhtPrvIATCor_mp = Simulink.Signal(StorageClass="ExportToFile", HeaderFile="EngPrt_PrtLimOvht_Signals.h", DefinitionFile="EngPrt_PrtLimOvht_Signals.c", DataType="Temp_C", Min=-50, Max=200, Unit="deg", InitialValue="0")  % Temperature correction depending on intake air temperature [deg C] K
EngPrt_tOvhtPrvCor_mp = Simulink.Signal(StorageClass="ExportToFile", HeaderFile="EngPrt_PrtLimOvht_Signals.h", DefinitionFile="EngPrt_PrtLimOvht_Signals.c", DataType="Temp_C", Min=-50, Max=200, Unit="deg", InitialValue="0")  % Corrected temperature under stable conditions[deg C] deg C
EngPrt_tOvhtPrvFlt_mp = Simulink.Signal(StorageClass="ExportToFile", HeaderFile="EngPrt_PrtLimOvht_Signals.h", DefinitionFile="EngPrt_PrtLimOvht_Signals.c", DataType="Temp_C", Min=-50, Max=200, Unit="deg", InitialValue="0")  % Filtered dynamic temperature[deg C]
EngPrt_tOvhtPrvDiff_mp = Simulink.Signal(StorageClass="ExportToFile", HeaderFile="EngPrt_PrtLimOvht_Signals.h", DefinitionFile="EngPrt_PrtLimOvht_Signals.c", DataType="Temp_C", Min=-50, Max=200, Unit="deg", InitialValue="0")  % Difference between allowed (EngPrt_tOvhtPrvAllwMax_C) and filtered (dynamic) temperature(EngPrt_tOvhtPrvFlt_mp) [degC] K
EngPrt_trqOvhtPrvDyn_mp = Simulink.Signal(StorageClass="ExportToFile", HeaderFile="EngPrt_PrtLimOvht_Signals.h", DefinitionFile="EngPrt_PrtLimOvht_Signals.c", DataType="Torq", Min=-3276.8, Max=3276.7, Unit="Nm", InitialValue="0")  % Dynamical allowed injection mass[mg/stroke] mg/hub
EngPrt_tAirDes_mp = Simulink.Signal(StorageClass="ExportToFile", HeaderFile="EngPrt_PrtLimOvht_Signals.h", DefinitionFile="EngPrt_PrtLimOvht_Signals.c", DataType="Temp_C", Min=-50, Max=200, Unit="deg", InitialValue="0")  % Intake air temperature
EngPrt_facOvhtPrvOT_mp = Simulink.Signal(StorageClass="ExportToFile", HeaderFile="EngPrt_PrtLimOvht_Signals.h", DefinitionFile="EngPrt_PrtLimOvht_Signals.c", DataType="Fac_10", Min=-10, Max=10, Unit="NaN", InitialValue="0")  % Oil temperature dependent prevention factor
EngPrt_facOvhtPrvCT_mp = Simulink.Signal(StorageClass="ExportToFile", HeaderFile="EngPrt_PrtLimOvht_Signals.h", DefinitionFile="EngPrt_PrtLimOvht_Signals.c", DataType="Fac_10", Min=-10, Max=10, Unit="NaN", InitialValue="0")  % Coolant temperature dependent prevention factor
EngPrt_facOvhtPrvFT_mp = Simulink.Signal(StorageClass="ExportToFile", HeaderFile="EngPrt_PrtLimOvht_Signals.h", DefinitionFile="EngPrt_PrtLimOvht_Signals.c", DataType="Fac_10", Min=-10, Max=10, Unit="NaN", InitialValue="0")  % Fuel temperature dependent prevention factor
EngPrt_facOvhtPrvIAT_mp = Simulink.Signal(StorageClass="ExportToFile", HeaderFile="EngPrt_PrtLimOvht_Signals.h", DefinitionFile="EngPrt_PrtLimOvht_Signals.c", DataType="Fac_10", Min=-10, Max=10, Unit="NaN", InitialValue="0")  % Intake air temperature dependent prevention factor
EngPrt_facOvhtPrv_mp = Simulink.Signal(StorageClass="ExportToFile", HeaderFile="EngPrt_PrtLimOvht_Signals.h", DefinitionFile="EngPrt_PrtLimOvht_Signals.c", DataType="Fac_10", Min=-10, Max=10, Unit="NaN", InitialValue="0")  % minimum prevention factor calculated from temperature curves
EngPrt_trqOvhtPrvNRng_mp = Simulink.Signal(StorageClass="ExportToFile", HeaderFile="EngPrt_PrtLimOvht_Signals.h", DefinitionFile="EngPrt_PrtLimOvht_Signals.c", DataType="Torq", Min=-3276.8, Max=3276.7, Unit="Nm", InitialValue="0")  % Engine speed dependent injection mass protection
EngPrt_trqOvhtPrvVRng_mp = Simulink.Signal(StorageClass="ExportToFile", HeaderFile="EngPrt_PrtLimOvht_Signals.h", DefinitionFile="EngPrt_PrtLimOvht_Signals.c", DataType="Torq", Min=-3276.8, Max=3276.7, Unit="Nm", InitialValue="0")  % Vehicle speed dependent injection mass protection mghub
EngPrt_trqOvhtPrvMax_MAP = Simulink.Parameter(repmat(300, 16, 16), StorageClass="ExportToFile", HeaderFile="EngPrt_PrtLimOvht_Paras.h", DefinitionFile="EngPrt_PrtLimOvht_Paras.c", DataType="Torq", Min=-3276.8, Max=3276.7, Unit="Nm")  % Injection mass at maximum temperature
EngPrt_trqOvhtPrvMax_MAPX = Simulink.Parameter([800 900 1000 1100 1200 1300 1400 1500 1600 1700 1800 2000 2200 2400 2600 2800], StorageClass="ExportToFile", HeaderFile="EngPrt_PrtLimOvht_Paras.h", DefinitionFile="EngPrt_PrtLimOvht_Paras.c", DataType="ERPM", Min=0, Max=6000, Unit="rpm")  % Epm_nEng
EngPrt_trqOvhtPrvMax_MAPY = Simulink.Parameter([700 800 900 1000 1100 1200 1300 1400 1500 1600 1800 2000 2200 2400 2600 2800], StorageClass="ExportToFile", HeaderFile="EngPrt_PrtLimOvht_Paras.h", DefinitionFile="EngPrt_PrtLimOvht_Paras.c", DataType="Mass_mg", Min=-16384, Max=16383.5, Unit="mg/hub")  % AFS_mAirPerCylFlt
EngPrt_trqOvhtPrvHigh_MAP = Simulink.Parameter(repmat(300, 16, 16), StorageClass="ExportToFile", HeaderFile="EngPrt_PrtLimOvht_Paras.h", DefinitionFile="EngPrt_PrtLimOvht_Paras.c", DataType="Torq", Min=-3276.8, Max=3276.7, Unit="Nm")  % Injection mass at high temperature
EngPrt_trqOvhtPrvHigh_MAPX = Simulink.Parameter([800 900 1000 1100 1200 1300 1400 1500 1600 1700 1800 2000 2200 2400 2600 2800], StorageClass="ExportToFile", HeaderFile="EngPrt_PrtLimOvht_Paras.h", DefinitionFile="EngPrt_PrtLimOvht_Paras.c", DataType="ERPM", Min=0, Max=6000, Unit="rpm")  % Epm_nEng
EngPrt_trqOvhtPrvHigh_MAPY = Simulink.Parameter([700 800 900 1000 1100 1200 1300 1400 1500 1600 1800 2000 2200 2400 2600 2800], StorageClass="ExportToFile", HeaderFile="EngPrt_PrtLimOvht_Paras.h", DefinitionFile="EngPrt_PrtLimOvht_Paras.c", DataType="Mass_mg", Min=-16384, Max=16383.5, Unit="mg/hub")  % AFS_mAirPerCylFlt

EngPrt_trqOvhtPrvLow_MAP = Simulink.Parameter([280 272 264 256 248 240 232 224 216 208 200 184 168 152 131.6 129.6
 300.96 292.72 284.56 276.32 268.16 260 251.76 243.6 235.44 227.2 219.04 202.64 186.24 169.92 144.8 136
 321.92 313.52 305.12 296.72 288.4 280 271.6 263.2 254.88 246.48 238.08 221.36 204.56 187.84 144 144
 342.8 334.24 325.68 317.12 308.56 300 291.44 282.8 274.24 265.68 257.12 240 222.8 205.68 168 160
 363.84 355.04 346.32 337.52 328.72 320 311.2 302.48 293.68 284.96 276.16 258.64 241.12 223.6 188 180
 384.8 375.84 366.88 357.92 348.96 340 331.04 322.08 313.12 304.24 295.28 277.36 259.44 241.52 212.8 208.8
 405.68 396.56 387.44 378.24 369.12 360 350.88 341.68 332.56 323.44 314.24 296 277.68 259.44 228.8 222.8
 426.72 417.36 408 398.72 389.36 380 370.72 361.36 352 342.72 333.36 314.72 296 277.36 244.8 237.2
 447.6 438.08 428.56 419.04 409.52 400 390.48 380.96 371.44 361.92 352.4 333.36 314.24 295.2 260.4 249.6
 468.56 458.88 449.12 439.44 429.76 420 410.32 400.56 390.88 381.12 371.44 352 332.56 313.12 278.8 268.8
 510.48 500.4 490.32 480.24 470.08 460 449.92 439.84 429.76 419.6 409.52 389.36 369.12 348.96 336.8 324
 552.4 541.92 531.44 520.96 510.48 500 489.52 479.04 468.56 458.08 447.6 426.64 405.76 384.8 372 363.6
 594.32 583.44 572.56 561.76 550.88 540 529.12 518.32 507.44 496.56 485.76 464 442.32 420.56 405.2 396
 636.16 624.96 613.68 602.48 591.28 580 568.8 557.52 546.32 535.04 523.84 501.36 478.88 456.4 422 412.4
 678.08 666.48 654.88 643.28 631.6 620 608.4 596.8 585.12 573.52 561.92 538.64 515.44 492.16 459.2 448.8
 720 708 696 684 672 660 648 636 624 612 600 576 552 528 495.2 484.8], StorageClass="ExportToFile", HeaderFile="EngPrt_PrtLimOvht_Paras.h", DefinitionFile="EngPrt_PrtLimOvht_Paras.c", DataType="Torq", Min=-3276.8, Max=3276.7, Unit="Nm")  % Injection mass at low temperature

EngPrt_trqOvhtPrvLow_MAPX = Simulink.Parameter([800 900 1000 1100 1200 1300 1400 1500 1600 1700 1800 2000 2200 2400 2600 2800], StorageClass="ExportToFile", HeaderFile="EngPrt_PrtLimOvht_Paras.h", DefinitionFile="EngPrt_PrtLimOvht_Paras.c", DataType="ERPM", Min=0, Max=6000, Unit="rpm")  % Epm_nEng
EngPrt_trqOvhtPrvLow_MAPY = Simulink.Parameter([700 800 900 1000 1100 1200 1300 1400 1500 1600 1800 2000 2200 2400 2600 2800], StorageClass="ExportToFile", HeaderFile="EngPrt_PrtLimOvht_Paras.h", DefinitionFile="EngPrt_PrtLimOvht_Paras.c", DataType="Mass_mg", Min=-16384, Max=16383.5, Unit="mg/hub")  % AFS_mAirPerCylFlt
EngPrt_tOvhtPrvHighMapRef_C = Simulink.Parameter(700, StorageClass="ExportToFile", HeaderFile="EngPrt_PrtLimOvht_Paras.h", DefinitionFile="EngPrt_PrtLimOvht_Paras.c", DataType="Temp_C", Min=-3000, Max=3000, Unit="deg")  % Reference temperature for high injection mass MAP EngPrt_qOvhtPrvHigh_MAP
EngPrt_tOvhtPrvLowMapRef_C = Simulink.Parameter(600, StorageClass="ExportToFile", HeaderFile="EngPrt_PrtLimOvht_Paras.h", DefinitionFile="EngPrt_PrtLimOvht_Paras.c", DataType="Temp_C", Min=-3000, Max=3000, Unit="deg")  % Reference temperature for low injection mass MAP EngPrt_qOvhtPrvLow_MAP
EngPrt_tOvhtPrvAllwMax_C = Simulink.Parameter(620, StorageClass="ExportToFile", HeaderFile="EngPrt_PrtLimOvht_Paras.h", DefinitionFile="EngPrt_PrtLimOvht_Paras.c", DataType="Temp_C", Min=-3000, Max=3000, Unit="deg")  % maximum allowed temperature
EngPrt_trqOvhtPrvDynLimMin_C = Simulink.Parameter(0, StorageClass="ExportToFile", HeaderFile="EngPrt_PrtLimOvht_Paras.h", DefinitionFile="EngPrt_PrtLimOvht_Paras.c", DataType="Torq", Min=-3276.8, Max=3276.7, Unit="Nm")  % Minimum limitation of dynamic injection mass
EngPrt_trqOvhtPrvDynLimMax_C = Simulink.Parameter(100, StorageClass="ExportToFile", HeaderFile="EngPrt_PrtLimOvht_Paras.h", DefinitionFile="EngPrt_PrtLimOvht_Paras.c", DataType="Torq", Min=-3276.8, Max=3276.7, Unit="Nm")  % Maximum limitation of dynamic injection mass
EngPrt_swtOvhtPrvOn_C = Simulink.Parameter(Switch.OFF, StorageClass="ExportToFile", HeaderFile="EngPrt_PrtLimOvht_Paras.h", DefinitionFile="EngPrt_PrtLimOvht_Paras.c", DataType="Enum: Switch", Unit="NaN")  % Switch to enable overheat temperature prevention (1 = enable )
EngPrt_facOvhtPrvIATCor_C = Simulink.Parameter(1, StorageClass="ExportToFile", HeaderFile="EngPrt_PrtLimOvht_Paras.h", DefinitionFile="EngPrt_PrtLimOvht_Paras.c", DataType="Fac_10", Min=-10, Max=10, Unit="NaN")  % Fac_10 for correction of calculated stabilized temperature
EngPrt_tOvhtPrvMinCalc_C = Simulink.Parameter(200, StorageClass="ExportToFile", HeaderFile="EngPrt_PrtLimOvht_Paras.h", DefinitionFile="EngPrt_PrtLimOvht_Paras.c", DataType="Temp_C", Min=-3000, Max=3000, Unit="deg")  % Lowest calculated temperature after correction
EngPrt_facOvhtPrvDown_C = Simulink.Parameter(50, StorageClass="ExportToFile", HeaderFile="EngPrt_PrtLimOvht_Paras.h", DefinitionFile="EngPrt_PrtLimOvht_Paras.c", DataType="Fac100", Min=0, Max=99.9985, Unit="NaN")  % Time constant for lowpass filter, decreasing temperature
EngPrt_facOvhtPrvUp_C = Simulink.Parameter(50, StorageClass="ExportToFile", HeaderFile="EngPrt_PrtLimOvht_Paras.h", DefinitionFile="EngPrt_PrtLimOvht_Paras.c", DataType="Fac100", Min=0, Max=99.9985, Unit="NaN")  % Time constant for lowpass filter, increasing temperature
EngPrt_tOvhtPrvIATRef_CUR = Simulink.Parameter(repmat(0, 1, 25), StorageClass="ExportToFile", HeaderFile="EngPrt_PrtLimOvht_Paras.h", DefinitionFile="EngPrt_PrtLimOvht_Paras.c", DataType="Temp_C", Min=-3000, Max=3000, Unit="deg")  % Curve for intake air temperature dependent correction of calculated stabilized
EngPrt_tOvhtPrvIATRef_CURX = Simulink.Parameter([600 700 800 900 1000 1100 1200 1300 1400 1500 1600 1700 1800 1900 2000 2100 2200 2300 2400 2500 2600 2700 2800 2900 3000], StorageClass="ExportToFile", HeaderFile="EngPrt_PrtLimOvht_Paras.h", DefinitionFile="EngPrt_PrtLimOvht_Paras.c", DataType="ERPM", Min=0, Max=6000, Unit="rpm")  % Epm_nEng
EngPrt_facOvhtPrvAdd_CUR = Simulink.Parameter(repmat(1, 1, 25), StorageClass="ExportToFile", HeaderFile="EngPrt_PrtLimOvht_Paras.h", DefinitionFile="EngPrt_PrtLimOvht_Paras.c", DataType="Fac_10", Min=-10, Max=10, Unit="NaN")  % Curve for calculated injection mass Fac_10 (facQntTemp statergy)
EngPrt_facOvhtPrvAdd_CURX = Simulink.Parameter([600 700 800 900 1000 1100 1200 1300 1400 1500 1600 1700 1800 1900 2000 2100 2200 2300 2400 2500 2600 2700 2800 2900 3000], StorageClass="ExportToFile", HeaderFile="EngPrt_PrtLimOvht_Paras.h", DefinitionFile="EngPrt_PrtLimOvht_Paras.c", DataType="ERPM", Min=0, Max=6000, Unit="rpm")  % Epm_nEng

EngPrt_trqOvhtPrvAdd_MAP = Simulink.Parameter([0 0 0 0 0 0 0 0 0 0 0 0 0 0 0 0
 3 3 3 3 3 3 3 3 3 3 3 3 3 3 3 3
 9 9 9 9 9 9 9 9 9 9 9 9 9 9 9 9
 18 18 18 18 18 18 18 18 18 18 18 18 18 18 18 18
 36 36 36 36 36 36 36 36 36 36 36 36 36 36 36 36
 42 42 42 42 42 42 42 42 42 42 42 42 42 42 42 42
 45 45 45 45 45 45 45 45 45 45 45 45 45 45 45 45
 49.5 49.5 49.5 49.5 49.5 49.5 49.5 49.5 49.5 49.5 49.5 49.5 49.5 49.5 49.5 49.5
 54 54 54 54 54 54 54 54 54 54 54 54 54 54 54 54
 54 54 54 54 54 54 54 54 54 54 54 54 54 54 54 54
 54 54 54 54 54 54 54 54 54 54 54 54 54 54 54 54
 54 54 54 54 54 54 54 54 54 54 54 54 54 54 54 54
 54 54 54 54 54 54 54 54 54 54 54 54 54 54 54 54
 54 54 54 54 54 54 54 54 54 54 54 54 54 54 54 54
 54 54 54 54 54 54 54 54 54 54 54 54 54 54 54 54
 54 54 54 54 54 54 54 54 54 54 54 54 54 54 54 54], StorageClass="ExportToFile", HeaderFile="EngPrt_PrtLimOvht_Paras.h", DefinitionFile="EngPrt_PrtLimOvht_Paras.c", DataType="Torq", Min=-3276.8, Max=3276.7, Unit="Nm")  % Dynamic calculated injection mass (MAP strategy)

EngPrt_trqOvhtPrvAdd_MAPX = Simulink.Parameter([800 900 1000 1100 1200 1300 1400 1500 1600 1700 1800 2000 2200 2400 2600 2800], StorageClass="ExportToFile", HeaderFile="EngPrt_PrtLimOvht_Paras.h", DefinitionFile="EngPrt_PrtLimOvht_Paras.c", DataType="ERPM", Min=20, Max=10000, Unit="rpm")  % Epm_nEng
EngPrt_trqOvhtPrvAdd_MAPY = Simulink.Parameter([-273.15 -253.15 -223.15 -173.15 -123.15 -73.15 -23.15 26.85 76.85 126.85 176.85 226.85 276.85 326.85 376.85 426.85], StorageClass="ExportToFile", HeaderFile="EngPrt_PrtLimOvht_Paras.h", DefinitionFile="EngPrt_PrtLimOvht_Paras.c", DataType="Temp_C", Min=-3000, Max=3000, Unit="deg")  % EngPrt_tOvhtPrvDiff_mp
EngPrt_swtOvhtPrvDyn_C = Simulink.Parameter(Switch.OFF, StorageClass="ExportToFile", HeaderFile="EngPrt_PrtLimOvht_Paras.h", DefinitionFile="EngPrt_PrtLimOvht_Paras.c", DataType="Enum: Switch", Unit="NaN")  % Switch for choosing the dynamic correction behavour (0 = MAP; 1=facQntTemp)
EngPrt_facOvhtPrvOT_CUR = Simulink.Parameter(repmat(1, 1, 25), StorageClass="ExportToFile", HeaderFile="EngPrt_PrtLimOvht_Paras.h", DefinitionFile="EngPrt_PrtLimOvht_Paras.c", DataType="Fac_10", Min=-10, Max=10, Unit="NaN")  % Curve for oil temperature dependent limitation Fac_10
EngPrt_facOvhtPrvOT_CURX = Simulink.Parameter([-40 -30 -20 -10 0 10 20 30 40 50 60 70 80 90 100 110 120 130 140 150 160 165 170 175 180], StorageClass="ExportToFile", HeaderFile="EngPrt_PrtLimOvht_Paras.h", DefinitionFile="EngPrt_PrtLimOvht_Paras.c", DataType="Temp_C", Min=-3000, Max=3000, Unit="deg")  % Oil_tSwmp
EngPrt_facOvhtPrvCT_CUR = Simulink.Parameter(repmat(1, 1, 25), StorageClass="ExportToFile", HeaderFile="EngPrt_PrtLimOvht_Paras.h", DefinitionFile="EngPrt_PrtLimOvht_Paras.c", DataType="Fac_10", Min=-10, Max=10, Unit="NaN")  % Curve for coolant temperature dependent limitation Fac_10
EngPrt_facOvhtPrvCT_CURX = Simulink.Parameter([-40 -30 -20 -10 0 10 20 30 40 50 60 70 80 90 100 105 110 115 120 125 130 135 140 145 150], StorageClass="ExportToFile", HeaderFile="EngPrt_PrtLimOvht_Paras.h", DefinitionFile="EngPrt_PrtLimOvht_Paras.c", DataType="Temp_C", Min=-3000, Max=3000, Unit="deg")  % CEngDsT_t
EngPrt_facOvhtPrvFT_CUR = Simulink.Parameter(repmat(1, 1, 25), StorageClass="ExportToFile", HeaderFile="EngPrt_PrtLimOvht_Paras.h", DefinitionFile="EngPrt_PrtLimOvht_Paras.c", DataType="Fac_10", Min=-10, Max=10, Unit="NaN")  % Curve for fuel temperature dependent limitation Fac_10
EngPrt_facOvhtPrvFT_CURX = Simulink.Parameter([-40 -30 -20 -10 0 10 20 30 40 50 60 70 80 90 100 105 110 115 120 125 130 135 140 145 150], StorageClass="ExportToFile", HeaderFile="EngPrt_PrtLimOvht_Paras.h", DefinitionFile="EngPrt_PrtLimOvht_Paras.c", DataType="Temp_C", Min=-3000, Max=3000, Unit="deg")  % FuelT_t
EngPrt_facOvhtPrvIAT_CUR = Simulink.Parameter(repmat(1, 1, 25), StorageClass="ExportToFile", HeaderFile="EngPrt_PrtLimOvht_Paras.h", DefinitionFile="EngPrt_PrtLimOvht_Paras.c", DataType="Fac_10", Min=-10, Max=10, Unit="NaN")  % Overheat protection curve intake air temperature in Fac_10
EngPrt_facOvhtPrvIAT_CURX = Simulink.Parameter([-40 -30 -20 -10 0 10 20 30 40 50 60 70 80 90 100 105 110 115 120 125 130 135 140 145 150], StorageClass="ExportToFile", HeaderFile="EngPrt_PrtLimOvht_Paras.h", DefinitionFile="EngPrt_PrtLimOvht_Paras.c", DataType="Temp_C", Min=-3000, Max=3000, Unit="deg")  % AirSys_tFld

EngPrt_trqOvhtPrvNRng_MAP = Simulink.Parameter([70 70 70 70 70 70 70 70 70 70 70 70 70 70 70 70
 70 70 70 70 70 70 70 70 70 70 70 70 70 70 70 70
 110 110 110 110 110 70 70 70 70 70 70 70 70 70 70 70
 166 166 154 142 142 110 110 70 70 70 70 70 70 70 70 70
 182 182 162 150 150 138 138 138 130 110 110 110 110 110 95 85
 182 182 182 182 178 170 170 170 170 150 150 130 130 110 110 95
 194 194 194 194 190 190 190 194 202 218 210 222 210 110 110 100
 194 194 194 206 214 222 222 214 222 226 218 222 210 190 182 110
 214 206 214 219.2 222 234.4 235.2 232 232.4 227.2 226.4 231.2 235.2 190 182 116
 230 230 230 230 234.4 234.4 235.2 232 232.4 235.2 234.4 239.2 238 234 182 116
 250 230 230 235.6 236 237.2 239.2 239.6 244 242 264.4 261.2 257.2 253.2 188.4 120
 260 250 240 240 236.4 236.4 237.2 238 238.4 237.2 232.4 225.2 225.2 219.2 212 204.8
 280 280 280 280 288 288 288 304 296 268 268 268 268 268 280 280
 280 280 280 280 280 280 280 280 280 280 280 280 280 280 280 280
 280 280 280 280 280 280 280 280 280 280 280 280 280 280 280 280
 280 280 280 280 280 280 280 280 280 280 280 280 280 280 280 280], StorageClass="ExportToFile", HeaderFile="EngPrt_PrtLimOvht_Paras.h", DefinitionFile="EngPrt_PrtLimOvht_Paras.c", DataType="Torq", Min=-3276.8, Max=3276.7, Unit="Nm")  % Map for Engine protection

EngPrt_trqOvhtPrvNRng_MAPX = Simulink.Parameter([800 1000 1200 1400 1600 1800 2000 2200 2400 2600 2800 3000 3100 3200 3400 3520], StorageClass="ExportToFile", HeaderFile="EngPrt_PrtLimOvht_Paras.h", DefinitionFile="EngPrt_PrtLimOvht_Paras.c", DataType="ERPM", Min=0, Max=6000, Unit="rpm")  % Epm_nEng
EngPrt_trqOvhtPrvNRng_MAPY = Simulink.Parameter([0 0.1 0.2 0.3 0.4 0.5 0.6 0.7 0.8 0.9 1 1.1 1.2 1.3 1.4 1.5], StorageClass="ExportToFile", HeaderFile="EngPrt_PrtLimOvht_Paras.h", DefinitionFile="EngPrt_PrtLimOvht_Paras.c", DataType="Fac_10", Min=-10, Max=10, Unit="NaN")  % EngPrt_facOvhtPrv_mp
EngPrt_trqOvhtPrvVRng_MAP = Simulink.Parameter(repmat(300, 16, 16), StorageClass="ExportToFile", HeaderFile="EngPrt_PrtLimOvht_Paras.h", DefinitionFile="EngPrt_PrtLimOvht_Paras.c", DataType="Torq", Min=-3276.8, Max=3276.7, Unit="Nm")  % Map for Engine protection
EngPrt_trqOvhtPrvVRng_MAPX = Simulink.Parameter([0 0.06 0.12 0.18 0.24 0.28 0.32 0.36 0.4 0.45 0.5 0.6 0.7 0.8 0.9 1], StorageClass="ExportToFile", HeaderFile="EngPrt_PrtLimOvht_Paras.h", DefinitionFile="EngPrt_PrtLimOvht_Paras.c", DataType="Fac_10", Min=-10, Max=10, Unit="NaN")  % EngPrt_facOvhtPrv_mp
EngPrt_trqOvhtPrvVRng_MAPY = Simulink.Parameter([0 10 20 30 40 50 60 70 80 90 100 110 120 130 140 150], StorageClass="ExportToFile", HeaderFile="EngPrt_PrtLimOvht_Paras.h", DefinitionFile="EngPrt_PrtLimOvht_Paras.c", DataType="V_kmph", Min=0, Max=255, Unit="km/h")  % VehV_v