% Simulink data dictionary EngPrt_TrqLimCalc.sldd
% references slprj_cm.sldd
% references sl_ddtypes.sldd

EngPrt_trqLim = Simulink.Signal(StorageClass="ExportToFile", HeaderFile="EngPrt_TrqLimCalc_Signals.h", DefinitionFile="EngPrt_TrqLimCalc_Signals.c", DataType="Torq", Min=-3276.8, Max=3276.7, Unit="Nm", InitialValue="0")  % Limitation torque for engine mechanic protection by torque limitation (as inner engine torque)