% Simulink data dictionary EngPrt_TrqLimPTO.sldd
% references slprj_cm.sldd
% references sl_ddtypes.sldd

EngPrt_trqLimPTO = Simulink.Signal(StorageClass="ExportToFile", HeaderFile="EngPrt_TrqLimPTO_Signals.h", DefinitionFile="EngPrt_TrqLimPTO_Signals.c", DataType="Torq", Min=-3276.8, Max=3276.7, Unit="Nm", InitialValue="0")  % Torque limitation value from PTO state
EngPrt_facPTOLim_mp = Simulink.Signal(StorageClass="ExportToFile", HeaderFile="EngPrt_TrqLimPTO_Signals.h", DefinitionFile="EngPrt_TrqLimPTO_Signals.c", DataType="Fac_10", Min=-10, Max=10, Unit="NaN", InitialValue="0")  % limitation factor calculate from PTO switch
EngPrt_facPTOLim0_CUR = Simulink.Parameter(repmat(1, 1, 25), StorageClass="ExportToFile", HeaderFile="EngPrt_TrqLimPTO_Paras.h", DefinitionFile="EngPrt_TrqLimPTO_Paras.c", DataType="Fac_10", Min=-10, Max=10, Unit="NaN")  % Curve for PTO switch 0 limitation Fac_10
EngPrt_facPTOLim0_CURX = Simulink.Parameter([600 700 800 900 1000 1100 1200 1300 1400 1500 1600 1700 1800 1900 2000 2100 2200 2300 2400 2500 2600 2700 2800 2900 3000], StorageClass="ExportToFile", HeaderFile="EngPrt_TrqLimPTO_Paras.h", DefinitionFile="EngPrt_TrqLimPTO_Paras.c", DataType="ERPM", Min=0, Max=6000, Unit="rpm")  % Engine speed
EngPrt_facPTOLim1_CUR = Simulink.Parameter(repmat(0.9, 1, 25), StorageClass="ExportToFile", HeaderFile="EngPrt_TrqLimPTO_Paras.h", DefinitionFile="EngPrt_TrqLimPTO_Paras.c", DataType="Fac_10", Min=-10, Max=10, Unit="NaN")  % Curve for PTO switch 1 limitation Fac_10
EngPrt_facPTOLim1_CURX = Simulink.Parameter([600 700 800 900 1000 1100 1200 1300 1400 1500 1600 1700 1800 1900 2000 2100 2200 2300 2400 2500 2600 2700 2800 2900 3000], StorageClass="ExportToFile", HeaderFile="EngPrt_TrqLimPTO_Paras.h", DefinitionFile="EngPrt_TrqLimPTO_Paras.c", DataType="ERPM", Min=0, Max=6000, Unit="rpm")  % Engine speed
EngPrt_facPTOLim2_CUR = Simulink.Parameter(repmat(0.75, 1, 25), StorageClass="ExportToFile", HeaderFile="EngPrt_TrqLimPTO_Paras.h", DefinitionFile="EngPrt_TrqLimPTO_Paras.c", DataType="Fac_10", Min=-10, Max=10, Unit="NaN")  % Curve for PTO switch 2 limitation Fac_10
EngPrt_facPTOLim2_CURX = Simulink.Parameter([600 700 800 900 1000 1100 1200 1300 1400 1500 1600 1700 1800 1900 2000 2100 2200 2300 2400 2500 2600 2700 2800 2900 3000], StorageClass="ExportToFile", HeaderFile="EngPrt_TrqLimPTO_Paras.h", DefinitionFile="EngPrt_TrqLimPTO_Paras.c", DataType="ERPM", Min=0, Max=6000, Unit="rpm")  % Engine speed
EngPrt_facPTOLim3_CUR = Simulink.Parameter(repmat(0.5, 1, 25), StorageClass="ExportToFile", HeaderFile="EngPrt_TrqLimPTO_Paras.h", DefinitionFile="EngPrt_TrqLimPTO_Paras.c", DataType="Fac_10", Min=-10, Max=10, Unit="NaN")  % Curve for PTO switch 3 limitation Fac_10
EngPrt_facPTOLim3_CURX = Simulink.Parameter([600 700 800 900 1000 1100 1200 1300 1400 1500 1600 1700 1800 1900 2000 2100 2200 2300 2400 2500 2600 2700 2800 2900 3000], StorageClass="ExportToFile", HeaderFile="EngPrt_TrqLimPTO_Paras.h", DefinitionFile="EngPrt_TrqLimPTO_Paras.c", DataType="ERPM", Min=0, Max=6000, Unit="rpm")  % Engine speed
EngPrt_facPTOLim4_CUR = Simulink.Parameter(repmat(0.25, 1, 25), StorageClass="ExportToFile", HeaderFile="EngPrt_TrqLimPTO_Paras.h", DefinitionFile="EngPrt_TrqLimPTO_Paras.c", DataType="Fac_10", Min=-10, Max=10, Unit="NaN")  % Curve for PTO switch 4 limitation Fac_10
EngPrt_facPTOLim4_CURX = Simulink.Parameter([600 700 800 900 1000 1100 1200 1300 1400 1500 1600 1700 1800 1900 2000 2100 2200 2300 2400 2500 2600 2700 2800 2900 3000], StorageClass="ExportToFile", HeaderFile="EngPrt_TrqLimPTO_Paras.h", DefinitionFile="EngPrt_TrqLimPTO_Paras.c", DataType="ERPM", Min=0, Max=6000, Unit="rpm")  % Engine speed