% Simulink data dictionary EngReq_SmkLimCalc.sldd
% references slprj_cm.sldd
% references sl_ddtypes.sldd

EngReq_trqInrLimSmkPrs = Simulink.Signal(StorageClass="ExportToFile", HeaderFile="EngReq_SmkLimCalc_Signals.h", DefinitionFile="EngReq_SmkLimCalc_Signals.c", DataType="Torq", Min=-3276.8, Max=3276.7, Unit="Nm", InitialValue="0")  % Resulting limiting torque smoke limit current operation mode
EngReq_trqInrLimSmk = Simulink.Signal(StorageClass="ExportToFile", HeaderFile="EngReq_SmkLimCalc_Signals.h", DefinitionFile="EngReq_SmkLimCalc_Signals.c", DataType="Torq", Min=-3276.8, Max=3276.7, Unit="Nm", InitialValue="0")  % Limiting torque smoke limit
EngReq_trqInrLimSmkSlow = Simulink.Signal(StorageClass="ExportToFile", HeaderFile="EngReq_SmkLimCalc_Signals.h", DefinitionFile="EngReq_SmkLimCalc_Signals.c", DataType="Torq", Min=-3276.8, Max=3276.7, Unit="Nm", InitialValue="0")  % Limiting torque smoke limit of slow path
AFS_mAirPerCylFlt = Simulink.Signal(StorageClass="ExportToFile", HeaderFile="EngReq_SmkLimCalc_Signals.h", DefinitionFile="EngReq_SmkLimCalc_Signals.c", DataType="Mass_mg", Min=0, Max=16383, Unit="mg/hub", InitialValue="0")  % filtered Air mass per cylinder
SmkLim_facSmkATSCor_mp = Simulink.Signal(StorageClass="ExportToFile", HeaderFile="EngReq_SmkLimCalc_Signals.h", DefinitionFile="EngReq_SmkLimCalc_Signals.c", DataType="Fac_10", Min=-10, Max=10, Unit="NaN", InitialValue="0")  % air Temperature Correction Fac_10 for smoke Limitation
SmkLim_trqLimSmkBase_mp = Simulink.Signal(StorageClass="ExportToFile", HeaderFile="EngReq_SmkLimCalc_Signals.h", DefinitionFile="EngReq_SmkLimCalc_Signals.c", DataType="Torq", Min=-3276.8, Max=3276.7, Unit="Nm", InitialValue="1000")  % Smoke Limitation torque
SmkLim_trqLimSmkAFSBase_mp = Simulink.Signal(StorageClass="ExportToFile", HeaderFile="EngReq_SmkLimCalc_Signals.h", DefinitionFile="EngReq_SmkLimCalc_Signals.c", DataType="Torq", Min=-3276.8, Max=3276.7, Unit="Nm", InitialValue="1000")  % Smoke Limitation torque when using AFS
SmkLim_trqLimSmkAFSEnvPCor_mp = Simulink.Signal(StorageClass="ExportToFile", HeaderFile="EngReq_SmkLimCalc_Signals.h", DefinitionFile="EngReq_SmkLimCalc_Signals.c", DataType="Torq", Min=-3276.8, Max=3276.7, Unit="Nm", InitialValue="0")  % Smoke Limitation torque correction for EnvP
SmkLim_facSmkEnvPCor_mp = Simulink.Signal(StorageClass="ExportToFile", HeaderFile="EngReq_SmkLimCalc_Signals.h", DefinitionFile="EngReq_SmkLimCalc_Signals.c", DataType="Fac_10", Min=-30, Max=30, Unit="NaN", InitialValue="1")  % Smoke limitation correction Fac_10 of EnvP
SmkLim_facSmkATSCor_CUR = Simulink.Parameter(repmat(1, 1, 8), StorageClass="ExportToFile", HeaderFile="EngReq_SmkLimCalc_Paras.h", DefinitionFile="EngReq_SmkLimCalc_Paras.c", DataType="Fac_10", Min=-10, Max=10, Unit="NaN")  % Intake air Temperature Correction Fac_10 for smoke Limitation
SmkLim_facSmkATSCor_CURX = Simulink.Parameter([-30 -20 -10 0 10 50 80 110], StorageClass="ExportToFile", HeaderFile="EngReq_SmkLimCalc_Paras.h", DefinitionFile="EngReq_SmkLimCalc_Paras.c", DataType="Temp_C", Min=-3000, Max=3000, Unit="deg")  % Air_tIntkVUs

SmkLim_trqLimSmk_MAP = Simulink.Parameter([260 260 258.0078125 228.0078125 195.7421875 191.3671875 191.953125 191.1328125 151.6796875 146.1328125 146.1328125 146.1328125 146.1328125 146.1328125 152.3046875 156.5234375 152.96875 153.75 152.9296875 152.34375 149.1796875 148.5546875 145.859375 143.046875 143.046875
 260 260 258.0078125 256.6015625 194.296875 197.4609375 195.46875 194.609375 191.09375 193.4765625 195.6640625 187.5 189.1796875 189.1796875 195.9375 197.9296875 194.4140625 191.015625 192.34375 187.34375 180.703125 180.1171875 176.9140625 176.9140625 176.9140625
 260 260 258.0078125 264.609375 227.1484375 228.7890625 225.546875 227.734375 224.453125 228.4765625 231.5625 228.125 231.6015625 230 234.8046875 241.1328125 233.9453125 228.5546875 225.2734375 217.578125 210.8984375 208.3984375 207.1484375 207.1484375 207.1484375
 260 260 258.0078125 276.015625 249.296875 250.8984375 245.234375 247.5390625 250.078125 252.5 248.7109375 249.1015625 250.6640625 257.0703125 260.7421875 266.796875 259.6875 258.0859375 250.6640625 246.6796875 239.921875 232.65625 229.4921875 229.4921875 229.4921875
 260 260 258.0078125 286.015625 252.5 250.8984375 247.2265625 249.453125 252.03125 254.375 253.984375 255.9765625 255.9765625 260 268.0078125 269.765625 264.1796875 260.2734375 258.4375 254.921875 248.3203125 242.890625 242.890625 242.890625 242.890625
 260 260 260 295.9765625 271.7578125 270.1171875 265.9375 268.2421875 264.6484375 267.03125 266.09375 264.0234375 269.609375 276.796875 281.5234375 285.7421875 281.5234375 278.5546875 275.859375 273.5546875 268.515625 266.015625 262.7734375 261.2109375 261.2109375
 260 260 260 299.9609375 286.875 286.875 281.71875 284.140625 277.96875 279.4140625 281.9140625 286.6796875 292.5 295.1171875 299.5703125 293.984375 295.1953125 294.8046875 293.984375 292.734375 288.5546875 283.4375 280 276.71875 276.71875
 260 260 260 299.9609375 298.59375 298.59375 300.859375 306.0546875 297.5 295.234375 300.234375 300.9765625 303.4375 307.7734375 309.6875 317.6953125 316.71875 312.421875 311.2109375 307.2265625 302.2265625 298.984375 297.96875 296.171875 296.171875
 260 260 260 299.9609375 310.9375 310.9375 321.5234375 323.125 314.140625 311.484375 311.484375 317.5390625 321.1328125 321.640625 327.890625 333.75 330.9375 329.4921875 323.0859375 318.5546875 312.2265625 311.4453125 307.7734375 307.7734375 307.7734375], StorageClass="ExportToFile", HeaderFile="EngReq_SmkLimCalc_Paras.h", DefinitionFile="EngReq_SmkLimCalc_Paras.c", DataType="Torq", Min=-3276.8, Max=3276.7, Unit="Nm")  % base torque for smoke limitation

SmkLim_trqLimSmk_MAPX = Simulink.Parameter([0 300 500 600 800 1000 1200 1400 1600 1800 2000 2200 2400 2600 2800 3000 3200 3400 3600 3800 4000 4200 4400 4600 4800], StorageClass="ExportToFile", HeaderFile="EngReq_SmkLimCalc_Paras.h", DefinitionFile="EngReq_SmkLimCalc_Paras.c", DataType="ERPM", Min=0, Max=6000, Unit="rpm")  % Epm_nEng
SmkLim_trqLimSmk_MAPY = Simulink.Parameter([0 10 20 40 60 80 100 120 140], StorageClass="ExportToFile", HeaderFile="EngReq_SmkLimCalc_Paras.h", DefinitionFile="EngReq_SmkLimCalc_Paras.c", DataType="Press_kpa", Min=0, Max=500, Unit="kPa")  % Air_pIntkVUs
EngReq_SlpLimPos_C = Simulink.Parameter(50, StorageClass="ExportToFile", HeaderFile="EngReq_SmkLimCalc_Paras.h", DefinitionFile="EngReq_SmkLimCalc_Paras.c", DataType="Torq_s", Min=-1000, Max=1000, Unit="Nm/s")  % Increase limitation ramp / Slope if the ramp has to be increased
EngReq_SlpLimNeg_C = Simulink.Parameter(50, StorageClass="ExportToFile", HeaderFile="EngReq_SmkLimCalc_Paras.h", DefinitionFile="EngReq_SmkLimCalc_Paras.c", DataType="Torq_s", Min=-1000, Max=1000, Unit="Nm/s")  % Increase limitation ramp / negative ramp slope
EngReq_nSlpLimMin_C = Simulink.Parameter(6000, StorageClass="ExportToFile", HeaderFile="EngReq_SmkLimCalc_Paras.h", DefinitionFile="EngReq_SmkLimCalc_Paras.c", DataType="ERPM", Min=0, Max=6000, Unit="rpm")  % Engine speed threshold for activating smoke limitation rise limiting
EngReq_bSmkLimIntkP_C = Simulink.Parameter(0, StorageClass="ExportToFile", HeaderFile="EngReq_SmkLimCalc_Paras.h", DefinitionFile="EngReq_SmkLimCalc_Paras.c", DataType="boolean", Min=0, Max=1, Unit="NaN")  % boolean flag for BPS or AFS work for smoke limit
EngReq_facAFSFlt_C = Simulink.Parameter(50, StorageClass="ExportToFile", HeaderFile="EngReq_SmkLimCalc_Paras.h", DefinitionFile="EngReq_SmkLimCalc_Paras.c", DataType="Fac100", Min=0, Max=99.9, Unit="NaN")  % filter for AFS signal used to smoke limit
SmkLim_trqLimSmkAFS_MAP = Simulink.Parameter(repmat(1000, 25, 25), StorageClass="ExportToFile", HeaderFile="EngReq_SmkLimCalc_Paras.h", DefinitionFile="EngReq_SmkLimCalc_Paras.c", DataType="Torq", Min=-3276.8, Max=3276.7, Unit="Nm")  % base torque for smoke limitation when use AFS
SmkLim_trqLimSmkAFS_MAPX = Simulink.Parameter([400 550 700 850 1000 1150 1300 1450 1600 1750 1900 2050 2200 2350 2500 2650 2800 2950 3100 3250 3400 3550 3700 3850 4000], StorageClass="ExportToFile", HeaderFile="EngReq_SmkLimCalc_Paras.h", DefinitionFile="EngReq_SmkLimCalc_Paras.c", DataType="ERPM", Min=0, Max=6000, Unit="rpm")  % Epm_nEng
SmkLim_trqLimSmkAFS_MAPY = Simulink.Parameter([400 800 1200 1600 2000 2400 2800 3200 3600 4000 4400 4800 5200 5600 6000 6400 6800 7200 7600 8000 8400 8800 9200 9600 10000], StorageClass="ExportToFile", HeaderFile="EngReq_SmkLimCalc_Paras.h", DefinitionFile="EngReq_SmkLimCalc_Paras.c", DataType="Mass_mg", Min=0, Max=16383, Unit="mg/hub")  % Yaxis point, AFS_mAirPerCylFlt
SmkLim_trqLimSmkAFSEnvPCor_MAP = Simulink.Parameter(repmat(0, 25, 25), StorageClass="ExportToFile", HeaderFile="EngReq_SmkLimCalc_Paras.h", DefinitionFile="EngReq_SmkLimCalc_Paras.c", DataType="Torq", Min=-3276.8, Max=3276.7, Unit="Nm")  % correction torque for smoke limitation when use AFS
SmkLim_trqLimSmkAFSEnvPCor_MAPX = Simulink.Parameter([400 550 700 850 1000 1150 1300 1450 1600 1750 1900 2050 2200 2350 2500 2650 2800 2950 3100 3250 3400 3550 3700 3850 4000], StorageClass="ExportToFile", HeaderFile="EngReq_SmkLimCalc_Paras.h", DefinitionFile="EngReq_SmkLimCalc_Paras.c", DataType="ERPM", Min=0, Max=6000, Unit="rpm")  % Epm_nEng
SmkLim_trqLimSmkAFSEnvPCor_MAPY = Simulink.Parameter([400 800 1200 1600 2000 2400 2800 3200 3600 4000 4400 4800 5200 5600 6000 6400 6800 7200 7600 8000 8400 8800 9200 9600 10000], StorageClass="ExportToFile", HeaderFile="EngReq_SmkLimCalc_Paras.h", DefinitionFile="EngReq_SmkLimCalc_Paras.c", DataType="Mass_mg", Min=0, Max=16383, Unit="mg/hub")  % Yaxis point, AFS_mAirPerCylFlt
SmkLim_facSmkEnvPCor_CUR = Simulink.Parameter(repmat(1, 1, 16), StorageClass="ExportToFile", HeaderFile="EngReq_SmkLimCalc_Paras.h", DefinitionFile="EngReq_SmkLimCalc_Paras.c", DataType="Fac_10", Min=-30, Max=30, Unit="NaN")  % Smoke limitation correction curve of EnvP
SmkLim_facSmkEnvPCor_CURX = Simulink.Parameter([50 54 58 62 66 70 74 78 82 86 90 94 98 102 106 110], StorageClass="ExportToFile", HeaderFile="EngReq_SmkLimCalc_Paras.h", DefinitionFile="EngReq_SmkLimCalc_Paras.c", DataType="Press_kpa", Min=0, Max=3276, Unit="kPa")  % Axis points of curve, EnvP_p
EngReq_bSmkLimCnv_C = Simulink.Parameter(0, StorageClass="ExportToFile", HeaderFile="EngReq_SmkLimCalc_Paras.h", DefinitionFile="EngReq_SmkLimCalc_Paras.c", DataType="boolean", Min=0, Max=1, Unit="NaN")  % boolean flag for smoke limit trq sources select based on fuel quantity to torque or (BPS/AFS)work