% Simulink data dictionary EngReq_TrqLimCalc.sldd
% references slprj_cm.sldd
% references sl_ddtypes.sldd

EngReq_trqLim = Simulink.Signal(StorageClass="ExportToFile", HeaderFile="EngReq_TrqLimCalc_Signals.h", DefinitionFile="EngReq_TrqLimCalc_Signals.c", DataType="Torq", Min=-3276.8, Max=3276.7, Unit="Nm", InitialValue="0")  % Resulting limiting torque from engine specifications