% Simulink data dictionary InjCrv_MI1.sldd
% references slprj_cm.sldd
% references sl_ddtypes.sldd

InjCrv_qMI1Des = Simulink.Signal(StorageClass="ExportToFile", HeaderFile="InjCrv_MI1_Signals.h", DefinitionFile="InjCrv_MI1_Signals.c", DataType="InjMass", Min=-319, Max=319, Unit="mg/hub", InitialValue="0")  % desired MI1 injection quantity
InjCrv_phiMI1Des = Simulink.Signal(StorageClass="ExportToFile", HeaderFile="InjCrv_MI1_Signals.h", DefinitionFile="InjCrv_MI1_Signals.c", DataType="Angle_CA", Min=-40, Max=40, Unit="CA", InitialValue="0")  % Desired reference angle for the start of MI1
InjCrv_stShutOffPiIPoI = Simulink.Signal(StorageClass="ExportToFile", HeaderFile="InjCrv_MI1_Signals.h", DefinitionFile="InjCrv_MI1_Signals.c", DataType="boolean", Min=0, Max=1, Unit="NaN", InitialValue="0")  % State of MI1 fuelMass too small
InjCrv_stShutOffPoI = Simulink.Signal(StorageClass="ExportToFile", HeaderFile="InjCrv_MI1_Signals.h", DefinitionFile="InjCrv_MI1_Signals.c", DataType="boolean", Min=0, Max=1, Unit="NaN", InitialValue="0")  % State of MI1 fuelMass too small
InjCrv_qMI1Bas_mp = Simulink.Signal(StorageClass="ExportToFile", HeaderFile="InjCrv_MI1_Signals.h", DefinitionFile="InjCrv_MI1_Signals.c", DataType="InjMass", Min=-319, Max=319, Unit="mg/hub", InitialValue="0")  % injection quantities for MI1
InjCrv_qMI1Set_mp = Simulink.Signal(StorageClass="ExportToFile", HeaderFile="InjCrv_MI1_Signals.h", DefinitionFile="InjCrv_MI1_Signals.c", DataType="InjMass", Min=-319, Max=319, Unit="mg/hub", InitialValue="0")  % injection quantities for MI1 affer correcion
InjCrv_phiMI1MaxEOM0_mp = Simulink.Signal(StorageClass="ExportToFile", HeaderFile="InjCrv_MI1_Signals.h", DefinitionFile="InjCrv_MI1_Signals.c", DataType="Angle_CA", Min=-40, Max=40, Unit="CA", InitialValue="0")  % max start of energizing for MI1
InjCrv_phiMI1Bas_mp = Simulink.Signal(StorageClass="ExportToFile", HeaderFile="InjCrv_MI1_Signals.h", DefinitionFile="InjCrv_MI1_Signals.c", DataType="Angle_CA", Min=-40, Max=40, Unit="CA", InitialValue="0")  % Start of energizing for MI1
InjCrv_phiMI1StrtBase_mp = Simulink.Signal(StorageClass="ExportToFile", HeaderFile="InjCrv_MI1_Signals.h", DefinitionFile="InjCrv_MI1_Signals.c", DataType="Angle_CA", Min=-40, Max=40, Unit="CA", InitialValue="0")  % Start of energizing for MI1 when engine start
InjCrv_phiMI1Strt_mp = Simulink.Signal(StorageClass="ExportToFile", HeaderFile="InjCrv_MI1_Signals.h", DefinitionFile="InjCrv_MI1_Signals.c", DataType="Angle_CA", Min=-40, Max=40, Unit="CA", InitialValue="0")  % Start of energizing for MI1 when engine start
InjCrv_phiMI1CorOut_mp = Simulink.Signal(StorageClass="ExportToFile", HeaderFile="InjCrv_MI1_Signals.h", DefinitionFile="InjCrv_MI1_Signals.c", DataType="Angle_CA", Min=-40, Max=40, Unit="CA", InitialValue="0")  % Start of energizing for MI1 before saturation
InjCrv_phiMI1Max2EOM0_mp = Simulink.Signal(StorageClass="ExportToFile", HeaderFile="InjCrv_MI1_Signals.h", DefinitionFile="InjCrv_MI1_Signals.c", DataType="Angle_CA", Min=-40, Max=40, Unit="CA", InitialValue="0")  % max start of energizing for MI1
InjCrv_phiMI1Max1EOM0_mp = Simulink.Signal(StorageClass="ExportToFile", HeaderFile="InjCrv_MI1_Signals.h", DefinitionFile="InjCrv_MI1_Signals.c", DataType="Angle_CA", Min=-40, Max=40, Unit="CA", InitialValue="0")  % max start of energizing for MI1
InjCrv_phiMI1Lim_mp = Simulink.Signal(StorageClass="ExportToFile", HeaderFile="InjCrv_MI1_Signals.h", DefinitionFile="InjCrv_MI1_Signals.c", DataType="Angle_CA", Min=-40, Max=40, Unit="CA", InitialValue="0")  % Start of energizing for MI1 before saturation
InjCrv_phiMI1CorIn_mp = Simulink.Signal(StorageClass="ExportToFile", HeaderFile="InjCrv_MI1_Signals.h", DefinitionFile="InjCrv_MI1_Signals.c", DataType="Angle_CA", Min=-40, Max=40, Unit="CA", InitialValue="0")  % Start of energizing for MI1 after environment correction and intake air correction
InjCrv_phiMI1Bas1EOM0_mp = Simulink.Signal(StorageClass="ExportToFile", HeaderFile="InjCrv_MI1_Signals.h", DefinitionFile="InjCrv_MI1_Signals.c", DataType="Angle_CA", Min=-40, Max=40, Unit="CA", InitialValue="0")  % Start of energizing for MI1
InjCrv_phiMI1Bas2EOM0_mp = Simulink.Signal(StorageClass="ExportToFile", HeaderFile="InjCrv_MI1_Signals.h", DefinitionFile="InjCrv_MI1_Signals.c", DataType="Angle_CA", Min=-40, Max=40, Unit="CA", InitialValue="0")  % Start of energizing for MI1
SigTst_qMI1_C = Simulink.Parameter(0, StorageClass="ExportToFile", HeaderFile="InjCrv_MI1_Paras.h", DefinitionFile="InjCrv_MI1_Paras.c", DataType="InjMass", Min=-300, Max=319, Unit="mg/hub")  % signal test Replacement value
SigTst_swtMI1Q_C = Simulink.Parameter(Switch.OFF, StorageClass="ExportToFile", HeaderFile="InjCrv_MI1_Paras.h", DefinitionFile="InjCrv_MI1_Paras.c", DataType="Enum: Switch", Unit="NaN")  % signal test switch
InjCrv_phiMI1Max2EOM0_MAPX = Simulink.Parameter([0 200 400 600 800 1000 1200 1400 1600 1800 2000 2200 2400 2800 3200 3600 4000 4400 4800 5200], StorageClass="ExportToFile", HeaderFile="InjCrv_MI1_Paras.h", DefinitionFile="InjCrv_MI1_Paras.c", DataType="ERPM", Min=0, Max=6000, Unit="rpm")  % Base value for MI1 start of energizing with PiI1 X axis
InjCrv_phiMI1Max2EOM0_MAPY = Simulink.Parameter([0 1 2 3 4 5 6 7 8 9 10 11 12 13 14 15 16 17 18 19], StorageClass="ExportToFile", HeaderFile="InjCrv_MI1_Paras.h", DefinitionFile="InjCrv_MI1_Paras.c", DataType="InjMass", Min=-300, Max=319, Unit="mg/hub")  % Base value for MI1 start of energizing with PiI1 Y axis

InjCrv_phiMI1Max2EOM0_MAP = Simulink.Parameter([2 4 6 8 10 12 14 16 18 20 22 24 26 28 30 32 34 36 38 40
 2 4 6 8 10 12 14 16 18 20 22 24 26 28 30 32 34 36 38 40
 2 4 6 8 10 12 14 16 18 20 22 24 26 28 30 32 34 36 38 40
 2 4 6 8 10 12 14 16 18 20 22 24 26 28 30 32 34 36 38 40
 2 4 6 8 10 12 14 16 18 20 22 24 26 28 30 32 34 36 38 40
 2 4 6 8 10 12 14 16 18 20 22 24 26 28 30 32 34 36 38 40
 2 4 6 8 10 12 14 16 18 20 22 24 26 28 30 32 34 36 38 40
 2 4 6 8 10 12 14 16 18 20 22 24 26 28 30 32 34 36 38 40
 2 4 6 8 10 12 14 16 18 20 22 24 26 28 30 32 34 36 38 40
 2 4 6 8 10 12 14 16 18 20 22 24 26 28 30 32 34 36 38 40
 2 4 6 8 10 12 14 16 18 20 22 24 26 28 30 32 34 36 38 40
 2 4 6 8 10 12 14 16 18 20 22 24 26 28 30 32 34 36 38 40
 2 4 6 8 10 12 14 16 18 20 22 24 26 28 30 32 34 36 38 40
 2 4 6 8 10 12 14 16 18 20 22 24 26 28 30 32 34 36 38 40
 2 4 6 8 10 12 14 16 18 20 22 24 26 28 30 32 34 36 38 40
 2 4 6 8 10 12 14 16 18 20 22 24 26 28 30 32 34 36 38 40
 2 4 6 8 10 12 14 16 18 20 22 24 26 28 30 32 34 36 38 40
 2 4 6 8 10 12 14 16 18 20 22 24 26 28 30 32 34 36 38 40
 2 4 6 8 10 12 14 16 18 20 22 24 26 28 30 32 34 36 38 40
 2 4 6 8 10 12 14 16 18 20 22 24 26 28 30 32 34 36 38 40], StorageClass="ExportToFile", HeaderFile="InjCrv_MI1_Paras.h", DefinitionFile="InjCrv_MI1_Paras.c", DataType="Angle_CA", Min=-10, Max=40, Unit="CA")  % Base value for MI1 start of energizing with PiI1

InjCrv_phiMI1Max1EOM0_MAPX = Simulink.Parameter([0 200 400 600 800 1000 1200 1400 1600 1800 2000 2200 2400 2800 3200 3600 4000 4400 4800 5200], StorageClass="ExportToFile", HeaderFile="InjCrv_MI1_Paras.h", DefinitionFile="InjCrv_MI1_Paras.c", DataType="ERPM", Min=0, Max=6000, Unit="rpm")  % Base value for MI1 start of energizing with no pilot injections X axis
InjCrv_phiMI1Max1EOM0_MAPY = Simulink.Parameter([0 1 2 3 4 5 6 7 8 9 10 11 12 13 14 15 16 17 18 19], StorageClass="ExportToFile", HeaderFile="InjCrv_MI1_Paras.h", DefinitionFile="InjCrv_MI1_Paras.c", DataType="InjMass", Min=-300, Max=319, Unit="mg/hub")  % Base value for MI1 start of energizing with no pilot injections Y axis

InjCrv_phiMI1Max1EOM0_MAP = Simulink.Parameter([0 1 2 3 4 5 6 7 8 9 10 11 12 13 14 15 16 17 18 19
 0 1 2 3 4 5 6 7 8 9 10 11 12 13 14 15 16 17 18 19
 0 1 2 3 4 5 6 7 8 9 10 11 12 13 14 15 16 17 18 19
 0 1 2 3 4 5 6 7 8 9 10 11 12 13 14 15 16 17 18 19
 0 1 2 3 4 5 6 7 8 9 10 11 12 13 14 15 16 17 18 19
 0 1 2 3 4 5 6 7 8 9 10 11 12 13 14 15 16 17 18 19
 0 1 2 3 4 5 6 7 8 9 10 11 12 13 14 15 16 17 18 19
 0 1 2 3 4 5 6 7 8 9 10 11 12 13 14 15 16 17 18 19
 0 1 2 3 4 5 6 7 8 9 10 11 12 13 14 15 16 17 18 19
 0 1 2 3 4 5 6 7 8 9 10 11 12 13 14 15 16 17 18 19
 0 1 2 3 4 5 6 7 8 9 10 11 12 13 14 15 16 17 18 19
 0 1 2 3 4 5 6 7 8 9 10 11 12 13 14 15 16 17 18 19
 0 1 2 3 4 5 6 7 8 9 10 11 12 13 14 15 16 17 18 19
 0 1 2 3 4 5 6 7 8 9 10 11 12 13 14 15 16 17 18 19
 0 1 2 3 4 5 6 7 8 9 10 11 12 13 14 15 16 17 18 19
 0 1 2 3 4 5 6 7 8 9 10 11 12 13 14 15 16 17 18 19
 0 1 2 3 4 5 6 7 8 9 10 11 12 13 14 15 16 17 18 19
 0 1 2 3 4 5 6 7 8 9 10 11 12 13 14 15 16 17 18 19
 0 1 2 3 4 5 6 7 8 9 10 11 12 13 14 15 16 17 18 19
 0 1 2 3 4 5 6 7 8 9 10 11 12 13 14 15 16 17 18 19], StorageClass="ExportToFile", HeaderFile="InjCrv_MI1_Paras.h", DefinitionFile="InjCrv_MI1_Paras.c", DataType="Angle_CA", Min=-10, Max=40, Unit="CA")  % Base value for MI1 start of energizing with no pilot injections

InjCrv_phiMI1Bas1EOM0_MAPX = Simulink.Parameter([800 1000 1200 1400 1600 1800 2000 2200 2400 2600 2800 3000 3200 3400 3600 4000], StorageClass="ExportToFile", HeaderFile="InjCrv_MI1_Paras.h", DefinitionFile="InjCrv_MI1_Paras.c", DataType="ERPM", Min=0, Max=6000, Unit="rpm")  % Base value for MI1 start of energizing with no pilot injections X axis
InjCrv_phiMI1Bas1EOM0_MAPY = Simulink.Parameter([0 5 10 15 20 25 30 35 40 45 50 55 60 65 70], StorageClass="ExportToFile", HeaderFile="InjCrv_MI1_Paras.h", DefinitionFile="InjCrv_MI1_Paras.c", DataType="InjMass", Min=-300, Max=319, Unit="mg/hub")  % Base value for MI1 start of energizing with no pilot injections Y axis

InjCrv_phiMI1Bas1EOM0_MAP = Simulink.Parameter([3.098145 3.735352 4.130859 4.614258 5.119629 5.844727 6.833496 7.932129 8.920898 9.602051 10.5249 11.4917 12.30469 12.96387 13.75488 14.50195
 2.834473 3.405762 3.80127 4.262695 4.746094 5.405273 6.350098 7.404785 8.349609 9.052734 9.931641 10.83252 11.55762 12.26074 12.91992 13.68896
 2.768555 3.383789 3.845215 4.328613 4.768066 5.317383 6.196289 7.185059 8.085938 8.76709 9.602051 10.43701 11.11816 11.82129 12.32666 13.07373
 2.922363 3.47168 3.999023 4.482422 4.943848 5.427246 6.416016 7.316895 8.239746 8.964844 9.755859 10.5249 11.16211 11.84326 12.37061 13.0957
 3.032227 3.669434 4.262695 4.724121 5.229492 5.712891 6.723633 7.646484 8.591309 9.338379 10.08545 10.78857 11.46973 12.12891 12.72217 13.44727
 3.22998 3.911133 4.504395 5.053711 5.559082 6.108398 7.053223 8.041992 9.008789 9.821777 10.54688 11.25 11.90918 12.6123 13.13965 13.99658
 3.493652 4.262695 4.833984 5.405273 6.04248 6.635742 7.536621 8.481445 9.470215 10.30518 11.11816 11.84326 12.4585 13.0957 13.73291 14.65576
 3.845215 4.54834 5.20752 5.822754 6.481934 7.163086 8.129883 9.052734 10.06348 10.98633 11.88721 12.63428 13.24951 13.88672 14.52393 15.38086
 4.240723 4.96582 5.690918 6.328125 7.053223 7.822266 8.745117 9.667969 10.67871 11.7334 12.76611 13.46924 14.12842 14.72168 15.40283 16.25977
 4.614258 5.427246 6.152344 6.943359 7.668457 8.569336 9.51416 10.45898 11.42578 12.41455 13.55713 14.32617 14.98535 15.62256 16.34766 17.20459
 5.053711 5.910645 6.679688 7.514648 8.261719 9.228516 10.2832 11.22803 12.17285 13.07373 14.19434 15.0293 15.6665 16.28174 17.05078 18.03955
 5.449219 6.328125 7.119141 7.954102 8.679199 9.755859 10.78857 11.77734 12.63428 13.5791 14.65576 15.33691 16.08398 16.69922 17.44629 18.56689
 5.712891 6.61377 7.470703 8.283691 8.986816 10.08545 11.09619 12.08496 12.98584 13.79883 14.94141 15.60059 16.32568 17.00684 17.75391 18.74268
 5.866699 6.723633 7.492676 8.4375 9.18457 10.2832 11.27197 12.26074 13.16162 13.93066 15.11719 15.77637 16.54541 17.16064 17.86377 18.91846
 5.822754 6.679688 7.536621 8.481445 9.250488 10.2832 11.29395 12.43652 13.31543 14.10645 15.22705 15.9082 16.61133 17.16064 17.90771 18.89648], StorageClass="ExportToFile", HeaderFile="InjCrv_MI1_Paras.h", DefinitionFile="InjCrv_MI1_Paras.c", DataType="Angle_CA", Min=-10, Max=40, Unit="CA")  % Base value for MI1 start of energizing with no pilot injections

InjCrv_phiMI1Bas2EOM0_MAPX = Simulink.Parameter([800 1000 1200 1400 1600 1800 2000 2200 2400 2600 2800 3000 3200 3400 3600 4000], StorageClass="ExportToFile", HeaderFile="InjCrv_MI1_Paras.h", DefinitionFile="InjCrv_MI1_Paras.c", DataType="ERPM", Min=0, Max=6000, Unit="rpm")  % Base value for MI1 start of energizing with PiI1 X axis
InjCrv_phiMI1Bas2EOM0_MAPY = Simulink.Parameter([0 5 10 15 20 25 30 35 40 45 50 55 60 65 70], StorageClass="ExportToFile", HeaderFile="InjCrv_MI1_Paras.h", DefinitionFile="InjCrv_MI1_Paras.c", DataType="InjMass", Min=-300, Max=319, Unit="mg/hub")  % Base value for MI1 start of energizing with PiI1 Y axis

InjCrv_phiMI1Bas2EOM0_MAP = Simulink.Parameter([3.098145 3.735352 4.130859 4.614258 5.119629 5.844727 6.833496 7.932129 8.920898 9.602051 10.5249 11.4917 12.30469 12.96387 13.75488 14.50195
 2.834473 3.405762 3.80127 4.262695 4.746094 5.405273 6.350098 7.404785 8.349609 9.052734 9.931641 10.83252 11.55762 12.26074 12.91992 13.68896
 2.768555 3.383789 3.845215 4.328613 4.768066 5.317383 6.196289 7.185059 8.085938 8.76709 9.602051 10.43701 11.11816 11.82129 12.32666 13.07373
 2.922363 3.47168 3.999023 4.482422 4.943848 5.427246 6.416016 7.316895 8.239746 8.964844 9.755859 10.5249 11.16211 11.84326 12.37061 13.0957
 3.032227 3.669434 4.262695 4.724121 5.229492 5.712891 6.723633 7.646484 8.591309 9.338379 10.08545 10.78857 11.46973 12.12891 12.72217 13.44727
 3.22998 3.911133 4.504395 5.053711 5.559082 6.108398 7.053223 8.041992 9.008789 9.821777 10.54688 11.25 11.90918 12.6123 13.13965 13.99658
 3.493652 4.262695 4.833984 5.405273 6.04248 6.635742 7.536621 8.481445 9.470215 10.30518 11.11816 11.84326 12.4585 13.0957 13.73291 14.65576
 3.845215 4.54834 5.20752 5.822754 6.481934 7.163086 8.129883 9.052734 10.06348 10.98633 11.88721 12.63428 13.24951 13.88672 14.52393 15.38086
 4.240723 4.96582 5.690918 6.328125 7.053223 7.822266 8.745117 9.667969 10.67871 11.7334 12.76611 13.46924 14.12842 14.72168 15.40283 16.25977
 4.614258 5.427246 6.152344 6.943359 7.668457 8.569336 9.51416 10.45898 11.42578 12.41455 13.55713 14.32617 14.98535 15.62256 16.34766 17.20459
 5.053711 5.910645 6.679688 7.514648 8.261719 9.228516 10.2832 11.22803 12.17285 13.07373 14.19434 15.0293 15.6665 16.28174 17.05078 18.03955
 5.449219 6.328125 7.119141 7.954102 8.679199 9.755859 10.78857 11.77734 12.63428 13.5791 14.65576 15.33691 16.08398 16.69922 17.44629 18.56689
 5.712891 6.61377 7.470703 8.283691 8.986816 10.08545 11.09619 12.08496 12.98584 13.79883 14.94141 15.60059 16.32568 17.00684 17.75391 18.74268
 5.866699 6.723633 7.492676 8.4375 9.18457 10.2832 11.27197 12.26074 13.16162 13.93066 15.11719 15.77637 16.54541 17.16064 17.86377 18.91846
 5.822754 6.679688 7.536621 8.481445 9.250488 10.2832 11.29395 12.43652 13.31543 14.10645 15.22705 15.9082 16.61133 17.16064 17.90771 18.89648], StorageClass="ExportToFile", HeaderFile="InjCrv_MI1_Paras.h", DefinitionFile="InjCrv_MI1_Paras.c", DataType="Angle_CA", Min=-10, Max=40, Unit="CA")  % Base value for MI1 start of energizing with PiI1

InjCrv_phiMI1StrtBase_MAPX = Simulink.Parameter([0 50 100 150 200 250 300 350 400 450 500 550 600 650 700 750], StorageClass="ExportToFile", HeaderFile="InjCrv_MI1_Paras.h", DefinitionFile="InjCrv_MI1_Paras.c", DataType="ERPM", Min=0, Max=6000, Unit="rpm")  % Base value for MI1 start of energizing when engine start  X axis
InjCrv_phiMI1StrtBase_MAPY = Simulink.Parameter([0 1 2 3 4 5 6 7 8 9 10 11 12 13 14 15], StorageClass="ExportToFile", HeaderFile="InjCrv_MI1_Paras.h", DefinitionFile="InjCrv_MI1_Paras.c", DataType="InjMass", Min=-300, Max=319, Unit="mg/hub")  % Base value for MI1 start of energizing when engine start  Y axis

InjCrv_phiMI1StrtBase_MAP = Simulink.Parameter([0 1 3 4 5 6 7 8 9 10 11 12 13 14 15 16
 0 1 3 4 5 6 7 8 9 10 11 12 13 14 15 16
 0 1 3 4 5 6 7 8 9 10 11 12 13 14 15 16
 0 1 3 4 5 6 7 8 9 10 11 12 13 14 15 16
 0 1 3 4 5 6 7 8 9 10 11 12 13 14 15 16
 0 1 3 4 5 6 7 8 9 10 11 12 13 14 15 16
 0 1 3 4 5 6 7 8 9 10 11 12 13 14 15 16
 0 1 3 4 5 6 7 8 9 10 11 12 13 14 15 16
 0 1 3 4 5 6 7 8 9 10 11 12 13 14 15 16
 0 1 3 4 5 6 7 8 9 10 11 12 13 14 15 16
 0 1 3 4 5 6 7 8 9 10 11 12 13 14 15 16
 0 1 3 4 5 6 7 8 9 10 11 12 13 14 15 16
 0 1 3 4 5 6 7 8 9 10 11 12 13 14 15 16
 0 1 3 4 5 6 7 8 9 10 11 12 13 14 15 16
 0 1 3 4 5 6 7 8 9 10 11 12 13 14 15 16
 0 1 3 4 5 6 7 8 9 10 11 12 13 14 15 16], StorageClass="ExportToFile", HeaderFile="InjCrv_MI1_Paras.h", DefinitionFile="InjCrv_MI1_Paras.c", DataType="Angle_CA", Min=-10, Max=40, Unit="CA")  % Base value for MI1 start of energizing when engine start

InjCrv_phiMI1Min_C = Simulink.Parameter(3, StorageClass="ExportToFile", HeaderFile="InjCrv_MI1_Paras.h", DefinitionFile="InjCrv_MI1_Paras.c", DataType="Angle_CA", Min=-10, Max=40, Unit="CA")  % mininum value for MI1 angle
SigTst_phiMI1_C = Simulink.Parameter(0, StorageClass="ExportToFile", HeaderFile="InjCrv_MI1_Paras.h", DefinitionFile="InjCrv_MI1_Paras.c", DataType="Angle_CA", Min=-10, Max=40, Unit="CA")  % signal test Replacement value
SigTst_swtMI1Phi_C = Simulink.Parameter(Switch.OFF, StorageClass="ExportToFile", HeaderFile="InjCrv_MI1_Paras.h", DefinitionFile="InjCrv_MI1_Paras.c", DataType="Enum: Switch", Unit="NaN")  % signal test switch
InjCrv_qMI1Min_C = Simulink.Parameter(2.5, StorageClass="ExportToFile", HeaderFile="InjCrv_MI1_Paras.h", DefinitionFile="InjCrv_MI1_Paras.c", DataType="InjMass", Min=-300, Max=319, Unit="mg/hub")  % mininum value for MI1 quantity
InjCrv_qMI1MinPiIDiff_C = Simulink.Parameter(2.5, StorageClass="ExportToFile", HeaderFile="InjCrv_MI1_Paras.h", DefinitionFile="InjCrv_MI1_Paras.c", DataType="InjMass", Min=-300, Max=319, Unit="mg/hub")  % mininum value between MI1 and Pil quantity
InjCrv_qMI1MinPoIDiff_C = Simulink.Parameter(2.5, StorageClass="ExportToFile", HeaderFile="InjCrv_MI1_Paras.h", DefinitionFile="InjCrv_MI1_Paras.c", DataType="InjMass", Min=-300, Max=319, Unit="mg/hub")  % mininum value between MI1 and PoI quantity
InjCrv_stInjCharSetVal_C = Simulink.Parameter(0, StorageClass="ExportToFile", HeaderFile="InjCrv_MI1_Paras.h", DefinitionFile="InjCrv_MI1_Paras.c", DataType="State", Min=0, Max=255, Unit="NaN")  % Injection characteristic setpoint (speed synchronous) switch