% Simulink data dictionary InjSys_CtlQnt.sldd
% references slprj_cm.sldd
% references sl_ddtypes.sldd

InjSys_qTot = Simulink.Signal(StorageClass="ExportToFile", HeaderFile="InjSys_CtlQnt_Signals.h", DefinitionFile="InjSys_CtlQnt_Signals.c", DataType="InjMass", Min=-319, Max=319, Unit="mg/hub", InitialValue="0")  % Total engine injection quantity
InjSys_qOfsTot = Simulink.Signal(StorageClass="ExportToFile", HeaderFile="InjSys_CtlQnt_Signals.h", DefinitionFile="InjSys_CtlQnt_Signals.c", DataType="InjMass", Min=-319, Max=319, Unit="mg/hub", InitialValue="0")  % Non-torque generating quantity, the offset-quantity from torque generating quantity to total quantity