% Simulink data dictionary InjVlv_CalcET.sldd
% references slprj_cm.sldd
% references sl_ddtypes.sldd

InjVlv_tiETMI1_mp = Simulink.Signal(StorageClass="ExportToFile", HeaderFile="InjVlv_CalcET_Signals.h", DefinitionFile="InjVlv_CalcET_Signals.c", DataType="uSec1", Min=-13107, Max=13106, Unit="us", InitialValue="0")  % Start of energizing for MI1
InjVlv_tiETPiI1_mp = Simulink.Signal(StorageClass="ExportToFile", HeaderFile="InjVlv_CalcET_Signals.h", DefinitionFile="InjVlv_CalcET_Signals.c", DataType="uSec1", Min=-13107, Max=13106, Unit="us", InitialValue="0")  % Start of energizing for PiI1
InjVlv_tiETPoI2_mp = Simulink.Signal(StorageClass="ExportToFile", HeaderFile="InjVlv_CalcET_Signals.h", DefinitionFile="InjVlv_CalcET_Signals.c", DataType="uSec1", Min=-13107, Max=13106, Unit="us", InitialValue="0")  % Start of energizing for PoI2
InjCrv_tiPoI2Pse_mp = Simulink.Signal(StorageClass="ExportToFile", HeaderFile="InjVlv_CalcET_Signals.h", DefinitionFile="InjVlv_CalcET_Signals.c", DataType="uSec1", Min=-13107, Max=13106, Unit="us", InitialValue="0")  % Minium injection interval between MI1 and PoI2
InjCrv_tiPiIPse_mp = Simulink.Signal(StorageClass="ExportToFile", HeaderFile="InjVlv_CalcET_Signals.h", DefinitionFile="InjVlv_CalcET_Signals.c", DataType="uSec1", Min=-13107, Max=13106, Unit="us", InitialValue="0")  % Minium injection interval between MI1 and PiI1
InjCrv_tiMI1ET = Simulink.Signal(StorageClass="ExportToFile", HeaderFile="InjVlv_CalcET_Signals.h", DefinitionFile="InjVlv_CalcET_Signals.c", DataType="uSec1", Min=-13107, Max=13106, Unit="us", InitialValue="0")  % Estimated MI1 energizing time
InjCrv_tiPiI1ET_mp = Simulink.Signal(StorageClass="ExportToFile", HeaderFile="InjVlv_CalcET_Signals.h", DefinitionFile="InjVlv_CalcET_Signals.c", DataType="uSec1", Min=-13107, Max=13106, Unit="us", InitialValue="0")  % Estimated energizing time for PiI1
InjVlv_tiETPiI2_mp = Simulink.Signal(StorageClass="ExportToFile", HeaderFile="InjVlv_CalcET_Signals.h", DefinitionFile="InjVlv_CalcET_Signals.c", DataType="uSec1", Min=-13107, Max=13106, Unit="us", InitialValue="0")  % Start of energizing for PiI2
InjCrv_tiPiI2ET_mp = Simulink.Signal(StorageClass="ExportToFile", HeaderFile="InjVlv_CalcET_Signals.h", DefinitionFile="InjVlv_CalcET_Signals.c", DataType="uSec1", Min=-13107, Max=13106, Unit="us", InitialValue="0")  % Estimated energizing time for PiI2
InjVlv_tiSOEDynCor_mp = Simulink.Signal(StorageClass="ExportToFile", HeaderFile="InjVlv_CalcET_Signals.h", DefinitionFile="InjVlv_CalcET_Signals.c", DataType="uSec1", Min=-13107, Max=13106, Unit="us", InitialValue="0")  % injector open delay time
InjVlv_tiEOEDynCor_mp = Simulink.Signal(StorageClass="ExportToFile", HeaderFile="InjVlv_CalcET_Signals.h", DefinitionFile="InjVlv_CalcET_Signals.c", DataType="uSec1", Min=-13107, Max=13106, Unit="us", InitialValue="0")  % injector close delay time
InjVlv_tiETMI1NoCor_mp = Simulink.Signal(StorageClass="ExportToFile", HeaderFile="InjVlv_CalcET_Signals.h", DefinitionFile="InjVlv_CalcET_Signals.c", DataType="uSec1", Min=-13107, Max=13106, Unit="us", InitialValue="0")  % Start of energizing for MI1 without correction
InjVlv_tiETPiI1NoCor_mp = Simulink.Signal(StorageClass="ExportToFile", HeaderFile="InjVlv_CalcET_Signals.h", DefinitionFile="InjVlv_CalcET_Signals.c", DataType="uSec1", Min=-13107, Max=13106, Unit="us", InitialValue="0")  % Start of energizing for PiI1 without correction
InjVlv_tiETPoI2NoCor_mp = Simulink.Signal(StorageClass="ExportToFile", HeaderFile="InjVlv_CalcET_Signals.h", DefinitionFile="InjVlv_CalcET_Signals.c", DataType="uSec1", Min=-13107, Max=13106, Unit="us", InitialValue="0")  % Start of energizing for PoI2 without correction
InjVlv_stPresMin = Simulink.Signal(StorageClass="ExportToFile", HeaderFile="InjVlv_CalcET_Signals.h", DefinitionFile="InjVlv_CalcET_Signals.c", DataType="boolean", Min=0, Max=1, Unit="NaN", InitialValue="0")  % State of Minium Rail pressure base on engine temperature
InjVlv_qMI1Min_mp = Simulink.Signal(StorageClass="ExportToFile", HeaderFile="InjVlv_CalcET_Signals.h", DefinitionFile="InjVlv_CalcET_Signals.c", DataType="InjMass", Min=-319, Max=319, Unit="mg/hub", InitialValue="0")  % Start of energizing correction factor for MI1 based on Rail pressure
InjVlv_qPiI1Min_mp = Simulink.Signal(StorageClass="ExportToFile", HeaderFile="InjVlv_CalcET_Signals.h", DefinitionFile="InjVlv_CalcET_Signals.c", DataType="InjMass", Min=-319, Max=319, Unit="mg/hub", InitialValue="0")  % Start of energizing correction for PiI1 based on Rail pressure
InjVlv_qPoI2Min_mp = Simulink.Signal(StorageClass="ExportToFile", HeaderFile="InjVlv_CalcET_Signals.h", DefinitionFile="InjVlv_CalcET_Signals.c", DataType="InjMass", Min=-319, Max=319, Unit="mg/hub", InitialValue="0")  % Start of energizing correction for PoI2 based on Rail pressure
InjVlv_stMI1QntMin = Simulink.Signal(StorageClass="ExportToFile", HeaderFile="InjVlv_CalcET_Signals.h", DefinitionFile="InjVlv_CalcET_Signals.c", DataType="boolean", Min=0, Max=1, Unit="NaN", InitialValue="0")  % State of Minium injection quantity of MI1
InjVlv_stPiI1QntMin = Simulink.Signal(StorageClass="ExportToFile", HeaderFile="InjVlv_CalcET_Signals.h", DefinitionFile="InjVlv_CalcET_Signals.c", DataType="boolean", Min=0, Max=1, Unit="NaN", InitialValue="0")  % State of Minium injection quantity of PiI1
InjVlv_stPoI2QntMin = Simulink.Signal(StorageClass="ExportToFile", HeaderFile="InjVlv_CalcET_Signals.h", DefinitionFile="InjVlv_CalcET_Signals.c", DataType="boolean", Min=0, Max=1, Unit="NaN", InitialValue="0")  % State of Minium injection quantity of PoI2
InjVlv_tiPoI2DiffMin_mp = Simulink.Signal(StorageClass="ExportToFile", HeaderFile="InjVlv_CalcET_Signals.h", DefinitionFile="InjVlv_CalcET_Signals.c", DataType="uSec1", Min=-13107, Max=13106, Unit="us", InitialValue="0")  % Interval time of Minium injection  of PoI2
InjVlv_tiPiIDiffMin_mp = Simulink.Signal(StorageClass="ExportToFile", HeaderFile="InjVlv_CalcET_Signals.h", DefinitionFile="InjVlv_CalcET_Signals.c", DataType="uSec1", Min=-13107, Max=13106, Unit="us", InitialValue="0")  % Interval time of Minium injection of PiI
InjVlv_pMin_mp = Simulink.Signal(StorageClass="ExportToFile", HeaderFile="InjVlv_CalcET_Signals.h", DefinitionFile="InjVlv_CalcET_Signals.c", DataType="Press_bar1", Min=0, Max=2000, Unit="bar", InitialValue="0")  % Minium Rail pressure for MI1 based on Rail pressure
InjVlv_tiETPiI2NoCor_mp = Simulink.Signal(StorageClass="ExportToFile", HeaderFile="InjVlv_CalcET_Signals.h", DefinitionFile="InjVlv_CalcET_Signals.c", DataType="uSec1", Min=-13107, Max=13106, Unit="us", InitialValue="0")  % Start of energizing for PiI2 without correction
InjVlv_qPiI2Min_mp = Simulink.Signal(StorageClass="ExportToFile", HeaderFile="InjVlv_CalcET_Signals.h", DefinitionFile="InjVlv_CalcET_Signals.c", DataType="InjMass", Min=-319, Max=319, Unit="mg/hub", InitialValue="0")  % Start of energizing correction for PiI2 based on Rail pressure
InjVlv_stPiI2QntMin = Simulink.Signal(StorageClass="ExportToFile", HeaderFile="InjVlv_CalcET_Signals.h", DefinitionFile="InjVlv_CalcET_Signals.c", DataType="boolean", Min=0, Max=1, Unit="NaN", InitialValue="0")  % State of Minium injection quantity of PiI2
InjVlv_pMin_C = Simulink.Parameter(150, StorageClass="ExportToFile", HeaderFile="InjVlv_CalcET_Paras.h", DefinitionFile="InjVlv_CalcET_Paras.c", DataType="Press_bar1", Min=0, Max=2000, Unit="bar")  % Injector pressure threshold for releasing/inhibiting the injection
InjVlv_pMin_CURX = Simulink.Parameter([-30 -10 10 30 50 70 90 110], StorageClass="ExportToFile", HeaderFile="InjVlv_CalcET_Paras.h", DefinitionFile="InjVlv_CalcET_Paras.c", DataType="Temp_C", Min=-50, Max=150, Unit="deg")  % Engine Temperature
InjVlv_pMin_CUR = Simulink.Parameter(repmat(120, 1, 8), StorageClass="ExportToFile", HeaderFile="InjVlv_CalcET_Paras.h", DefinitionFile="InjVlv_CalcET_Paras.c", DataType="Press_bar1", Min=0, Max=2000, Unit="bar")  % Minium Rail pressure for MI1 based on Rail pressure
InjVlv_qMI1Min_CURX = Simulink.Parameter([0 200 250 300 350 400 450 500 550 600 650 700 750 800 850 900 950 1000 1050 1100 1150 1200 1250 1300 1350], StorageClass="ExportToFile", HeaderFile="InjVlv_CalcET_Paras.h", DefinitionFile="InjVlv_CalcET_Paras.c", DataType="Press_bar1", Min=0, Max=2000, Unit="bar")  % minimum fuel quantity curve for MI1
InjVlv_qMI1Min_CUR = Simulink.Parameter(repmat(0.4, 1, 25), StorageClass="ExportToFile", HeaderFile="InjVlv_CalcET_Paras.h", DefinitionFile="InjVlv_CalcET_Paras.c", DataType="InjMass", Min=-319, Max=319, Unit="mg/hub")  % minimum fuel quantity curve for MI1
InjVlv_qPiI1Min_CURX = Simulink.Parameter([0 200 250 300 350 400 450 500 550 600 650 700 750 800 850 900 950 1000 1050 1100 1150 1200 1250 1300 1350], StorageClass="ExportToFile", HeaderFile="InjVlv_CalcET_Paras.h", DefinitionFile="InjVlv_CalcET_Paras.c", DataType="Press_bar1", Min=0, Max=2000, Unit="bar")  % minimum fuel quantity curve for PiI1
InjVlv_qPiI1Min_CUR = Simulink.Parameter(repmat(0.4, 1, 25), StorageClass="ExportToFile", HeaderFile="InjVlv_CalcET_Paras.h", DefinitionFile="InjVlv_CalcET_Paras.c", DataType="InjMass", Min=-319, Max=319, Unit="mg/hub")  % minimum fuel quantity curve for PiI1
InjVlv_qPoI2Min_CURX = Simulink.Parameter([0 200 250 300 350 400 450 500 550 600 650 700 750 800 850 900 950 1000 1050 1100 1150 1200 1250 1300 1350], StorageClass="ExportToFile", HeaderFile="InjVlv_CalcET_Paras.h", DefinitionFile="InjVlv_CalcET_Paras.c", DataType="Press_bar1", Min=0, Max=2000, Unit="bar")  % minimum fuel quantity curve for PoI2
InjVlv_qPoI2Min_CUR = Simulink.Parameter(repmat(0.4, 1, 25), StorageClass="ExportToFile", HeaderFile="InjVlv_CalcET_Paras.h", DefinitionFile="InjVlv_CalcET_Paras.c", DataType="InjMass", Min=-319, Max=319, Unit="mg/hub")  % minimum fuel quantity curve for PoI2
InjVlv_tiDiffMin_MAPX = Simulink.Parameter([100 200 300 400 500 600 700 800], StorageClass="ExportToFile", HeaderFile="InjVlv_CalcET_Paras.h", DefinitionFile="InjVlv_CalcET_Paras.c", DataType="Press_bar1", Min=0, Max=2000, Unit="bar")  % Minium injection interval between two injection
InjVlv_tiDiffMin_MAPY = Simulink.Parameter([0 7 14 21 28 35 40 45], StorageClass="ExportToFile", HeaderFile="InjVlv_CalcET_Paras.h", DefinitionFile="InjVlv_CalcET_Paras.c", DataType="InjMass", Min=0, Max=319, Unit="mg/hub")  % Minium injection interval between two injection
InjVlv_tiDiffMin_MAP = Simulink.Parameter(repmat(0, 8, 8), StorageClass="ExportToFile", HeaderFile="InjVlv_CalcET_Paras.h", DefinitionFile="InjVlv_CalcET_Paras.c", DataType="uSec1", Min=-13107, Max=13106, Unit="us")  % Minium injection interval between two injection
InjVlv_tiPseElec = Simulink.Parameter(800, StorageClass="ExportToFile", HeaderFile="InjVlv_CalcET_Paras.h", DefinitionFile="InjVlv_CalcET_Paras.c", DataType="uSec1", Min=-13107, Max=13106, Unit="us")  % Injector pause time for preventing collisions (during electric energizing)
InjVlv_tiOpenDelay_MAPX = Simulink.Parameter([0 2 5 10 15 20 25 30 35 40 50 60 70 80], StorageClass="ExportToFile", HeaderFile="InjVlv_CalcET_Paras.h", DefinitionFile="InjVlv_CalcET_Paras.c", DataType="InjMass", Min=-319, Max=319, Unit="mg/hub")  % injector open delay time
InjVlv_tiOpenDelay_MAPY = Simulink.Parameter([0 100 200 300 400 500 600 700 800 900 1000 1100 1200 1300], StorageClass="ExportToFile", HeaderFile="InjVlv_CalcET_Paras.h", DefinitionFile="InjVlv_CalcET_Paras.c", DataType="Press_bar1", Min=0, Max=2000, Unit="bar")  % injector open delay time
InjVlv_tiOpenDelay_MAP = Simulink.Parameter(repmat(0, 14, 14), StorageClass="ExportToFile", HeaderFile="InjVlv_CalcET_Paras.h", DefinitionFile="InjVlv_CalcET_Paras.c", DataType="uSec1", Min=-13107, Max=13106, Unit="us")  % injector open delay time
InjVlv_tiCloseDelay_MAPX = Simulink.Parameter([0 2 5 10 15 20 25 30 35 40 50 60 70 80], StorageClass="ExportToFile", HeaderFile="InjVlv_CalcET_Paras.h", DefinitionFile="InjVlv_CalcET_Paras.c", DataType="InjMass", Min=-319, Max=319, Unit="mg/hub")  % injector close delay time
InjVlv_tiCloseDelay_MAPY = Simulink.Parameter([0 100 200 300 400 500 600 700 800 900 1000 1100 1200 1300], StorageClass="ExportToFile", HeaderFile="InjVlv_CalcET_Paras.h", DefinitionFile="InjVlv_CalcET_Paras.c", DataType="Press_bar1", Min=0, Max=2000, Unit="bar")  % injector close delay time
InjVlv_tiCloseDelay_MAP = Simulink.Parameter(repmat(0, 14, 14), StorageClass="ExportToFile", HeaderFile="InjVlv_CalcET_Paras.h", DefinitionFile="InjVlv_CalcET_Paras.c", DataType="uSec1", Min=-13107, Max=13106, Unit="us")  % injector close delay time
InjVlv_tiET_MAPX = Simulink.Parameter([0 0.5 1 2 3 4 5 10 15 20 25 30 35 40 45 50 55 60 70 80], StorageClass="ExportToFile", HeaderFile="InjVlv_CalcET_Paras.h", DefinitionFile="InjVlv_CalcET_Paras.c", DataType="InjMass", Min=-319, Max=319, Unit="mg/hub")  % Map for converting from injection quantity to energizing time,Applies to all injections
InjVlv_tiET_MAPY = Simulink.Parameter([0 100 200 300 400 500 600 700 800 900 1000 1100 1200 1300 1400 1500], StorageClass="ExportToFile", HeaderFile="InjVlv_CalcET_Paras.h", DefinitionFile="InjVlv_CalcET_Paras.c", DataType="Press_bar1", Min=0, Max=2000, Unit="bar")  % Map for converting from injection quantity to energizing time,Applies to all injections

InjVlv_tiET_MAP = Simulink.Parameter([0 414 509.6 622.8 733.2 772.8 836 1110.8 1282.8 1496 1753.2 2020.8 2266.4 2509.2 2762 3004.4 3257.2 3500 3995.2 4490.8
 0 362.4 450.8 553.6 634.4 678.8 737.6 965.2 1126.8 1310.8 1509.2 1707.6 1913.6 2112 2317.6 2516 2722 2920.4 3324.8 3728.8
 0 311.2 392 484.4 536 584.4 638.8 819.6 970.8 1125.2 1264.8 1394.4 1560.4 1714.8 1873.2 2027.6 2186.4 2340.8 2654 2966.8
 0 267.2 303.6 392 443.6 487.6 516.8 684.4 787.2 918 1015.2 1131.2 1248.8 1346 1460 1579.2 1695.2 1805.6 2039.2 2267.2
 0 252 281.6 318.4 384.8 435.6 465.6 590 693.2 796 877.2 987.2 1075.2 1156 1258.8 1354.4 1442.4 1538 1729.2 1920.4
 0 237.6 267.2 296.4 348.8 406.8 443.6 531.6 634.4 715.2 788.8 892.8 965.2 1040 1121.6 1201.6 1275.2 1356 1539.6 1702.4
 0 230.4 259.6 284 311.2 370 409.2 497.2 585.6 656.4 732.4 813.2 872 958 1034 1100 1166 1239.6 1376.8 1541.2
 0 222.8 252.4 274.4 296.4 340.4 377.2 465.6 538.8 605.2 686 756 818.4 891.6 950.4 1013.2 1086.8 1149.2 1277.6 1410
 0 222.8 244.8 267.2 289.2 318.4 353.2 443.6 507.2 568.4 639.6 700.8 779.2 838 891.6 958 1014.4 1073.2 1190.8 1316
 0 222.8 244.8 267.2 281.6 296.4 326 428.8 480 546.4 604.4 656.4 730 788.8 846.8 905.6 958 1009.2 1119.6 1236.4
 0 222.8 244.8 259.6 274.4 281.6 303.6 407.2 465.6 524.4 568.8 620.4 693.2 752 803.6 862.4 914 958.4 1061.2 1171.2
 0 222.8 237.6 252.4 267.2 274.4 289.2 384.8 443.6 502.4 546.4 597.6 651.2 715.2 774 820 869.6 921.2 1011.2 1119.6
 0 222.8 230.4 252.4 259.6 274.4 281.6 370 428.8 472.8 531.6 571.6 620 682 737.6 788.8 836.4 884.4 968.4 1071.6
 0 218.4 230.4 244.8 259.6 267.2 271.6 355.2 406.8 458 509.6 550.8 590.4 649.2 708 756.8 803.6 847.6 933.2 1016.8
 0 218.4 230.4 244.8 244.8 258.4 265.6 348 399.2 443.6 493.6 531.6 568.4 620 671.2 722.8 772.8 818.4 897.6 980
 0 208.4 222.8 237.6 237.6 252.4 252.4 333.2 384.8 428.8 472.8 509.6 553.6 597.6 649.2 700.8 744.8 788.8 869.6 943.2], StorageClass="ExportToFile", HeaderFile="InjVlv_CalcET_Paras.h", DefinitionFile="InjVlv_CalcET_Paras.c", DataType="uSec1", Min=-13107, Max=13106, Unit="us")  % Map for converting from injection quantity to energizing time,Applies to all injections

SigTst_tiMI1ET_C = Simulink.Parameter(0, StorageClass="ExportToFile", HeaderFile="InjVlv_CalcET_Paras.h", DefinitionFile="InjVlv_CalcET_Paras.c", DataType="uSec1", Min=-13107, Max=13106, Unit="us")  % Set Value of energizing time for MI1
SigTst_swtMI1ET_C = Simulink.Parameter(Switch.OFF, StorageClass="ExportToFile", HeaderFile="InjVlv_CalcET_Paras.h", DefinitionFile="InjVlv_CalcET_Paras.c", DataType="Enum: Switch", Unit="NaN")  % Switch for Set Value of energizing time for MI1
SigTst_tiPiI1ET_C = Simulink.Parameter(0, StorageClass="ExportToFile", HeaderFile="InjVlv_CalcET_Paras.h", DefinitionFile="InjVlv_CalcET_Paras.c", DataType="uSec1", Min=-13107, Max=13106, Unit="us")  % Set Value of energizing time for PiI1
SigTst_swtPiI1ET_C = Simulink.Parameter(Switch.OFF, StorageClass="ExportToFile", HeaderFile="InjVlv_CalcET_Paras.h", DefinitionFile="InjVlv_CalcET_Paras.c", DataType="Enum: Switch", Unit="NaN")  % Switch for Set Value of energizing time for PiI1
SigTst_tiPOI2ET_C = Simulink.Parameter(0, StorageClass="ExportToFile", HeaderFile="InjVlv_CalcET_Paras.h", DefinitionFile="InjVlv_CalcET_Paras.c", DataType="uSec1", Min=-13107, Max=13106, Unit="us")  % Set Value of energizing time for PoI2
SigTst_swtPOI2ET_C = Simulink.Parameter(Switch.OFF, StorageClass="ExportToFile", HeaderFile="InjVlv_CalcET_Paras.h", DefinitionFile="InjVlv_CalcET_Paras.c", DataType="Enum: Switch", Unit="NaN")  % Switch for Set Value of energizing time for PoI2
InjVlv_qPiI2Min_CURX = Simulink.Parameter([0 200 250 300 350 400 450 500 550 600 650 700 750 800 850 900 950 1000 1050 1100 1150 1200 1250 1300 1350], StorageClass="ExportToFile", HeaderFile="InjVlv_CalcET_Paras.h", DefinitionFile="InjVlv_CalcET_Paras.c", DataType="Press_bar1", Min=0, Max=2000, Unit="bar")  % minimum fuel quantity curve for PiI2
InjVlv_qPiI2Min_CUR = Simulink.Parameter(repmat(0.4, 1, 25), StorageClass="ExportToFile", HeaderFile="InjVlv_CalcET_Paras.h", DefinitionFile="InjVlv_CalcET_Paras.c", DataType="InjMass", Min=-319, Max=319, Unit="mg/hub")  % minimum fuel quantity curve for PiI2
SigTst_tiPiI2ET_C = Simulink.Parameter(0, StorageClass="ExportToFile", HeaderFile="InjVlv_CalcET_Paras.h", DefinitionFile="InjVlv_CalcET_Paras.c", DataType="uSec1", Min=-13107, Max=13106, Unit="us")  % Set Value of energizing time for PiI2
SigTst_swtPiI2ET_C = Simulink.Parameter(Switch.OFF, StorageClass="ExportToFile", HeaderFile="InjVlv_CalcET_Paras.h", DefinitionFile="InjVlv_CalcET_Paras.c", DataType="Enum: Switch", Unit="NaN")  % Switch for Set Value of energizing time for PiI2