% Simulink data dictionary RailP_VD.sldd
% references slprj_cm.sldd
% references sl_ddtypes.sldd

RailP_pFlt = Simulink.Signal(StorageClass="ExportToFile", HeaderFile="RailP_VD_Signals.h", DefinitionFile="RailP_VD_Signals.c", DataType="Press_bar1", Min=0, Max=2500, Unit="bar", InitialValue="0")  % Maximum rail pressure of the last 10 sampling cycle
RailP_pSubsVal_mp = Simulink.Signal(StorageClass="ExportToFile", HeaderFile="RailP_VD_Signals.h", DefinitionFile="RailP_VD_Signals.c", DataType="Press_bar1", Min=0, Max=2500, Unit="bar", InitialValue="0")  % Rail pressure substitution value in case of an error in pressure sensor
RailP_pFltNoCor_mp = Simulink.Signal(StorageClass="ExportToFile", HeaderFile="RailP_VD_Signals.h", DefinitionFile="RailP_VD_Signals.c", DataType="Press_bar1", Min=0, Max=2500, Unit="bar", InitialValue="0")  % Not corrected rail pressure
RailP_facFltPT1_mp = Simulink.Signal(StorageClass="ExportToFile", HeaderFile="RailP_VD_Signals.h", DefinitionFile="RailP_VD_Signals.c", DataType="Fac_100", Min=0, Max=99.9985, Unit="NaN", InitialValue="0")  % Current filter time for PT1 filter
RailP_dvolSubsCtlDlvMeUn_mp = Simulink.Signal(StorageClass="ExportToFile", HeaderFile="RailP_VD_Signals.h", DefinitionFile="RailP_VD_Signals.c", DataType="vFlow_mm3ps", Min=-327680, Max=327670, Unit="mm^3/s", InitialValue="0")  % Open loop controlled volume flow in limp home mode
RailP_nRef_mp = Simulink.Signal(StorageClass="ExportToFile", HeaderFile="RailP_VD_Signals.h", DefinitionFile="RailP_VD_Signals.c", DataType="ERPM", Min=0, Max=6000, Unit="rpm", InitialValue="0")  % Engine speed
RailP_numMax_mp = Simulink.Signal(StorageClass="ExportToFile", HeaderFile="RailP_VD_Signals.h", DefinitionFile="RailP_VD_Signals.c", DataType="uint8", Min=1, Max=20, Unit="NaN", InitialValue="1")  % Number of rail pressure max values
RailP_pFltWinNeg_CURX = Simulink.Parameter([0 1 1.5 2 2.5 3 3.5 4 4.5 5], StorageClass="ExportToFile", HeaderFile="RailP_VD_Paras.h", DefinitionFile="RailP_VD_Paras.c", DataType="InjMass", Min=-300, Max=300, Unit="mg/hub")  % InjCtl_qSetUnBal
RailP_pFltWinNeg_CUR = Simulink.Parameter([10 20 30 40 50 60 70 80 90 100], StorageClass="ExportToFile", HeaderFile="RailP_VD_Paras.h", DefinitionFile="RailP_VD_Paras.c", DataType="Press_bar1", Min=0, Max=2500, Unit="bar")  % Rail pressure decrease from which the system switches to the large signal parameter
RailP_pSubsCtlDlvMeUn_CUR = Simulink.Parameter(repmat(6, 1, 9), StorageClass="ExportToFile", HeaderFile="RailP_VD_Paras.h", DefinitionFile="RailP_VD_Paras.c", DataType="Press_bar1", Min=0, Max=2500, Unit="bar")  % Rail pressure for opened PRV and controlled delivery of MeUn
RailP_pSubsCtlDlvMeUn_CURX = Simulink.Parameter([0 30 60 90 120 150 180 210 240], StorageClass="ExportToFile", HeaderFile="RailP_VD_Paras.h", DefinitionFile="RailP_VD_Paras.c", DataType="vFlow_mm3ps", Min=-327680, Max=327670, Unit="mm^3/s")  % RailP_dvolSubsCtlDlvMeUn_mp
RailP_facFlt1PT1_C = Simulink.Parameter(50, StorageClass="ExportToFile", HeaderFile="RailP_VD_Paras.h", DefinitionFile="RailP_VD_Paras.c", DataType="Fac_100", Min=0, Max=99.9985, Unit="NaN")  % PT1 filter parameter for increasing rail pressure
RailP_facFlt2PT1_C = Simulink.Parameter(50, StorageClass="ExportToFile", HeaderFile="RailP_VD_Paras.h", DefinitionFile="RailP_VD_Paras.c", DataType="Fac_100", Min=0, Max=99.9985, Unit="NaN")  % PT1 filter parameter for decreasing rail pressure (small signal behaviour)
RailP_facFlt3PT1_C = Simulink.Parameter(50, StorageClass="ExportToFile", HeaderFile="RailP_VD_Paras.h", DefinitionFile="RailP_VD_Paras.c", DataType="Fac_100", Min=0, Max=99.9985, Unit="NaN")  % PT1 filter parameter for severely decreasing rail pressure (large signal behaviour)
RailP_numMax_CUR = Simulink.Parameter(repmat(1, 1, 10), StorageClass="ExportToFile", HeaderFile="RailP_VD_Paras.h", DefinitionFile="RailP_VD_Paras.c", DataType="uint8", Min=1, Max=20, Unit="NaN")  % Curve that delivers the number of rail pressure max values
RailP_numMax_CURX = Simulink.Parameter([600 800 1000 1200 1400 1600 1800 2000 2200 2400], StorageClass="ExportToFile", HeaderFile="RailP_VD_Paras.h", DefinitionFile="RailP_VD_Paras.c", DataType="ERPM", Min=0, Max=6000, Unit="rpm")  % Curve that delivers the number of rail pressure max values
RailP_nDiffMax_C = Simulink.Parameter(0, StorageClass="ExportToFile", HeaderFile="RailP_VD_Paras.h", DefinitionFile="RailP_VD_Paras.c", DataType="ERPM", Min=0, Max=50, Unit="rpm")  % Speed difference from that a new speed to the determination of the number of rail pressure max values is applied
RailP_swtFlt_C = Simulink.Parameter(1, StorageClass="ExportToFile", HeaderFile="RailP_VD_Paras.h", DefinitionFile="RailP_VD_Paras.c", DataType="boolean", Min=0, Max=1, Unit="NaN")  % Functioning of the peak rail pressure value determination