% Simulink data dictionary APP_ChkSig.sldd
% references slprj_cm.sldd
% references sl_ddtypes.sldd

APP_r = Simulink.Signal(StorageClass="ExportToFile", HeaderFile="APP_ChkSig_Signals.h", DefinitionFile="APP_ChkSig_Signals.c", DataType="Percent", Min=0, Max=100, Unit="%", InitialValue="0")  % Acceleration pedal sensor 1 value after fault handling
APP_rUnLim_mp = Simulink.Signal(StorageClass="ExportToFile", HeaderFile="APP_ChkSig_Signals.h", DefinitionFile="APP_ChkSig_Signals.c", DataType="Percent", Min=0, Max=100, Unit="%", InitialValue="0")  % APP value not limited by alive detection
APP_rPla_mp = Simulink.Signal(StorageClass="ExportToFile", HeaderFile="APP_ChkSig_Signals.h", DefinitionFile="APP_ChkSig_Signals.c", DataType="Percent", Min=0, Max=100, Unit="%", InitialValue="0")  % APP value after plausibility check with brake
APP_stAlive_mp = Simulink.Signal(StorageClass="ExportToFile", HeaderFile="APP_ChkSig_Signals.h", DefinitionFile="APP_ChkSig_Signals.c", DataType="boolean", Min=0, Max=1, Unit="NaN", InitialValue="0")  % State of APP alive detection of APP
APP_swtAliveDetEna_C = Simulink.Parameter(Switch.OFF, StorageClass="ExportToFile", HeaderFile="APP_ChkSig_Paras.h", DefinitionFile="APP_ChkSig_Paras.c", DataType="Enum: Switch", Unit="NaN")  % Switch to enable alive detection
APP_tiAliveDebLoHi_C = Simulink.Parameter(0, StorageClass="ExportToFile", HeaderFile="APP_ChkSig_Paras.h", DefinitionFile="APP_ChkSig_Paras.c", DataType="Debncd_ms", Min=0, Max=1000, Unit="ms")  % Debounce times for alive detection of APP / Time for a Low to High transition
APP_tiAliveDebHiLo_C = Simulink.Parameter(300, StorageClass="ExportToFile", HeaderFile="APP_ChkSig_Paras.h", DefinitionFile="APP_ChkSig_Paras.c", DataType="Debncd_ms", Min=0, Max=1000, Unit="ms")  % Debounce times for alive detection of APP / Time for a High to Low transition
APP_rThresAliveDet_C = Simulink.Parameter(20, StorageClass="ExportToFile", HeaderFile="APP_ChkSig_Paras.h", DefinitionFile="APP_ChkSig_Paras.c", DataType="Percent", Min=0, Max=100, Unit="%")  % APP threshold for alive detection
APP_drLimpMax_C = Simulink.Parameter(40, StorageClass="ExportToFile", HeaderFile="APP_ChkSig_Paras.h", DefinitionFile="APP_ChkSig_Paras.c", DataType="Percent_s", Min=-200, Max=200, Unit="%/s")  % Limit for APP gradient in limphome mode
APP_rLimpMax_C = Simulink.Parameter(0, StorageClass="ExportToFile", HeaderFile="APP_ChkSig_Paras.h", DefinitionFile="APP_ChkSig_Paras.c", DataType="Percent", Min=0, Max=100, Unit="%")  % Limit for APP value in limphome mode
APP_rPlaMaxVal_C = Simulink.Parameter(0, StorageClass="ExportToFile", HeaderFile="APP_ChkSig_Paras.h", DefinitionFile="APP_ChkSig_Paras.c", DataType="Percent", Min=0, Max=100, Unit="%")  % Maximum APP value when plausibility with brake failed
APP_drLimPos_C = Simulink.Parameter(10, StorageClass="ExportToFile", HeaderFile="APP_ChkSig_Paras.h", DefinitionFile="APP_ChkSig_Paras.c", DataType="Percent_s", Min=-200, Max=200, Unit="%/s")  % Ramp slope for substitutevalue in case of APP/Brake plausibilityerror / Slope if the ramp has to be increased
APP_drLimNeg_C = Simulink.Parameter(10, StorageClass="ExportToFile", HeaderFile="APP_ChkSig_Paras.h", DefinitionFile="APP_ChkSig_Paras.c", DataType="Percent_s", Min=-200, Max=200, Unit="%/s")  % Ramp slope for substitutevalue in case of APP/Brake plausibilityerror / negative ramp slope
APP_swtPlaChkEna_C = Simulink.Parameter(Switch.ON, StorageClass="ExportToFile", HeaderFile="APP_ChkSig_Paras.h", DefinitionFile="APP_ChkSig_Paras.c", DataType="Enum: Switch", Unit="NaN")  % Switch to enable plausibility check with brake
APP_rRmtAPPThresTrqDem_C = Simulink.Parameter(10, StorageClass="ExportToFile", HeaderFile="APP_ChkSig_Paras.h", DefinitionFile="APP_ChkSig_Paras.c", DataType="Percent", Min=-200, Max=200, Unit="%")  % Threshold for Remote accelerator pedal sensor value for resetting the HLSDem "Torque demand"
APP_stRmtAppTrqEN_C = Simulink.Parameter(0, StorageClass="ExportToFile", HeaderFile="APP_ChkSig_Paras.h", DefinitionFile="APP_ChkSig_Paras.c", DataType="boolean", Min=0, Max=1, Unit="NaN")  % Remote accelerator pedal Torque Request enable
APP_tiRmtAppEN_C = Simulink.Parameter(100, StorageClass="ExportToFile", HeaderFile="APP_ChkSig_Paras.h", DefinitionFile="APP_ChkSig_Paras.c", DataType="Debncd_ms", Min=0, Max=50000, Unit="ms")  % Remote accelerator pedal initial check delay time
APP_rRmtAPPThresTrqDemL_C = Simulink.Parameter(2, StorageClass="ExportToFile", HeaderFile="APP_ChkSig_Paras.h", DefinitionFile="APP_ChkSig_Paras.c", DataType="Percent", Min=0, Max=100, Unit="%")  % Low Threshold for Remote accelerator pedal hysteresis comparator
APP_rRmtAPPThresTrqDemH_C = Simulink.Parameter(3, StorageClass="ExportToFile", HeaderFile="APP_ChkSig_Paras.h", DefinitionFile="APP_ChkSig_Paras.c", DataType="Percent", Min=0, Max=100, Unit="%")  % High Threshold for Remote accelerator pedal hysteresis comparato