% Simulink data dictionary APP_DD1.sldd
% references slprj_cm.sldd
% references sl_ddtypes.sldd

APP_uRaw1 = Simulink.Signal(StorageClass="ExportToFile", HeaderFile="APP_DD1_Signals.h", DefinitionFile="APP_DD1_Signals.c", DataType="Volt_mV", Min=0, Max=5000, Unit="mv", InitialValue="0")  % Acceleration Pedal Position D
APP_bAPP1FinalDef = Simulink.Signal(StorageClass="ExportToFile", HeaderFile="APP_DD1_Signals.h", DefinitionFile="APP_DD1_Signals.c", DataType="boolean", Min=0, Max=1, Unit="NaN", InitialValue="0")  % Status Sensor 1 of the acceleration pedal finally defect
APP_bAPP1ProvDef = Simulink.Signal(StorageClass="ExportToFile", HeaderFile="APP_DD1_Signals.h", DefinitionFile="APP_DD1_Signals.c", DataType="boolean", Min=0, Max=1, Unit="NaN", InitialValue="0")  % Status Sensor 1 of the acceleration pedal temporary defect
APP_bSRCHigh1Deb_DSM = Simulink.Signal(StorageClass="ExportToFile", HeaderFile="APP_DD1_Signals.h", DefinitionFile="APP_DD1_Signals.c", DataType="boolean", Min=0, Max=1, Unit="NaN", InitialValue="0")  % Status debounced SRC-High error Sensor 1
APP_bSRCLow1Deb_DSM = Simulink.Signal(StorageClass="ExportToFile", HeaderFile="APP_DD1_Signals.h", DefinitionFile="APP_DD1_Signals.c", DataType="boolean", Min=0, Max=1, Unit="NaN", InitialValue="0")  % Status debounced SRC-Low error Sensor 1
APP_bSRCHigh1 = Simulink.Signal(StorageClass="ExportToFile", HeaderFile="APP_DD1_Signals.h", DefinitionFile="APP_DD1_Signals.c", DataType="boolean", Min=0, Max=1, Unit="NaN", InitialValue="0")  % Status temporary SRC-High error Sensor 1
APP_bSRCLow1 = Simulink.Signal(StorageClass="ExportToFile", HeaderFile="APP_DD1_Signals.h", DefinitionFile="APP_DD1_Signals.c", DataType="boolean", Min=0, Max=1, Unit="NaN", InitialValue="0")  % Status temporary SRC-Low error Sensor 1
APP_uRaw1SRCHigh_C = Simulink.Parameter(5000, StorageClass="ExportToFile", HeaderFile="APP_DD1_Paras.h", DefinitionFile="APP_DD1_Paras.c", DataType="Volt_mV", Min=0, Max=5000, Unit="mv")  % voltage upper threshold of channel 1
APP_uRaw1SRCLow_C = Simulink.Parameter(500, StorageClass="ExportToFile", HeaderFile="APP_DD1_Paras.h", DefinitionFile="APP_DD1_Paras.c", DataType="Volt_mV", Min=0, Max=5000, Unit="mv")  % voltage lower threshold of channel 1
APP_tiSRCHighDefDeb_C = Simulink.Parameter(100, StorageClass="ExportToFile", HeaderFile="APP_DD1_Paras.h", DefinitionFile="APP_DD1_Paras.c", DataType="Debncd_ms", Min=0, Max=1000, Unit="ms")  % debounce time
APP_tiSRCHighOKDeb_C = Simulink.Parameter(100, StorageClass="ExportToFile", HeaderFile="APP_DD1_Paras.h", DefinitionFile="APP_DD1_Paras.c", DataType="Debncd_ms", Min=0, Max=1000, Unit="ms")  % debounce time
APP_tiSRCLowDefDeb_C = Simulink.Parameter(100, StorageClass="ExportToFile", HeaderFile="APP_DD1_Paras.h", DefinitionFile="APP_DD1_Paras.c", DataType="Debncd_ms", Min=0, Max=1000, Unit="ms")  % debounce time
APP_tiSRCLowOKDeb_C = Simulink.Parameter(100, StorageClass="ExportToFile", HeaderFile="APP_DD1_Paras.h", DefinitionFile="APP_DD1_Paras.c", DataType="Debncd_ms", Min=0, Max=1000, Unit="ms")  % debounce time
APP_uRaw1Def_C = Simulink.Parameter(0, StorageClass="ExportToFile", HeaderFile="APP_DD1_Paras.h", DefinitionFile="APP_DD1_Paras.c", DataType="Volt_mV", Min=0, Max=5000, Unit="mv")  % Substitute value for sensor 1 defect