% Simulink data dictionary APP_VD.sldd
% references slprj_cm.sldd
% references sl_ddtypes.sldd

APP_uUnJit_mp = Simulink.Signal(StorageClass="ExportToFile", HeaderFile="APP_VD_Signals.h", DefinitionFile="APP_VD_Signals.c", DataType="Volt_mV", Min=0, Max=5000, Unit="mv", InitialValue="0")  % Acceleration pedal position unjittered value
APP_rLinAPP_mp = Simulink.Signal(StorageClass="ExportToFile", HeaderFile="APP_VD_Signals.h", DefinitionFile="APP_VD_Signals.c", DataType="Percent", Min=0, Max=100, Unit="%", InitialValue="0")  % Linearisation ratio of accelerator pedal
APP_drUnFlt = Simulink.Signal(StorageClass="ExportToFile", HeaderFile="APP_VD_Signals.h", DefinitionFile="APP_VD_Signals.c", DataType="Percent_s", Min=-200, Max=200, Unit="%/ms", InitialValue="0")  % Acceleration pedal position gradient of unfilterd value
APP_rUnFlt = Simulink.Signal(StorageClass="ExportToFile", HeaderFile="APP_VD_Signals.h", DefinitionFile="APP_VD_Signals.c", DataType="Percent", Min=0, Max=100, Unit="%", InitialValue="0")  % Unfiltered APP value
APP_rFlt_mp = Simulink.Signal(StorageClass="ExportToFile", HeaderFile="APP_VD_Signals.h", DefinitionFile="APP_VD_Signals.c", DataType="Percent", Min=0, Max=100, Unit="%", InitialValue="0")  % Acceleration pedal position filtered value
APP_rUnFlt_mp = Simulink.Signal(StorageClass="ExportToFile", HeaderFile="APP_VD_Signals.h", DefinitionFile="APP_VD_Signals.c", DataType="Percent", Min=0, Max=100, Unit="%", InitialValue="0")  % Unfiltered APP value
APP_facPT1 = Simulink.Signal(StorageClass="ExportToFile", HeaderFile="APP_VD_Signals.h", DefinitionFile="APP_VD_Signals.c", DataType="Fac_100", Min=0, Max=99.9985, Unit="NaN", InitialValue="0")  % Filter time
APP_uJitter_C = Simulink.Parameter(3, StorageClass="ExportToFile", HeaderFile="APP_VD_Paras.h", DefinitionFile="APP_VD_Paras.c", DataType="Volt_mV", Min=0, Max=5000, Unit="mv")  % Threshold for unjittering
APP_swtEnaUnJit_C = Simulink.Parameter(Switch.OFF, StorageClass="ExportToFile", HeaderFile="APP_VD_Paras.h", DefinitionFile="APP_VD_Paras.c", DataType="Enum: Switch", Unit="NaN")  % Switch to enable unjittering
MoFAPP_rLinAPPCURCalMsgA_CURX = Simulink.Parameter([1000 3390], StorageClass="ExportToFile", HeaderFile="APP_VD_Paras.h", DefinitionFile="APP_VD_Paras.c", DataType="Volt_mV", Min=0, Max=5000, Unit="mv")  % accpedal axis
MoFAPP_rLinAPPCURCalMsgA_CUR = Simulink.Parameter([0 100], StorageClass="ExportToFile", HeaderFile="APP_VD_Paras.h", DefinitionFile="APP_VD_Paras.c", DataType="Percent", Min=0, Max=100, Unit="%")  % the physical value of accpedal
APP_drLinRmp_C = Simulink.Parameter(5, StorageClass="ExportToFile", HeaderFile="APP_VD_Paras.h", DefinitionFile="APP_VD_Paras.c", DataType="Percent_s", Min=-200, Max=200, Unit="%/s")  % Permissible amount of accpedal value when vehicle quits limp mode
APP_rThrFltLowNeg_C = Simulink.Parameter(25, StorageClass="ExportToFile", HeaderFile="APP_VD_Paras.h", DefinitionFile="APP_VD_Paras.c", DataType="Percent", Min=0, Max=100, Unit="%")  % Threshold for low/mid-range Filter parameter falling signal
APP_rThrFltMidNeg_C = Simulink.Parameter(50, StorageClass="ExportToFile", HeaderFile="APP_VD_Paras.h", DefinitionFile="APP_VD_Paras.c", DataType="Percent", Min=0, Max=100, Unit="%")  % Threshold for mid/high-range Filter parameter falling signal
APP_rThrFltLowPos_C = Simulink.Parameter(25, StorageClass="ExportToFile", HeaderFile="APP_VD_Paras.h", DefinitionFile="APP_VD_Paras.c", DataType="Percent", Min=0, Max=100, Unit="%")  % Threshold for low/mid-range Filter parameter rising signal
APP_rThrFltMidPos_C = Simulink.Parameter(50, StorageClass="ExportToFile", HeaderFile="APP_VD_Paras.h", DefinitionFile="APP_VD_Paras.c", DataType="Percent", Min=0, Max=100, Unit="%")  % Threshold for mid/high-range Filter parameter rising signal
APP_facUppNegPT1_C = Simulink.Parameter(50, StorageClass="ExportToFile", HeaderFile="APP_VD_Paras.h", DefinitionFile="APP_VD_Paras.c", DataType="Fac_100", Min=0, Max=99.9985, Unit="NaN")  % Filter parameter falling signal high range
APP_facMidNegPT1_C = Simulink.Parameter(50, StorageClass="ExportToFile", HeaderFile="APP_VD_Paras.h", DefinitionFile="APP_VD_Paras.c", DataType="Fac_100", Min=0, Max=99.9985, Unit="NaN")  % Filter parameter falling signal mid range
APP_facLowNegPT1_C = Simulink.Parameter(50, StorageClass="ExportToFile", HeaderFile="APP_VD_Paras.h", DefinitionFile="APP_VD_Paras.c", DataType="Fac_100", Min=0, Max=99.9985, Unit="NaN")  % Filter parameter falling signal low range
APP_facUppPosPT1_C = Simulink.Parameter(50, StorageClass="ExportToFile", HeaderFile="APP_VD_Paras.h", DefinitionFile="APP_VD_Paras.c", DataType="Fac_100", Min=0, Max=99.9985, Unit="NaN")  % Filter parameter rising signal high range
APP_facMidPosPT1_C = Simulink.Parameter(50, StorageClass="ExportToFile", HeaderFile="APP_VD_Paras.h", DefinitionFile="APP_VD_Paras.c", DataType="Fac_100", Min=0, Max=99.9985, Unit="NaN")  % Filter parameter rising signal mid range
APP_facLowPosPT1_C = Simulink.Parameter(50, StorageClass="ExportToFile", HeaderFile="APP_VD_Paras.h", DefinitionFile="APP_VD_Paras.c", DataType="Fac_100", Min=0, Max=99.9985, Unit="NaN")  % Filter parameter rising signal low range
SigTst_rAPP_C = Simulink.Parameter(0, StorageClass="ExportToFile", HeaderFile="APP_VD_Paras.h", DefinitionFile="APP_VD_Paras.c", DataType="Percent", Min=0, Max=100, Unit="%")  % set the accpedal value
SigTst_swtAPP_C = Simulink.Parameter(Switch.OFF, StorageClass="ExportToFile", HeaderFile="APP_VD_Paras.h", DefinitionFile="APP_VD_Paras.c", DataType="Enum: Switch", Unit="NaN")  % Switch to set accpedal value
APP_swtEnaFlt_C = Simulink.Parameter(Switch.OFF, StorageClass="ExportToFile", HeaderFile="APP_VD_Paras.h", DefinitionFile="APP_VD_Paras.c", DataType="Enum: Switch", Unit="NaN")  % Switch to enable PT1