% Simulink data dictionary CoPT_TrqDesCoord.sldd
% references slprj_cm.sldd
% references sl_ddtypes.sldd

CoPT_trqDesClth = Simulink.Signal(StorageClass="ExportToFile", HeaderFile="CoPT_TrqDesCoord_Signals.h", DefinitionFile="CoPT_TrqDesCoord_Signals.c", DataType="Torq", Min=-3000, Max=3000, Unit="Nm", InitialValue="0")  % Desired Clutch Torque
CoPT_trqDes = Simulink.Signal(StorageClass="ExportToFile", HeaderFile="CoPT_TrqDesCoord_Signals.h", DefinitionFile="CoPT_TrqDesCoord_Signals.c", DataType="Torq", Min=-3000, Max=3000, Unit="Nm", InitialValue="0")  % Total torque order for torque actuator (clutch torque)
PT_stTraIntv = Simulink.Signal(StorageClass="ExportToFile", HeaderFile="CoPT_TrqDesCoord_Signals.h", DefinitionFile="CoPT_TrqDesCoord_Signals.c", DataType="State", Min=0, Max=255, Unit="NaN", InitialValue="0")  % Status of torque access gearbox interventions
CoPT_trqPTPrt = Simulink.Signal(StorageClass="ExportToFile", HeaderFile="CoPT_TrqDesCoord_Signals.h", DefinitionFile="CoPT_TrqDesCoord_Signals.c", DataType="Torq", Min=-3000, Max=3000, Unit="Nm", InitialValue="0")  % Drive train protection torque (clutch torque)
CoPT_trqDesDecMin_mp = Simulink.Signal(StorageClass="ExportToFile", HeaderFile="CoPT_TrqDesCoord_Signals.h", DefinitionFile="CoPT_TrqDesCoord_Signals.c", DataType="Torq", Min=-3000, Max=3000, Unit="Nm", InitialValue="0")  % Torque request after decreasing transmission intervention
CoPT_trqDesIncMax_mp = Simulink.Signal(StorageClass="ExportToFile", HeaderFile="CoPT_TrqDesCoord_Signals.h", DefinitionFile="CoPT_TrqDesCoord_Signals.c", DataType="Torq", Min=-3000, Max=3000, Unit="Nm", InitialValue="0")  % Torque request after increasing transmission intervention
PTPRTOVRDSSPDGOV_SY = fi(0, 1, 32, 0)
PTPRT_OVRDS_SPDGOV = fi(1, 1, 32, 0)
DFFTLPRTOVRDSTSCINC_SY = fi(1, 1, 32, 0)
DFFTLPRT_OVRDS_TSCINC = fi(1, 1, 32, 0)
DCSOVRDSENGPRT_SY = fi(1, 1, 32, 0)
DCS_OVRDS_ENGPRT = fi(1, 1, 32, 0)