% Simulink data dictionary PTODi_TrqDesCoord.sldd
% references slprj_cm.sldd
% references sl_ddtypes.sldd

PT_trqCrSPTPrt = Simulink.Signal(StorageClass="ExportToFile", HeaderFile="PTODi_TrqDesCoord_Signals.h", DefinitionFile="PTODi_TrqDesCoord_Signals.c", DataType="Torq", Min=-3000, Max=3000, Unit="Nm", InitialValue="0")  % Application parameter for powertrain protection train protection torque(crankshaft torque)
PT_trqCrSDes = Simulink.Signal(StorageClass="ExportToFile", HeaderFile="PTODi_TrqDesCoord_Signals.h", DefinitionFile="PTODi_TrqDesCoord_Signals.c", DataType="Torq", Min=-3000, Max=3000, Unit="Nm", InitialValue="0")  % Application parameter for requested propulsion torque to engine(crankshaft torque)
CoPT_facDesDyn = Simulink.Signal(StorageClass="ExportToFile", HeaderFile="PTODi_TrqDesCoord_Signals.h", DefinitionFile="PTODi_TrqDesCoord_Signals.c", DataType="Fac_10", Min=-30, Max=30, Unit="NaN", InitialValue="0")  % Dynamics Fac_10 of vehicle located requestors
PT_trqCrSDCS = Simulink.Signal(StorageClass="ExportToFile", HeaderFile="PTODi_TrqDesCoord_Signals.h", DefinitionFile="PTODi_TrqDesCoord_Signals.c", DataType="Torq", Min=-3000, Max=3000, Unit="Nm", InitialValue="0")  % crankshaft torque for request decrcment
PT_trqCrSDCS_C = Simulink.Parameter(0, StorageClass="ExportToFile", HeaderFile="PTODi_TrqDesCoord_Paras.h", DefinitionFile="PTODi_TrqDesCoord_Paras.c", DataType="Torq", Min=-3000, Max=3000, Unit="Nm")  % crankshaft torque for request decrcment