% Simulink data dictionary CoVeh_TrqDesCoord.sldd
% references slprj_cm.sldd
% references sl_ddtypes.sldd

CoVeh_trqDes = Simulink.Signal(StorageClass="ExportToFile", HeaderFile="CoVeh_TrqDesCoord_Signals.h", DefinitionFile="CoVeh_TrqDesCoord_Signals.c", DataType="Torq", Min=-3000, Max=3000, Unit="Nm", InitialValue="0")  % Setpoint torque order to the drive train (gearbox output torque)