% Simulink data dictionary AccPed_DrvDemDes.sldd
% references slprj_cm.sldd
% references sl_ddtypes.sldd
% references sl_const.sldd

AccPed_trqDesAct = Simulink.Signal(StorageClass="ExportToFile", HeaderFile="AccPed_DrvDemDes_Signals.h", DefinitionFile="AccPed_DrvDemDes_Signals.c", DataType="Torq", Min=-3000, Max=3000, Unit="Nm", InitialValue="0")  % driver torque raw of propulsion
VehMot_stPrpAccPed = Simulink.Signal(StorageClass="ExportToFile", HeaderFile="AccPed_DrvDemDes_Signals.h", DefinitionFile="AccPed_DrvDemDes_Signals.c", DataType="boolean", Min=0, Max=1, Unit="NaN", InitialValue="0")  % Status of propulsion demand by driver demand
AccPed_trqComp = Simulink.Signal(StorageClass="ExportToFile", HeaderFile="AccPed_DrvDemDes_Signals.h", DefinitionFile="AccPed_DrvDemDes_Signals.c", DataType="Torq", Min=-3000, Max=3000, Unit="Nm", InitialValue="0")  % Compensation torque of accelerator pedal
AccPed_stBrkDes_mp = Simulink.Signal(StorageClass="ExportToFile", HeaderFile="AccPed_DrvDemDes_Signals.h", DefinitionFile="AccPed_DrvDemDes_Signals.c", DataType="State", Min=0, Max=255, Unit="NaN", InitialValue="0")  % raw engine brake request before prioritisation
AccPed_trqDifBrk_mp = Simulink.Signal(StorageClass="ExportToFile", HeaderFile="AccPed_DrvDemDes_Signals.h", DefinitionFile="AccPed_DrvDemDes_Signals.c", DataType="Torq", Min=-3000, Max=3000, Unit="Nm", InitialValue="0")  % completely possible engine brake torque Nm
AccPed_rBrk50_mp = Simulink.Signal(StorageClass="ExportToFile", HeaderFile="AccPed_DrvDemDes_Signals.h", DefinitionFile="AccPed_DrvDemDes_Signals.c", DataType="Percent", Min=0, Max=100, Unit="%", InitialValue="50")  % percentage of engine brake torque
AccPed_trqDesPull = Simulink.Signal(StorageClass="ExportToFile", HeaderFile="AccPed_DrvDemDes_Signals.h", DefinitionFile="AccPed_DrvDemDes_Signals.c", DataType="Torq", Min=-3000, Max=3000, Unit="Nm", InitialValue="0")  % Application parameter for driver demand in pull mode for desired value
AccPed_trqDesOvrRun_mp = Simulink.Signal(StorageClass="ExportToFile", HeaderFile="AccPed_DrvDemDes_Signals.h", DefinitionFile="AccPed_DrvDemDes_Signals.c", DataType="Torq", Min=-3000, Max=3000, Unit="Nm", InitialValue="0")  % Driver command torque overrun part setpoint path
AccPed_trqDesBefComp_mp = Simulink.Signal(StorageClass="ExportToFile", HeaderFile="AccPed_DrvDemDes_Signals.h", DefinitionFile="AccPed_DrvDemDes_Signals.c", DataType="Torq", Min=-3000, Max=3000, Unit="Nm", InitialValue="0")  % Driver demand torque before compensation
AccPed_trqDesComp_mp = Simulink.Signal(StorageClass="ExportToFile", HeaderFile="AccPed_DrvDemDes_Signals.h", DefinitionFile="AccPed_DrvDemDes_Signals.c", DataType="Torq", Min=-3000, Max=3000, Unit="Nm", InitialValue="0")  % driver demand without limit Nm
MoFDrDem_trqEngRev_MAPX = Simulink.Parameter([0 500 1000 1500 2000 2500 3000 3500 4000 4500 5000 5100 5200 5300 5400 5500], StorageClass="ExportToFile", HeaderFile="AccPed_DrvDemDes_Paras.h", DefinitionFile="AccPed_DrvDemDes_Paras.c", DataType="ERPM", Min=0, Max=6000, Unit="rpm")  % Average engine speed of one cylinder segment
MoFDrDem_trqEngRev_MAPY = Simulink.Parameter([0 10 20 30 40 50 60 70 80 90 100 101 102 103 104 105], StorageClass="ExportToFile", HeaderFile="AccPed_DrvDemDes_Paras.h", DefinitionFile="AccPed_DrvDemDes_Paras.c", DataType="Percent", Min=0, Max=120, Unit="%")  % Standardized accelerator pedal position

MoFDrDem_trqEngRev_MAP = Simulink.Parameter([0 0 0 0 0 0 0 0 0 0 0 0 0 0 0 0
 10 15 20 25 30 35 40 45 50 55 60 60 60 60 60 60
 20 25 30 35 40 45 50 55 60 65 70 70 70 70 70 70
 30 35 40 45 50 55 60 65 70 75 80 80 80 80 80 80
 40 45 50 55 60 65 70 75 80 85 90 90 90 90 90 90
 50 55 60 65 70 75 80 85 90 95 100 100 100 100 100 100
 60 65 70 75 80 85 90 95 100 105 110 110 110 110 110 110
 70 75 80 85 90 95 100 105 110 115 120 120 120 120 120 120
 80 85 90 95 100 105 110 115 120 125 130 130 130 130 130 130
 90 95 100 105 110 115 120 125 130 135 140 140 140 140 140 140
 100 105 110 115 120 125 130 135 140 145 150 150 150 150 150 150
 100 105 110 115 120 125 130 135 140 145 150 150 150 150 150 150
 100 105 110 115 120 125 130 135 140 145 150 150 150 150 150 150
 100 105 110 115 120 125 130 135 140 145 150 150 150 150 150 150
 100 105 110 115 120 125 130 135 140 145 150 150 150 150 150 150
 100 105 110 115 120 125 130 135 140 145 150 150 150 150 150 150], StorageClass="ExportToFile", HeaderFile="AccPed_DrvDemDes_Paras.h", DefinitionFile="AccPed_DrvDemDes_Paras.c", DataType="Torq", Min=-3000, Max=3000, Unit="Nm")  % inner torque for engaged reverse gear calculated from the accelerator pedal angle and the engine speed

MoFDrDem_trqEng_MAPX = Simulink.Parameter([600 800 1000 1200 1400 1600 1700 1800 1900 2000 2200 2400 2600 2800 3000 3200], StorageClass="ExportToFile", HeaderFile="AccPed_DrvDemDes_Paras.h", DefinitionFile="AccPed_DrvDemDes_Paras.c", DataType="ERPM", Min=0, Max=6000, Unit="rpm")  % Average engine speed of one cylinder segment
MoFDrDem_trqEng_MAPY = Simulink.Parameter([0 5 10 15 20 25 30 40 50 60 70 80 85 90 95 100], StorageClass="ExportToFile", HeaderFile="AccPed_DrvDemDes_Paras.h", DefinitionFile="AccPed_DrvDemDes_Paras.c", DataType="Percent", Min=0, Max=120, Unit="%")  % Standardized accelerator pedal position

MoFDrDem_trqEng_MAP = Simulink.Parameter([0 0 0 0 0 0 0 0 0 0 0 0 0 0 0 0
 17.5 7.4 0.8 0.8 0 0 0 0 0 0 0 0 0 0 0 0
 36.5 19.8 9.3 1.6 0 0 0 0 0 0 0 0 0 0 0 0
 58.9 37.8 23.5 14.7 4.5 0 0 0 0 0 0 0 0 0 0 0
 85.6 62.5 45.9 30.5 17.9 11.4 6.9 0 0 0 0 0 0 0 0 0
 117.4 94.5 77.6 60.4 44.2 35 25 14.4 4.5 4.5 0 0 0 0 0 0
 147.9 125 108.2 91.6 73.8 60.9 49.9 36.4 27 19 8.5 2.3 0 0 0 0
 187 165.6 148.1 129.8 111 98.1 87.7 70.8 54.8 44.3 23.8 6.6 0 0 0 0
 215.3 201.1 188.9 173.5 160.3 147.6 134.7 123.5 104.8 89.9 62.1 32.9 15.5 4.3 1.2 0
 226.2 222.2 216.3 207.4 196 188.9 181.4 170.1 158.1 141.6 112.7 82 56.4 35.4 19.5 0
 237 236.1 236.1 236.1 229.8 226.2 221.2 209.4 203.6 192.2 168.2 139.5 114.3 86.8 58 0
 244 244 244.9 244 244 243.2 243.2 238.4 231.6 228.2 209.7 184 160.8 133.9 89 0
 255.8 255.8 256.4 255.8 255.8 255.2 255.2 251.6 246.3 243.8 228.4 206.8 186.8 163.3 112 0
 267.6 267.6 268 267.6 267.6 267.2 267.2 264.8 261.1 259.4 247.2 229.7 212.9 192.8 135.1 0
 279.3 279.3 279.5 279.3 279.3 279.1 279.1 277.9 275.8 275 265.9 252.4 238.9 222.2 158.1 0
 291.1 291.1 291.1 291.1 291.1 291.1 291.1 291.1 290.6 290.6 284.7 275.3 265 251.7 181.2 0], StorageClass="ExportToFile", HeaderFile="AccPed_DrvDemDes_Paras.h", DefinitionFile="AccPed_DrvDemDes_Paras.c", DataType="Torq", Min=-3000, Max=3000, Unit="Nm")  % inner torque for disengaged reverse gear calculated from the accelerator pedal angle and the engine speed

AccPed_trqPrp_MAPX = Simulink.Parameter([0 25 50 75 100 125 150 175 200 225 250 251 252 253 254 255], StorageClass="ExportToFile", HeaderFile="AccPed_DrvDemDes_Paras.h", DefinitionFile="AccPed_DrvDemDes_Paras.c", DataType="V_kmph", Min=0, Max=255, Unit="km/h")  % Longitudinal vehicle speed (X-direction)
AccPed_trqPrp_MAPY = Simulink.Parameter([0 10 20 30 40 50 60 70 80 90 100 101 102 103 104 105], StorageClass="ExportToFile", HeaderFile="AccPed_DrvDemDes_Paras.h", DefinitionFile="AccPed_DrvDemDes_Paras.c", DataType="Percent", Min=0, Max=120, Unit="%")  % Standardized accelerator pedal position

AccPed_trqPrp_MAP = Simulink.Parameter([0 10 20 30 40 50 60 70 80 90 100 100 100 100 100 100
 0 15 25 35 45 55 65 75 85 95 105 105 105 105 105 105
 0 20 30 40 50 60 70 80 90 100 110 110 110 110 110 110
 0 25 35 45 55 65 75 85 95 105 115 115 115 115 115 115
 0 30 40 50 60 70 80 90 100 110 120 120 120 120 120 120
 0 35 45 55 65 75 85 95 105 115 125 125 125 125 125 125
 0 40 50 60 70 80 90 100 110 120 130 130 130 130 130 130
 0 45 55 65 75 85 95 105 115 125 135 135 135 135 135 135
 0 50 60 70 80 90 100 110 120 130 140 140 140 140 140 140
 0 55 65 75 85 95 105 115 125 135 145 145 145 145 145 145
 0 60 70 80 90 100 110 120 130 140 150 150 150 150 150 150
 0 60 70 80 90 100 110 120 130 140 150 150 150 150 150 150
 0 60 70 80 90 100 110 120 130 140 150 150 150 150 150 150
 0 60 70 80 90 100 110 120 130 140 150 150 150 150 150 150
 0 60 70 80 90 100 110 120 130 140 150 150 150 150 150 150
 0 60 70 80 90 100 110 120 130 140 150 150 150 150 150 150], StorageClass="ExportToFile", HeaderFile="AccPed_DrvDemDes_Paras.h", DefinitionFile="AccPed_DrvDemDes_Paras.c", DataType="Torq", Min=-3000, Max=3000, Unit="Nm")  % inner torque in mastershift operation calculated from the accelerator pedal angle and the vehicle speed

AccPed_facCompTot_C = Simulink.Parameter(0, StorageClass="ExportToFile", HeaderFile="AccPed_DrvDemDes_Paras.h", DefinitionFile="AccPed_DrvDemDes_Paras.c", DataType="Fac10", Min=-10, Max=10, Unit="NaN")  % Fac10 for complete compensation (cutoff ramp)
AccPed_trqDemThres_C = Simulink.Parameter(1, StorageClass="ExportToFile", HeaderFile="AccPed_DrvDemDes_Paras.h", DefinitionFile="AccPed_DrvDemDes_Paras.c", DataType="Torq", Min=-3000, Max=3000, Unit="Nm")  % Threshold value of driver demand torque for status driver demand active
AccPed_swtBrkPrio_C = Simulink.Parameter(0, StorageClass="ExportToFile", HeaderFile="AccPed_DrvDemDes_Paras.h", DefinitionFile="AccPed_DrvDemDes_Paras.c", DataType="State", Min=0, Max=255, Unit="NaN")  % AccPed/EngBrk priority: (0:EngBrk wins, 1: pressed AccPed wins, >=2 last changed wins)
AccPed_rBrk50_CURX = Simulink.Parameter([0 800 1000 1200 1400 1600 1800 2000 2500 3000 3500 4000 4500 5000 5500 6000], StorageClass="ExportToFile", HeaderFile="AccPed_DrvDemDes_Paras.h", DefinitionFile="AccPed_DrvDemDes_Paras.c", DataType="ERPM", Min=0, Max=6000, Unit="rpm")  % Average engine speed of one cylinder segment
AccPed_rBrk50_CUR = Simulink.Parameter(repmat(50, 1, 16), StorageClass="ExportToFile", HeaderFile="AccPed_DrvDemDes_Paras.h", DefinitionFile="AccPed_DrvDemDes_Paras.c", DataType="Percent", Min=0, Max=120, Unit="%")  % percentage of engine brake torque
SigTst_swtAccPed_C = Simulink.Parameter(Switch.OFF, StorageClass="ExportToFile", HeaderFile="AccPed_DrvDemDes_Paras.h", DefinitionFile="AccPed_DrvDemDes_Paras.c", DataType="Enum: Switch", Unit="NaN")  % switch of torque under test
SigTst_trqAccPed_C = Simulink.Parameter(0, StorageClass="ExportToFile", HeaderFile="AccPed_DrvDemDes_Paras.h", DefinitionFile="AccPed_DrvDemDes_Paras.c", DataType="Torq", Min=-3000, Max=3000, Unit="Nm")  % torque under test
AccPed_rZero_C = Simulink.Parameter(0, StorageClass="ExportToFile", HeaderFile="AccPed_DrvDemDes_Paras.h", DefinitionFile="AccPed_DrvDemDes_Paras.c", DataType="Percent", Min=0, Max=100, Unit="%")  % ratio of APP, below which the resulting fuel quantity should be zero
AccPed_rThresPrp_C = Simulink.Parameter(100, StorageClass="ExportToFile", HeaderFile="AccPed_DrvDemDes_Paras.h", DefinitionFile="AccPed_DrvDemDes_Paras.c", DataType="Percent", Min=0, Max=100, Unit="%")  % Threshold between overrun and propulsion
ACCPED_REVGEARMAP_SY = fi(1, 0, 8, 0)
MSTSHFT_SY = fi(0, 0, 8, 0)
ACCPED_OVRRUNRMP_SY = fi(1, 0, 8, 0)
TRQPRPHIGH_ZERO = fi(0, 1, 16, 0)
FACT_ONE = fi(1, 1, 16, 0)