% Simulink data dictionary T15_DD.sldd
% references slprj_cm.sldd
% references sl_ddtypes.sldd

T15_st = Simulink.Signal(StorageClass="ExportToFile", HeaderFile="T15_DD_Signals.h", DefinitionFile="T15_DD_Signals.c", DataType="Enum:Switch", Unit="NaN", InitialValue="Switch.OFF")  % Terminal 15 status after debouncing
T15_stRaw = Simulink.Signal(StorageClass="ExportToFile", HeaderFile="T15_DD_Signals.h", DefinitionFile="T15_DD_Signals.c", DataType="boolean", Unit="NaN", InitialValue="0")  % Raw value of Terminal 15 status
T15_tiDebLoHi_C = Simulink.Parameter(10, StorageClass="ExportToFile", HeaderFile="T15_DD_Paras.h", DefinitionFile="T15_DD_Paras.c", DataType="Debncd_ms", Min=0, Max=6500, Unit="ms")  % Debounce time terminal15-signal from high to low
T15_tiDebHiLo_C = Simulink.Parameter(10, StorageClass="ExportToFile", HeaderFile="T15_DD_Paras.h", DefinitionFile="T15_DD_Paras.c", DataType="Debncd_ms", Min=0, Max=6500, Unit="ms")  % Debounce time terminal15-signal from low to high
T15_uThreshold_C = Simulink.Parameter(800, StorageClass="ExportToFile", HeaderFile="T15_DD_Paras.h", DefinitionFile="T15_DD_Paras.c", DataType="Volt_mV", Min=0, Max=5000, Unit="mv")  % T15 voltage threshold