% Simulink data dictionary CoVM_TrqDesCoord.sldd
% references slprj_cm.sldd
% references sl_ddtypes.sldd

CoVM_trqDes = Simulink.Signal(StorageClass="ExportToFile", HeaderFile="CoVM_TrqDesCoord_Signals.h", DefinitionFile="CoVM_TrqDesCoord_Signals.c", DataType="Torq", Min=-3000, Max=3000, Unit="Nm", InitialValue="0")  % Propulsion torque order after ESP-torque intervention coordination (wheel torque)