% Simulink data dictionary Prp_TrqDesCoord.sldd
% references slprj_cm.sldd
% references sl_ddtypes.sldd

VehMot_trqDes = Simulink.Signal(StorageClass="ExportToFile", HeaderFile="Prp_TrqDesCoord_Signals.h", DefinitionFile="Prp_TrqDesCoord_Signals.c", DataType="Torq", Min=-3000, Max=3000, Unit="Nm", InitialValue="0")  % Desired torque for propulsion (transmission output torque)
VehMot_stLimDfftl = Simulink.Signal(StorageClass="ExportToFile", HeaderFile="Prp_TrqDesCoord_Signals.h", DefinitionFile="Prp_TrqDesCoord_Signals.c", DataType="State", Min=0, Max=255, Unit="NaN", InitialValue="0")  % Status torque intervention differential protection
Prp_trqDes_mp = Simulink.Signal(StorageClass="ExportToFile", HeaderFile="Prp_TrqDesCoord_Signals.h", DefinitionFile="Prp_TrqDesCoord_Signals.c", DataType="Torq", Min=-3000, Max=3000, Unit="Nm", InitialValue="0")  % Set point torque with stability interventions on transmission output torque level