% Simulink data dictionary AccPed_DrvDemStpLim.sldd
% references slprj_cm.sldd
% references sl_ddtypes.sldd

AccPed_stPTSLEna = Simulink.Signal(StorageClass="ExportToFile", HeaderFile="AccPed_DrvDemStpLim_Signals.h", DefinitionFile="AccPed_DrvDemStpLim_Signals.c", DataType="boolean", Min=0, Max=1, Unit="NaN", InitialValue="0")  % Enable status of the propulsion torque step limitation
AccPed_trqDes = Simulink.Signal(StorageClass="ExportToFile", HeaderFile="AccPed_DrvDemStpLim_Signals.h", DefinitionFile="AccPed_DrvDemStpLim_Signals.c", DataType="Torq", Min=-3000, Max=3000, Unit="Nm", InitialValue="0")  % Driver torque value of propulsion after step limitation
Epm_dnEng = Simulink.Signal(StorageClass="ExportToFile", HeaderFile="AccPed_DrvDemStpLim_Signals.h", DefinitionFile="AccPed_DrvDemStpLim_Signals.c", DataType="ERPM_s", Min=-12000, Max=12000, Unit="rpm/s", InitialValue="0")  % Engine speed gradient calculated over current crankshaft-segment (S0-S0 or S1-S1)
AccPed_dtrqUpLim_mp = Simulink.Signal(StorageClass="ExportToFile", HeaderFile="AccPed_DrvDemStpLim_Signals.h", DefinitionFile="AccPed_DrvDemStpLim_Signals.c", DataType="Torq_s", Min=-3000, Max=3000, Unit="Nm/s", InitialValue="0")  % Torque step limitation for rising ramp from the map AccPed_dtrqUpLim_MAP
AccPed_trqSumUpLimDes_mp = Simulink.Signal(StorageClass="ExportToFile", HeaderFile="AccPed_DrvDemStpLim_Signals.h", DefinitionFile="AccPed_DrvDemStpLim_Signals.c", DataType="Torq", Min=-3000, Max=3000, Unit="Nm", InitialValue="0")  % measuring point for AccPed_trqDes + AccPed_dtrqUpLim_mp*DT
AccPed_dtrqDwnLim_mp = Simulink.Signal(StorageClass="ExportToFile", HeaderFile="AccPed_DrvDemStpLim_Signals.h", DefinitionFile="AccPed_DrvDemStpLim_Signals.c", DataType="Torq_s", Min=-3000, Max=3000, Unit="Nm/s", InitialValue="0")  % Torque step limitation for falling ramp from the MAP AccPed_dtrqDwnLim_MAP
AccPed_trqSumDwnLimDes_mp = Simulink.Signal(StorageClass="ExportToFile", HeaderFile="AccPed_DrvDemStpLim_Signals.h", DefinitionFile="AccPed_DrvDemStpLim_Signals.c", DataType="Torq", Min=-3000, Max=3000, Unit="Nm", InitialValue="0")  % measuring point for AccPed_trqDes + AccPed_dtrqDwnLim_mp*DT
AccPed_dtrqUpLim_MAPX = Simulink.Parameter([-3200 -2800 -2400 -2000 -1600 -1200 -800 -400 -200 -100 -50 50 100 200 400 800 1200 1600 2000 2400 2800 3200], StorageClass="ExportToFile", HeaderFile="AccPed_DrvDemStpLim_Paras.h", DefinitionFile="AccPed_DrvDemStpLim_Paras.c", DataType="Torq", Min=-3200, Max=3200, Unit="Nm")  % Previous raster of Accped_trqDes
AccPed_dtrqUpLim_MAPY = Simulink.Parameter([0 1 2 3 4 5 6 7 8 9 10 11 12 13 14 15 16 17 18], StorageClass="ExportToFile", HeaderFile="AccPed_DrvDemStpLim_Paras.h", DefinitionFile="AccPed_DrvDemStpLim_Paras.c", DataType="TraGear", Min=0, Max=200, Unit="NaN")  % Current gear information
AccPed_dtrqUpLim_MAP = Simulink.Parameter(repmat(0, 19, 22), StorageClass="ExportToFile", HeaderFile="AccPed_DrvDemStpLim_Paras.h", DefinitionFile="AccPed_DrvDemStpLim_Paras.c", DataType="Torq_s", Min=-3000, Max=3000, Unit="Nm/s")  % Torque step limitation for rising ramp from the map AccPed_dtrqUpLim_MAP
AccPed_dnMaxRmp_C = Simulink.Parameter(0, StorageClass="ExportToFile", HeaderFile="AccPed_DrvDemStpLim_Paras.h", DefinitionFile="AccPed_DrvDemStpLim_Paras.c", DataType="ERPM_s", Min=-12000, Max=12000, Unit="rpm/s")  % Maximum allowed threshold for engine speed acceleration
AccPed_nMaxRmp_C = Simulink.Parameter(0, StorageClass="ExportToFile", HeaderFile="AccPed_DrvDemStpLim_Paras.h", DefinitionFile="AccPed_DrvDemStpLim_Paras.c", DataType="ERPM", Min=0, Max=6000, Unit="rpm")  % The downward torque step limitation is switched off above this speed.
AccPed_dtrqDwnLim_MAPX = Simulink.Parameter([-3200 -2800 -2400 -2000 -1600 -1200 -800 -400 -200 -100 -50 50 100 200 400 800 1200 1600 2000 2400 2800 3200], StorageClass="ExportToFile", HeaderFile="AccPed_DrvDemStpLim_Paras.h", DefinitionFile="AccPed_DrvDemStpLim_Paras.c", DataType="Torq", Min=-3200, Max=3200, Unit="Nm")  % Previous raster of Accped_trqDes
AccPed_dtrqDwnLim_MAPY = Simulink.Parameter([0 1 2 3 4 5 6 7 8 9 10 11 12 13 14 15 16 17 18], StorageClass="ExportToFile", HeaderFile="AccPed_DrvDemStpLim_Paras.h", DefinitionFile="AccPed_DrvDemStpLim_Paras.c", DataType="TraGear", Min=0, Max=200, Unit="NaN")  % Current gear information
AccPed_dtrqDwnLim_MAP = Simulink.Parameter(repmat(0, 19, 22), StorageClass="ExportToFile", HeaderFile="AccPed_DrvDemStpLim_Paras.h", DefinitionFile="AccPed_DrvDemStpLim_Paras.c", DataType="Torq_s", Min=-3000, Max=3000, Unit="Nm/s")  % Torque step limitation for falling ramp from the MAP AccPed_dtrqDwnLim_MAP
AccPed_swtStpLim_C = Simulink.Parameter(Switch.ON, StorageClass="ExportToFile", HeaderFile="AccPed_DrvDemStpLim_Paras.h", DefinitionFile="AccPed_DrvDemStpLim_Paras.c", DataType="Enum: Switch", Unit="NaN")  % Switch to select propulsion torque step limitation-(1 -Select, 0 -deselect)

TRQ_ZERO = embedded.fi(
  DataType="Fixed",
  Scaling="SlopeBias",
  Signed=true,
  WordLength=16,
  FixedExponent=-4,
  SlopeAdjustmentFactor=1.6,
  intarray=int16(0),
  noverflows=0,
  nunderflows=0,
  maxlog=-Inf,
  minlog=Inf,
  RoundingMethod="Nearest",
  OverflowAction="Saturate",
  ProductMode="FullPrecision",
  SumMode="FullPrecision",
  ProductWordLength=32,
  SumWordLength=32,
  MaxProductWordLength=65535,
  MaxSumWordLength=65535,
  ProductFractionLength=30,
  ProductFixedExponent=-30,
  ProductSlope=9.313226e-10,
  ProductSlopeAdjustmentFactor=1,
  ProductBias=0,
  SumFractionLength=30,
  SumFixedExponent=-30,
  SumSlope=9.313226e-10,
  SumSlopeAdjustmentFactor=1,
  SumBias=0,
  CastBeforeSum=true,
  DDGMaxProductWordLength=65535,
  DDGMaxSumWordLength=65535,
  DDGProductFixedExponent=-30,
  DDGProductFractionLength=30,
  DDGProductWordLength=32,
  DDGSumFixedExponent=-30,
  DDGSumFractionLength=30,
  DDGSumWordLength=32,
  DDGCastBeforeSum=true,
  DDGProductBias=0,
  DDGProductSlopeAdjustmentFactor=1,
  DDGSumBias=0,
  DDGSumSlopeAdjustmentFactor=1,
  DDGProductSlope=9.313226e-10,
  DDGSumSlope=9.313226e-10,
  Logging=false,
  fimathislocal=false)