% Simulink data dictionary CoVMD_TrqDesCoord.sldd
% references slprj_cm.sldd
% references sl_ddtypes.sldd

VMD_swtTrqSel = Simulink.Signal(StorageClass="ExportToFile", HeaderFile="CoVMD_TrqDesCoord_Signals.h", DefinitionFile="CoVMD_TrqDesCoord_Signals.c", DataType="State", Min=0, Max=255, Unit="NaN", InitialValue="1")  % Driver demand - Cruise control torque selection switch
VMD_swtVCMActv = Simulink.Signal(StorageClass="ExportToFile", HeaderFile="CoVMD_TrqDesCoord_Signals.h", DefinitionFile="CoVMD_TrqDesCoord_Signals.c", DataType="Enum:Switch", Unit="NaN", InitialValue="Switch.OFF")  % Application parameter which Indicates whether Vehicle Control Mode(VCM) is enabled or disabled
VMD_stBrkDes = Simulink.Signal(StorageClass="ExportToFile", HeaderFile="CoVMD_TrqDesCoord_Signals.h", DefinitionFile="CoVMD_TrqDesCoord_Signals.c", DataType="State2", Min=0, Max=65535, Unit="NaN", InitialValue="0")  % Application parameter for torque status information
VMD_trqDesUnLim = Simulink.Signal(StorageClass="ExportToFile", HeaderFile="CoVMD_TrqDesCoord_Signals.h", DefinitionFile="CoVMD_TrqDesCoord_Signals.c", DataType="Torq", Min=-3000, Max=3000, Unit="Nm", InitialValue="0")  % Desired torque in front of top speed limitation Nm
VMD_trqDesRaw = Simulink.Signal(StorageClass="ExportToFile", HeaderFile="CoVMD_TrqDesCoord_Signals.h", DefinitionFile="CoVMD_TrqDesCoord_Signals.c", DataType="Torq", Min=-3000, Max=3000, Unit="Nm", InitialValue="0")  % Raw value of propulsion torque demand.
VMD_trqDesIn = Simulink.Signal(StorageClass="ExportToFile", HeaderFile="CoVMD_TrqDesCoord_Signals.h", DefinitionFile="CoVMD_TrqDesCoord_Signals.c", DataType="Torq", Min=-3000, Max=3000, Unit="Nm", InitialValue="0")  % Desired Propulsion Torque Nm
VMD_trqDes = Simulink.Signal(StorageClass="ExportToFile", HeaderFile="CoVMD_TrqDesCoord_Signals.h", DefinitionFile="CoVMD_TrqDesCoord_Signals.c", DataType="Torq", Min=-3000, Max=3000, Unit="Nm", InitialValue="0")  % propulsion  torque after driving assistance coordination
VehMot_facCompAcs = Simulink.Signal(StorageClass="ExportToFile", HeaderFile="CoVMD_TrqDesCoord_Signals.h", DefinitionFile="CoVMD_TrqDesCoord_Signals.c", DataType="Fac_10", Min=-4, Max=3.999, Unit="NaN", InitialValue="0")  % Compensation Fac_10 for loss compensation
VehMot_stPrpLLim = Simulink.Signal(StorageClass="ExportToFile", HeaderFile="CoVMD_TrqDesCoord_Signals.h", DefinitionFile="CoVMD_TrqDesCoord_Signals.c", DataType="boolean", Min=0, Max=1, Unit="NaN", InitialValue="0")  % Status longitudinal limiter controls propulsion torque
VehMot_stPrpCrCt = Simulink.Signal(StorageClass="ExportToFile", HeaderFile="CoVMD_TrqDesCoord_Signals.h", DefinitionFile="CoVMD_TrqDesCoord_Signals.c", DataType="boolean", Min=0, Max=1, Unit="NaN", InitialValue="0")  % Status cruise control overrides acceleration pedal
VMD_trqDesInThres_mp = Simulink.Signal(StorageClass="ExportToFile", HeaderFile="CoVMD_TrqDesCoord_Signals.h", DefinitionFile="CoVMD_TrqDesCoord_Signals.c", DataType="Torq", Min=-3000, Max=3000, Unit="Nm", InitialValue="0")  % Lead torque from driver and Variable Engine Speed Governor Nm
VMD_swtTrqSel_mp = Simulink.Signal(StorageClass="ExportToFile", HeaderFile="CoVMD_TrqDesCoord_Signals.h", DefinitionFile="CoVMD_TrqDesCoord_Signals.c", DataType="boolean", Min=0, Max=1, Unit="NaN", InitialValue="0")  % Driver demand - Cruise control torque selection switch
VMD_nsetplocomp_mp = Simulink.Signal(StorageClass="ExportToFile", HeaderFile="CoVMD_TrqDesCoord_Signals.h", DefinitionFile="CoVMD_TrqDesCoord_Signals.c", DataType="boolean", Min=0, Max=1, Unit="NaN", InitialValue="0")  % Compare of Minimum engine speed
VMD_appr_mp = Simulink.Signal(StorageClass="ExportToFile", HeaderFile="CoVMD_TrqDesCoord_Signals.h", DefinitionFile="CoVMD_TrqDesCoord_Signals.c", DataType="boolean", Min=0, Max=1, Unit="NaN", InitialValue="0")  % Compare of  app
VMD_trqdescomp_mp = Simulink.Signal(StorageClass="ExportToFile", HeaderFile="CoVMD_TrqDesCoord_Signals.h", DefinitionFile="CoVMD_TrqDesCoord_Signals.c", DataType="boolean", Min=0, Max=1, Unit="NaN", InitialValue="0")  % Compare of torque
VMD_accpedstbrkdes_mp = Simulink.Signal(StorageClass="ExportToFile", HeaderFile="CoVMD_TrqDesCoord_Signals.h", DefinitionFile="CoVMD_TrqDesCoord_Signals.c", DataType="boolean", Min=0, Max=1, Unit="NaN", InitialValue="0")  % Compare of status of brake pedal
CoVMD_facTrq_C = Simulink.Parameter(1, StorageClass="ExportToFile", HeaderFile="CoVMD_TrqDesCoord_Paras.h", DefinitionFile="CoVMD_TrqDesCoord_Paras.c", DataType="Fac_10", Min=-30, Max=30, Unit="NaN")  % Adjustment Fac_10 for the frictional torque
VMD_swtVCMActv_C = Simulink.Parameter(Switch.OFF, StorageClass="ExportToFile", HeaderFile="CoVMD_TrqDesCoord_Paras.h", DefinitionFile="CoVMD_TrqDesCoord_Paras.c", DataType="Enum: Switch", Unit="NaN")  % Switch to enable/disable Vehicle control mode
DrvDem_nSetPLo_C = Simulink.Parameter(0, StorageClass="ExportToFile", HeaderFile="CoVMD_TrqDesCoord_Paras.h", DefinitionFile="CoVMD_TrqDesCoord_Paras.c", DataType="ERPM", Min=-12000, Max=12000, Unit="rpm")  % Minimal engine speed of DrvDem
VMD_ACCPED = fi(1, 0, 8, 0)
VMD_CRUISE_CONTROL = fi(2, 0, 8, 0)
VMD_ENGINE_BRAKE = fi(10, 0, 8, 0)