% Simulink data dictionary VehCo_VehDem.sldd
% references slprj_cm.sldd
% references sl_ddtypes.sldd
% references sl_const.sldd

CoVeh_trqDes = Simulink.Signal(StorageClass="ExportToFile", HeaderFile="VehCo_VehDem_Signals.h", DefinitionFile="VehCo_VehDem_Signals.c", DataType="Torq", Min=-3000, Max=3000, Unit="Nm", InitialValue="0")  % Setpoint torque order to the drive train (gearbox output torque)